# Dynamo graph Adding Duct Insulation with Dynamo.dyn (Dynamo 2.6.1.8786)
# packages: MEPover 2020.6.2

# group: Duct Insulation / Duct Lining Type Names
element_types = ElementTypes("DuctLiningType")
all_elements_of_type = ElementsOfType(element_type=element_types)
name = FamilyType.Name(familyType=all_elements_of_type)
element_types_2 = ElementTypes("DuctInsulationType")
all_elements_of_type_2 = ElementsOfType(element_type=element_types_2)
name_2 = FamilyType.Name(familyType=all_elements_of_type_2)

watch = Watch(name_2)

# group: Categories for Duct / Duct Fittings Insulation
# note: Pragatheesh Kumar
# Script Summary:
# 1.Select all Supply Air duct by system type propertie.
# 2.User selects insulation family Type and Size to apply (USER INPUT).
# 3. Applies selected insulation to selected ductwork and duct fittings.
# Dynamo Package Used:
# - MEPover
code_block = CodeBlock()
# ---------- code_block.designscript (4 lines) ----------
//Revit categories to query system type

"Ducts";
"Duct Fittings";
# ----------------------------------------

# group: Collect all Duct and Duct Fitting Elements
byName = Category.ByName(name=code_block.out0)
all_elements_of_category = ElementsOfCategory(Category=byName)
byName_2 = Category.ByName(name=code_block.out1)
all_elements_of_category_2 = ElementsOfCategory(Category=byName_2)
list_create = List.Create(item0=all_elements_of_category, item1=all_elements_of_category_2)
flatten = List.Flatten(list=list_create)

# group: System Type
# note: The Input System type will receive will receive insulation from this script
code_block_2 = CodeBlock { "Supply Air"; }

# group: Get System type of Duct / Duct fittings, Filter by "Supply Air" only
code_block_3 = CodeBlock { "System Type"; }
getParameterValueByName = Element.GetParameterValueByName(element=flatten, parameterName=code_block_3)
name_3 = FamilyType.Name(familyType=getParameterValueByName)
eq = name_3 == code_block_2
filterByBoolMask = List.FilterByBoolMask(list=flatten, mask=eq)

# group: Input the desired Insulation type to apply
code_block_4 = CodeBlock(DuctInsdulationType=all_elements_of_type_2)
# ---------- code_block_4.designscript (2 lines) ----------
//Select the duct Insullation Type by Name
DuctInsdulationType[2];
# ----------------------------------------

# group: Input Insulation Thickness
code_block_5 = CodeBlock()
# ---------- code_block_5.designscript (3 lines) ----------
//Set Insulation Thickness
//Decimal Feet - (1.5/12)
thk = 50;
# ----------------------------------------

# group: Applies the selected Insulation to the filtered list of Duct and Duct Fittings
# note: MEPover Package
addInsulation = Custom[Element.AddInsulation](Elements=filterByBoolMask.in, InsulationType=code_block_4, Thickness=code_block_5)  # package MEPover; Adds insulation to pipe or duct networks
