# Dynamo graph Adding PipeInsulatorBySizeAndSystem with Dynamo.dyn (Dynamo 2.6.1.8786)
# packages: MEPover 2020.6.2

# note: Pragatheesh kumar
# Script Summary:
# 1. Grab all Pipes and Pipe Fittings, filter for System Type user input.
# 2. Get Pipe and Fitting sizes, filter based on size thresholds found in project Pipe Insulation schedule.
# 3. Choose an insulation type and size, apply it to filtered pipe system.
# Dynamo Version: v2.0.4
# Script Name: PipeInsulatorBySizeAndSystem (dyn2.0.4) v0.01.dyn
# Packages used in this script:
# MEPover version: 2019.8.1
# Clockwork for Dynamo 2.x version: 2.1.0

# group: Categories for needed all Pipes, PipeFittings, and PipeInsulations
code_block = CodeBlock { "Pipe Insulations"; "Pipes"; "Pipe Fittings"; }

# group: Collect all Pipes & PipeFitting elements
# note: * We split Pipes and PipeFittings to more easily call their size parameters later on.
byName = Category.ByName(name=code_block.out1)
all_elements_of_category = ElementsOfCategory(Category=byName)
byName_2 = Category.ByName(name=code_block.out2)
all_elements_of_category_2 = ElementsOfCategory(Category=byName_2)

# group: Get all PipeSystem Types in project
# note: Element.Types: This node should have "PipingSystemType" selected.
element_types = ElementTypes("PathReinSpanSymbol")
# note: User Interface
# note: Debug
# note: Input
all_elements_of_type = ElementsOfType(element_type=element_types)
# note: Edit Revit Document
# note: Process
# note: Edit OS Files
# note: Process - Optional
name = FamilyType.Name(familyType=all_elements_of_type)

# group: Input: Pipe System Type
pipe_system_type_select_index = IntegerSlider(4, range=-1..30 step 1)  # "PIPE SYSTEM TYPE, select index position"
# note: Select the desired Pipe System Type to receive insulation by inputting its index position from the list to the right: (may first require running the script once)
watch_system_types = Watch(name)

# group: select Pipe System Type Name by index position
# note: Select the Pipe System Type Name at user-input index position
getItemAtIndex = List.GetItemAtIndex(list=name, index=pipe_system_type_select_index)
code_block_2 = CodeBlock()  # frozen
# ---------- code_block_2.designscript (8 lines) ----------
// alternate input:
// write the Sys Type name:

"Domestic Cold Water";
"Domestic Hot Water";
"Vent";
"Storm";
"...";
# ----------------------------------------
watch_selected_pipe_system_type = Watch(getItemAtIndex)

# group: Filter through all Pipe elements for selected System Type
string = StringInput("System Type")
# note: Get the System Type of each particular element
# note: IN: Total list of all Pipe elements in model.
# OUT: Filtered list of Pipe elements matching input System Type
getParameterValueByName = Element.GetParameterValueByName(element=all_elements_of_category, parameterName=string)
# note: Get the name of each element's System Type
name_2 = FamilyType.Name(familyType=getParameterValueByName)
code_block_3 = CodeBlock(input_sys_type=getItemAtIndex) { input_sys_type; }
# note: T/F Test if element's Sys Type matches the desired input Sys Type
eq = name_2 == code_block_3  # lacing=CrossProduct
# note: Filter the entire list of Pipe elements for solely elements that match the desired input System Type name
filterByBoolMask = List.FilterByBoolMask(list=all_elements_of_category, mask=eq)

# group: Get Diameter size for ea Pipe
string_2 = StringInput("Diameter")
getParameterValueByName_2 = Element.GetParameterValueByName(element=filterByBoolMask.in, parameterName=string_2)

# group: Input:
smaller_than_pipe_size_a = DoubleSlider(1, range=0..8 step 0.001)  # "smaller than: PIPE SIZE A (diameter, inches)"
# note: * Index position sliders are set to -1 to begin.
larger_than_pipe_size_b_diameter = DoubleSlider(1.25, range=0..24 step 0.001)  # "larger than: PIPE SIZE B (diameter, inches)"
# note: ...receives insulation this thick:
# note: using this type of insulation:
pipe_insulation_type_a_select = IntegerSlider(2, range=-1..5 step 1)  # "PIPE INSULATION Type A, select index position"
pipe_insulation_type_b_select = IntegerSlider(2, range=-1..5 step 1)  # "PIPE INSULATION Type B, select index position"
# note: Pipes that are <this> size and SMALLER...
insulation_size_a_thickness = DoubleSlider(0.5, range=0..8 step 0.001)  # "INSULATION SIZE A (thickness, inches)"
# note: Pipes that are <this> size and LARGER...
insulation_size_b_thickness = DoubleSlider(1, range=0..8 step 0.001)  # "INSULATION SIZE B (thickness, inches)"

# group: Pipe Size Thresholds
# note: Get all pipes Smaller than Pipe Size A
# note: Get all pipes Larger than Pipe Size B
pipe_size_codeblock_for_clarity = CodeBlock(pipe_size_A=smaller_than_pipe_size_a, pipe_size_B=larger_than_pipe_size_b_diameter)
# ---------- pipe_size_codeblock_for_clarity.designscript (5 lines) ----------
// (Pipe Size A) and smaller (inch):
pipe_size_A;

// (Pipe Size B) and larger (inch):
pipe_size_B;
# ----------------------------------------

# group: Test Pipe Diameter vs. Size Threshold
# note: Test for pipeFitting sizes smaller than Size A, and larger than Size B.
# OUT: two seperate lists of bools, used for filter masks.
less_than_pipe_size_a = getParameterValueByName_2 <= pipe_size_codeblock_for_clarity.pipe_size_A
larger_than_pipe_size_b = getParameterValueByName_2 >= pipe_size_codeblock_for_clarity.pipe_size_B

# group: Get all Pipe Insulations in the model
element_types_2 = ElementTypes("Part")
all_elements_of_type_2 = ElementsOfType(element_type=element_types_2)
name_3 = FamilyType.Name(familyType=all_elements_of_type_2)

# group: select Insulation Types by index position
insulation_material = CodeBlock(i_A=pipe_insulation_type_a_select, i_B=pipe_insulation_type_b_select, ins_fam_types=all_elements_of_type_2)  # "INSULATION MATERIAL (GetItemAtIndex)x2"
# ---------- insulation_material.designscript (9 lines) ----------
i_A;
i_B;
ins_fam_types;

// PIPE INS. "Type A"
ins_fam_types[i_A];

//PIPE INS. "Type B"
ins_fam_types[i_B];
# ----------------------------------------
name_4 = FamilyType.Name(familyType=insulation_material.out3)
watch_pipe_insulation_type_a = Watch(name_4)
name_5 = FamilyType.Name(familyType=insulation_material.out4)
watch_pipe_insulation_type_b = Watch(name_5)

# group: Insulation Size Thickness (inch)
# note: Insulation thickness to apply to Pipe Size_B
# note: Insulation thickness to apply to Pipe Size_A
insulation_thickness = CodeBlock(ins_size_A=insulation_size_a_thickness, ins_size_B=insulation_size_b_thickness)
# ---------- insulation_thickness.designscript (5 lines) ----------
// ...to receive Insulation Size A (inch):
ins_size_A;

// ...to receive Insulation Size B (inch):
ins_size_B;
# ----------------------------------------

# group: Applies to PIPES: Ins_Size_A to Pipe_Size_A and Smaller
# note: Element.AddInsulation (MEPover)
# IN[0]: Elements matching input System Type
# IN[1]: InsulationType input
# IN[2]: Thickness (feet) input
list_filterbyboolmask_pipes_size = List.FilterByBoolMask(list=filterByBoolMask.in, mask=less_than_pipe_size_a)  # "List.FilterByBoolMask (PIPES SIZE_A)"
watch_insulation_type_element = Watch(insulation_material.out3)
convert_insulation_thickness_to = CodeBlock(inches_input=insulation_thickness.ins_size_A) { inches_input; feet_output = inches_input/12; }  # "Convert Insulation Thickness to Feet"
# note: Node Element.AddInsulation is from the MEPover package. Its underlying python script has been copied below to allow acces to those without the package.
addInsulation = Custom[Element.AddInsulation](Elements=list_filterbyboolmask_pipes_size.in, InsulationType=watch_insulation_type_element, Thickness=convert_insulation_thickness_to.feet_output)  # frozen; package MEPover; Adds insulation to pipe or duct networks
# note: Element.AddInsulation (MEPover)
# IN[0]: Elements (list)
# IN[1]: InsulationType
# IN[2]: Thickness (feet)
element_addinsulation_mepover = Python(IN[0]=list_filterbyboolmask_pipes_size.in, IN[1]=watch_insulation_type_element, IN[2]=convert_insulation_thickness_to.feet_output)
# ---------- element_addinsulation_mepover.python (61 lines) ----------
# Created by https://sites.google.com/site/bimstallatie/dynamo/mepover-package Copyright(c) 2016
# 01-31-2021 EvolveLAB modified paul@evolvelab.io

import clr

clr.AddReference("RevitServices")
import RevitServices
from RevitServices.Persistence import DocumentManager
from RevitServices.Transactions import TransactionManager
doc = DocumentManager.Instance.CurrentDBDocument

clr.AddReference("RevitAPI")
import Autodesk
from Autodesk.Revit.DB import *

clr.AddReference("RevitNodes")
import Revit
clr.ImportExtensions(Revit.Elements)
clr.ImportExtensions(Revit.GeometryConversion)

dut = doc.GetUnits().GetFormatOptions(UnitType.UT_Length).DisplayUnits
bool = dut == DisplayUnitType.DUT_MILLIMETERS

if isinstance(IN[0], list):
	pipes = UnwrapElement(IN[0])
else:
	pipes = [UnwrapElement(IN[0])]
if isinstance(IN[1], list):
	insultype = UnwrapElement(IN[1])
else:
	insultype = [UnwrapElement(IN[1])]
li = len(insultype)
if isinstance(IN[2], list):
	size = IN[2]
else:
	size = [IN[2]]
ls = len(size)

size = map(lambda x:UnitUtils.Convert(x,DisplayUnitType.DUT_MILLIMETERS,DisplayUnitType.DUT_DECIMAL_FEET) if bool else x, size)

failed = []
succes = []

TransactionManager.Instance.EnsureInTransaction(doc)
for i,pipe in enumerate(pipes):
	s = i%ls
	l = i%li
	try:
		Plumbing.PipeInsulation.Create(doc,pipe.Id,insultype[0].Id,size[0])
		succes.append(pipe)
	except:
		try:
			Mechanical.DuctInsulation.Create(doc,pipe.Id,insultype[l].Id,size[s])
			succes.append(pipe)
		except:
			failed.append(pipe)

TransactionManager.Instance.TransactionTaskDone()


OUT = succes, failed
# ----------------------------------------

# group: Applies to PIPES: Ins_Size_B to Pipe_Size_B and Larger
list_filterbyboolmask_pipes_size_2 = List.FilterByBoolMask(list=filterByBoolMask.in, mask=larger_than_pipe_size_b)  # "List.FilterByBoolMask (PIPES SIZE_B)"
watch_insulation_type_element_2 = Watch(insulation_material.out3)
convert_insulation_thickness_to_2 = CodeBlock(inches_input=insulation_thickness.ins_size_B) { inches_input; feet_output = inches_input/12; }  # "Convert Insulation Thickness to Feet"
# note: Node Element.AddInsulation is from the MEPover package. Its underlying python script has been copied below to allow acces to those without the package.
addInsulation_2 = Custom[Element.AddInsulation](Elements=list_filterbyboolmask_pipes_size_2.in, InsulationType=watch_insulation_type_element_2, Thickness=convert_insulation_thickness_to_2.feet_output)  # frozen
# note: Element.AddInsulation (MEPover)
# IN[0]: Elements (list)
# IN[1]: InsulationType
# IN[2]: Thickness (feet)
element_addinsulation_mepover_2 = Python(IN[0]=list_filterbyboolmask_pipes_size_2.in, IN[1]=watch_insulation_type_element_2, IN[2]=convert_insulation_thickness_to_2.feet_output)  # same code as element_addinsulation_mepover

# group: Filter through all PipeFitting elements for selected System Type
# note: IN: Total list of all PipeFitting elements in model.
# OUT: Filtered list of PipeFitting elements matching input System Type
string_3 = StringInput("System Type")
getParameterValueByName_3 = Element.GetParameterValueByName(element=all_elements_of_category_2, parameterName=string_3)
name_6 = FamilyType.Name(familyType=getParameterValueByName_3)
code_block_4 = CodeBlock(input_sys_type=getItemAtIndex) { input_sys_type; }
eq_2 = name_6 == code_block_4  # lacing=CrossProduct
filterByBoolMask_2 = List.FilterByBoolMask(list=all_elements_of_category_2, mask=eq_2)

# group: Get Nominal Diameter size for ea PipeFitting
string_4 = StringInput("Nominal Diameter")
getParameterValueByName_4 = Element.GetParameterValueByName(element=filterByBoolMask_2.in, parameterName=string_4)

# group: filter out 'blanks': Pipe/Fittings elements w/ more than one primary size, i.e. T-reducing
# note: ISSUE: Fittings with more than one nominal size (i.e. reducting Tees) will have a blank value for "Nominal Diameter". For the script to run, these elements need to be filtered out.
code_block_5 = CodeBlock { ""; }
# note: If an elements "Nominal Diameter" size parameter is not blank then this will return True, which we use for a filter mask applied to
ne = getParameterValueByName_4 != code_block_5
list_filterbyboolmask_elements = List.FilterByBoolMask(list=filterByBoolMask_2.in, mask=ne)
list_filterbyboolmask_sizes = List.FilterByBoolMask(list=getParameterValueByName_4, mask=ne)

# group: Test PipeFitting NominalDiameter vs. Size Threshold
larger_than = list_filterbyboolmask_sizes.in >= pipe_size_codeblock_for_clarity.pipe_size_B
# note: Test for pipeFitting sizes smaller than Size A, and larger than Size B.
# OUT: two seperate lists of bools, used for filter masks.
less_than = list_filterbyboolmask_sizes.in <= pipe_size_codeblock_for_clarity.pipe_size_A

# group: Applies to FITTINGS: Ins_Size_B to Pipe_Size_B and Larger
list_filterbyboolmask_pipe_size = List.FilterByBoolMask(list=list_filterbyboolmask_elements.in, mask=larger_than)  # "List.FilterByBoolMask (PIPE_SIZE_B)"
watch_insulation_type_element_3 = Watch(insulation_material.out4)
convert_insulation_thickness_to_3 = CodeBlock(inches_input=insulation_thickness.ins_size_B) { inches_input; feet_output = inches_input/12; }  # "Convert Insulation Thickness to Feet"
addInsulation_3 = Custom[Element.AddInsulation](Elements=list_filterbyboolmask_pipe_size.in, InsulationType=watch_insulation_type_element_3, Thickness=convert_insulation_thickness_to_3.feet_output)  # frozen
# note: Element.AddInsulation (MEPover)
# IN[0]: Elements (list)
# IN[1]: InsulationType
# IN[2]: Thickness (feet)
element_addinsulation_mepover_3 = Python(IN[0]=list_filterbyboolmask_pipe_size.in, IN[1]=watch_insulation_type_element_3, IN[2]=convert_insulation_thickness_to_3.feet_output)  # same code as element_addinsulation_mepover

# group: Applies to FITTINGS: Ins_Size_A to Pipe_Size_A and Smaller
list_filterbyboolmask_pipe_size_2 = List.FilterByBoolMask(list=list_filterbyboolmask_elements.in, mask=less_than)  # "List.FilterByBoolMask (PIPE_SIZE_B)"
watch_insulation_type_element_4 = Watch(insulation_material.out4)
convert_insulation_thickness_to_4 = CodeBlock(inches_input=insulation_thickness.ins_size_A) { inches_input; feet_output = inches_input/12; }  # "Convert Insulation Thickness to Feet"
addInsulation_4 = Custom[Element.AddInsulation](Elements=list_filterbyboolmask_pipe_size_2.in, InsulationType=watch_insulation_type_element_4, Thickness=convert_insulation_thickness_to_4.feet_output)  # frozen
# note: Element.AddInsulation (MEPover)
# IN[0]: Elements (list)
# IN[1]: InsulationType
# IN[2]: Thickness (feet)
element_addinsulation_mepover_4 = Python(IN[0]=list_filterbyboolmask_pipe_size_2.in, IN[1]=watch_insulation_type_element_4, IN[2]=convert_insulation_thickness_to_4.feet_output)  # same code as element_addinsulation_mepover

# note: Select the desired Pipe Insulation Type by inputting its index position from the list:
watch_pipe_insulation_types = Watch(name_3)
watch = Watch(pipe_insulation_type_a_select)
watch_2 = Watch(pipe_insulation_type_b_select)
