# Dynamo graph Analyzing Curves.dyn (Dynamo 1.3.4.6666)

number_slider = DoubleSlider(0, range=0..100 step 0.1)
number_slider_2 = DoubleSlider(0, range=0..100 step 0.1)
number_slider_3 = DoubleSlider(10, range=0..100 step 0.1)
byCoordinates = Point.ByCoordinates(x=number_slider, y=number_slider_2, z=number_slider_3)
number_slider_4 = DoubleSlider(3, range=0..100 step 0.1)
number_slider_5 = DoubleSlider(10, range=0..100 step 0.1)
number_slider_6 = DoubleSlider(15, range=0..100 step 0.1)
byCoordinates_2 = Point.ByCoordinates(x=number_slider_4, y=number_slider_5, z=number_slider_6)
byStartPointEndPoint = Line.ByStartPointEndPoint(startPoint=byCoordinates, endPoint=byCoordinates_2)
number_slider_7 = DoubleSlider(12, range=0..112 step 0.1)
number_slider_8 = DoubleSlider(10, range=0..100 step 0.1)
number_slider_9 = DoubleSlider(15, range=0..100 step 0.1)
byCoordinates_3 = Point.ByCoordinates(x=number_slider_7, y=number_slider_8, z=number_slider_9)
number_slider_10 = DoubleSlider(12.7, range=0..100 step 0.1)
byCoordinates_4 = Point.ByCoordinates(x=number_slider_9, y=number_slider_4, z=number_slider_10)
byStartPointEndPoint_2 = Line.ByStartPointEndPoint(startPoint=byCoordinates_3, endPoint=byCoordinates_4)
create = List.Create(byStartPointEndPoint, byStartPointEndPoint_2)
byLoft = Surface.ByLoft(create)
file_path = Filename("C:\Users\Pragatheesh\Desktop\CANOPY.SAT")
exportToSAT = ExportWithUnits(byLoft, file_path, exportedUnit=Feet)  # frozen
family_types = FamilyTypes("Light_Canopy:Light_Canopy")
number = DoubleInput(0)
number_2 = DoubleInput(1)
number_3 = DoubleInput(0.2)
range = Range(start=number, end=number_2, step=number_3, lacing=CrossProduct)
pointAtParameter = Surface.PointAtParameter(surface=byLoft, u=range, v=range, lacing=CrossProduct)
byPoint = FamilyInstance.ByPoint(familyType=family_types, point=pointAtParameter)
number_4 = DoubleInput(0)
number_5 = DoubleInput(1)
create_2 = List.Create(number_4, number_5)
number_6 = DoubleInput(0.2)
number_7 = DoubleInput(0.8)
number_8 = DoubleInput(0.2)
range_2 = Range(start=number_6, end=number_7, step=number_8, lacing=Longest)
pointAtParameter_2 = Surface.PointAtParameter(surface=byLoft, u=create_2, v=range_2, lacing=CrossProduct)
transpose = List.Transpose(pointAtParameter_2)
byPoints = PolyCurve.ByPoints(points=transpose)
levels = Levels("Level 1")
structural_framing_types = StructuralFramingTypes("Canopy Structure")
beamByCurve = StructuralFraming.BeamByCurve(curve=byPoints, level=levels, structuralFramingType=structural_framing_types)
perimeterCurves = Surface.PerimeterCurves(byLoft)
XY = Plane.XY()
pullOntoPlane = Curve.PullOntoPlane(curve=perimeterCurves, plane=XY)
floor_types = FloorTypes("Finish - Sidewalk Accent")
byOutlineTypeAndLevel = Floor.ByOutlineTypeAndLevel(outlineCurves=pullOntoPlane, floorType=floor_types, level=levels)
number_9 = DoubleInput(0)
number_10 = DoubleInput(2)
create_3 = List.Create(number_9, number_10)
getItemAtIndex = List.GetItemAtIndex(list=pullOntoPlane, index=create_3)
number_11 = DoubleInput(3)
wall_types = WallTypes("Exterior - Knee Wall")
byCurveAndHeight = Wall.ByCurveAndHeight(curve=getItemAtIndex, height=number_11, level=levels, wallType=wall_types)
