# Dynamo graph Attractor Sphere.dyn (Dynamo 1.3.3.4111)

code_block = CodeBlock { 0..100..#5; }
byCoordinates = Point.ByCoordinates(x=code_block, y=code_block, z=code_block, lacing=CrossProduct)
code_block_2 = CodeBlock(Pt=byCoordinates) { sphereByZ(Pt); }
code_block_3 = CodeBlock()
# ---------- code_block_3.designscript (10 lines) ----------
def sphereByZ(inputPt)
{
 //get inputPt variables
 sphereRadius=(inputPt.Z)/20;

 //define sphere
 sphere=Sphere.ByCenterPointRadius(inputPt,sphereRadius);
 //finally, define the function's output with 'return'
 return=sphere;
};
# ----------------------------------------
