# Dynamo graph Calatrava door - one.dyn (Dynamo 0.7.6.4190)

code_block = CodeBlock { 0; }
byCoordinates = Point.ByCoordinates(code_block, code_block, code_block)
YAxis = Vector.YAxis()
code_block_2 = CodeBlock { 80; }
byStartPointDirectionLength = Line.ByStartPointDirectionLength(byCoordinates, YAxis, code_block_2)
ZAxis = Vector.ZAxis()
number_slider = DoubleSlider(20, range=0..20 step 0.01)
translate = Geometry.Translate(byStartPointDirectionLength, ZAxis, number_slider)
code_block_3 = CodeBlock { 0..1..0.02; }
planeAtParameter = Curve.PlaneAtParameter(translate, code_block_3)
origin = Plane.Origin(planeAtParameter)
count = Count(code_block_3)
code_block_4 = CodeBlock(x=count) { 180/x; }
number_slider_2 = DoubleSlider(4.5, range=1..9 step 0.01)
code_block_5 = CodeBlock(x=code_block_2) { x/2.5; }
code_block_6 = CodeBlock(x=code_block_5) { x/1.9; }
code_block_7 = CodeBlock(x=code_block_4, p=number_slider_2, y=code_block_6) { -(Math.Sin(0..180..x)*p)+y; }
count_2 = Count(code_block_7)
removeItemAtIndex = List.RemoveItemAtIndex(code_block_7, count_2)
code_block_8 = CodeBlock { -90; }
code_block_9 = CodeBlock { 100; }
YAxis_2 = Vector.YAxis()
byCenterPointRadiusAngle = Arc.ByCenterPointRadiusAngle(origin, removeItemAtIndex, code_block_8, code_block_9, YAxis_2)
ZAxis_2 = Vector.ZAxis()
translate_2 = Geometry.Translate(byStartPointDirectionLength, ZAxis_2, code_block_5)
planeAtParameter_2 = Curve.PlaneAtParameter(translate_2, code_block_3)
origin_2 = Plane.Origin(planeAtParameter_2)
code_block_10 = CodeBlock(x=code_block_5, y=removeItemAtIndex) { x-y; }
code_block_11 = CodeBlock { -270; }
code_block_12 = CodeBlock { 270; }
byCenterPointRadiusAngle_2 = Arc.ByCenterPointRadiusAngle(origin_2, code_block_10, code_block_11, code_block_12, YAxis_2)
intersect = Geometry.Intersect(byCenterPointRadiusAngle, byCenterPointRadiusAngle_2)
flatten = Flatten(intersect)
flatten_2 = Flatten(origin)
byStartPointEndPoint = Line.ByStartPointEndPoint(flatten, flatten_2)
flatten_3 = Flatten(byStartPointEndPoint)
count_3 = Count(flatten_3)
code_block_13 = CodeBlock(x=count_3) { x-1; }
removeItemAtIndex_2 = List.RemoveItemAtIndex(flatten_3, code_block_13)
count_4 = Count(code_block_3)
code_block_14 = CodeBlock(x=code_block_2, y=count_4) { (x/y)*0.87; }
extrude = Curve.Extrude(removeItemAtIndex_2, YAxis, code_block_14)
code_block_15 = CodeBlock { -0.25; }
thicken = Surface.Thicken(extrude, code_block_15)
byGeometry = ImportInstance.ByGeometry(thicken)
flatten_4 = Flatten(intersect)
flatten_5 = Flatten(origin_2)
byStartPointEndPoint_2 = Line.ByStartPointEndPoint(flatten_4, flatten_5)
flatten_6 = Flatten(byStartPointEndPoint_2)
count_5 = Count(flatten_6)
code_block_16 = CodeBlock(x=count_5) { x-1; }
removeItemAtIndex_3 = List.RemoveItemAtIndex(byStartPointEndPoint_2, code_block_16)
extrude_2 = Curve.Extrude(removeItemAtIndex_3, YAxis, code_block_14)
code_block_17 = CodeBlock { 0.25; }
thicken_2 = Surface.Thicken(extrude_2, code_block_17)
byGeometry_2 = ImportInstance.ByGeometry(thicken_2)
