# Dynamo graph Chair.dyn (Dynamo 1.3.4.6666)

family_types = FamilyTypes("M_Chair-Desk:Desk Chair")
number = DoubleInput(0)
number_2 = DoubleInput(15)
number_3 = DoubleInput(500)
sequence = Sequence(start=number, amount=number_2, step=number_3, lacing=Longest)
number_4 = DoubleInput(0)
number_5 = DoubleInput(15)
number_6 = DoubleInput(500)
sequence_2 = Sequence(start=number_4, amount=number_5, step=number_6, lacing=Longest)
byCoordinates = Point.ByCoordinates(x=sequence, y=sequence_2, lacing=CrossProduct)
byPoint = FamilyInstance.ByPoint(familyType=family_types, point=byCoordinates)
