# Dynamo graph Create plane.dyn (Dynamo 1.3.4.6666)

# group: Create Plane
number_slider = DoubleSlider(17.2, range=0..100 step 0.1)
number_slider_2 = DoubleSlider(27, range=0..100 step 0.1)
number_slider_3 = DoubleSlider(20, range=0..100 step 0.1)
byCoordinates = Vector.ByCoordinates(x=number_slider, y=number_slider_2, z=number_slider_3)
byOriginNormal = Plane.ByOriginNormal(normal=byCoordinates)

# group: Create circle in a plane
number_slider_4 = DoubleSlider(7, range=0..100 step 0.1)
byPlaneRadius = Circle.ByPlaneRadius(plane=byOriginNormal, radius=number_slider_4)
