# Dynamo graph Creation of a Dashboard in Dynamo with Mandrill.dyn "D_6-Creation of a Dashboard in Dynamo with Mandrill" (Dynamo 2.3.0.5885)
# packages: Archi-lab_Mandrill 2020.2.1

categories = Categories("OST_Rooms")  # graph input
all_elements_of_category = ElementsOfCategory(Category=categories)
code_block = CodeBlock()
# ---------- code_block.designscript (4 lines) ----------
[
"Name",
"Area"
];
# ----------------------------------------
getParameterValueByName = Element.GetParameterValueByName(element=all_elements_of_category, parameterName=code_block, lacing=CrossProduct)
transpose = List.Transpose(lists=getParameterValueByName)

# group: Area
code_block_2 = CodeBlock { 1; }
getItemAtIndex = List.GetItemAtIndex(list=transpose, index=code_block_2)

# group: Name
code_block_3 = CodeBlock { 0; }
getItemAtIndex_2 = List.GetItemAtIndex(list=transpose, index=code_block_3)

groupByKey = List.GroupByKey(list=getItemAtIndex, keys=getItemAtIndex_2)

# group: Data for Bar Chart
watch = Watch(groupByKey.unique_keys)
watch_2 = Watch(groupByKey.groups)
sum = Math.Sum(values=watch_2)

# group: Bar Chart
minimumItem = List.MinimumItem(list=sum)
maximumItem = List.MaximumItem(list=sum)
domain = Charts.MiscNodes.Domain(A=minimumItem, B=maximumItem)
data = Charts.BarChart.Data(Names=watch, Values=sum, Domain=domain)
count = List.Count(list=sum)
boolean = BoolSelector(true)  # graph input
style = Charts.BarChart.Style(TickMarksX=count, xTextRotation=boolean)
chart = Charts.BarChart.Chart(Data=data, Style=style)

# group: Description
code_block_4 = CodeBlock { "this is a dashboard"; }
style_2 = Text.Text.Style()
create = Text.Text.Create(Text=code_block_4, Style=style_2)

create_report = MandrillReportNode(Chart0=chart, Chart1=create)
report_window = MandrillWindowNodeModel(Report=create_report, IsWindowClosed=true, Message=""" Launch
Window""")
