# Dynamo graph Curling bridge - final stage - pre bake - two.dyn (Dynamo 0.7.6.4190)

code_block = CodeBlock {  }
code_block_2 = CodeBlock { 0; 20; }
byCoordinates = Point.ByCoordinates(code_block_2.out0, code_block_2.out0, code_block_2.out1)
XAxis = Vector.XAxis()
byOriginNormal = Plane.ByOriginNormal(byCoordinates, XAxis)
byPlaneRadius = Circle.ByPlaneRadius(byOriginNormal, code_block_2.out1)
code_block_3 = CodeBlock { 360/8; }
code_block_4 = CodeBlock(x=code_block_3) { x/2; }
rotate = Geometry.Rotate(byPlaneRadius, byOriginNormal, code_block_4)
code_block_5 = CodeBlock { 8; }
regularPolygon = Polygon.RegularPolygon(rotate, code_block_5)
explode = Geometry.Explode(regularPolygon)
code_block_6 = CodeBlock { 5; }
getItemAtIndex = List.GetItemAtIndex(explode, code_block_6)
endPoint = Curve.EndPoint(getItemAtIndex)
startPoint = Curve.StartPoint(getItemAtIndex)
byTwoPoints = Vector.ByTwoPoints(endPoint, startPoint)
code_block_7 = CodeBlock { 0.55; }
translate = Geometry.Translate(endPoint, byTwoPoints, code_block_7)
byTwoPoints_2 = Vector.ByTwoPoints(startPoint, endPoint)
translate_2 = Geometry.Translate(startPoint, byTwoPoints_2, code_block_7)
byStartPointEndPoint = Line.ByStartPointEndPoint(translate, translate_2)
XAxis_2 = Vector.XAxis()
code_block_8 = CodeBlock { 15; }
extrude = Curve.Extrude(byStartPointEndPoint, XAxis_2, code_block_8)
code_block_9 = CodeBlock { 0.4; }
thicken = Surface.Thicken(extrude, code_block_9)
centerPoint = Circle.CenterPoint(rotate)
ZAxis = Vector.ZAxis()
reverse = Vector.Reverse(ZAxis)
code_block_10 = CodeBlock { 5; }
translate_3 = Geometry.Translate(centerPoint, reverse, code_block_10)
byTwoPoints_3 = Vector.ByTwoPoints(translate_3, translate_2)
code_block_11 = CodeBlock { 6; }
translate_4 = Geometry.Translate(translate_3, byTwoPoints_3, code_block_11)
byTwoPoints_4 = Vector.ByTwoPoints(translate_3, translate)
translate_5 = Geometry.Translate(translate_3, byTwoPoints_4, code_block_11)
create = List.Create(translate, translate_2, translate_4, translate_5)
code_block_12 = CodeBlock { 1; }
boolean = BoolSelector(true)
byControlPoints = NurbsCurve.ByControlPoints(create, code_block_12, boolean)
code_block_13 = CodeBlock { 3; }
byControlPoints_2 = NurbsCurve.ByControlPoints(create, code_block_13, boolean)
create_2 = List.Create(byControlPoints, byControlPoints_2)
byLoft = Surface.ByLoft(create_2)
thicken_2 = Surface.Thicken(byLoft, code_block_9)
translate_6 = Geometry.Translate(thicken_2, XAxis_2, code_block_8)
byStartPointEndPoint_2 = Line.ByStartPointEndPoint(translate_5, translate_4)
code_block_14 = CodeBlock { 0.25..0.75..0.05; }
planeAtParameter = Curve.PlaneAtParameter(byStartPointEndPoint_2, code_block_14)
origin = Plane.Origin(planeAtParameter)
planeAtParameter_2 = Curve.PlaneAtParameter(byStartPointEndPoint, code_block_14)
origin_2 = Plane.Origin(planeAtParameter_2)
byStartPointEndPoint_3 = Line.ByStartPointEndPoint(origin, origin_2)
code_block_15 = CodeBlock { 0..1..1; }
planeAtParameter_3 = Curve.PlaneAtParameter(byStartPointEndPoint_3, code_block_15, lacing=CrossProduct)
code_block_16 = CodeBlock { 0.05; }
byPlaneRadius_2 = Circle.ByPlaneRadius(planeAtParameter_3, code_block_16)
byLoft_2 = Surface.ByLoft(byPlaneRadius_2)
code_block_17 = CodeBlock(x=code_block_8) { x-0.4; }
translate_7 = Geometry.Translate(byLoft_2, XAxis_2, code_block_17)
startPoint_2 = Curve.StartPoint(getItemAtIndex)
endPoint_2 = Curve.EndPoint(getItemAtIndex)
byTwoPoints_5 = Vector.ByTwoPoints(endPoint_2, startPoint_2)
byStartPointEndPoint_4 = Line.ByStartPointEndPoint(endPoint_2, startPoint_2)
length = Curve.Length(byStartPointEndPoint_4)
byStartPointDirectionLength = Line.ByStartPointDirectionLength(startPoint_2, byTwoPoints_5, length)
XAxis_3 = Vector.XAxis()
number_slider = DoubleSlider(-25, range=-45..0 step 0.1)
rotate_2 = Geometry.Rotate(byStartPointDirectionLength, startPoint_2, XAxis_3, number_slider)
endPoint_3 = Curve.EndPoint(rotate_2)
startPoint_3 = Curve.StartPoint(rotate_2)
byStartPointEndPoint_5 = Line.ByStartPointEndPoint(endPoint_3, startPoint_3)
code_block_18 = CodeBlock { 0.5; }
planeAtParameter_4 = Curve.PlaneAtParameter(byStartPointEndPoint_5, code_block_18)
origin_3 = Plane.Origin(planeAtParameter_4)
byStartPointEndPoint_6 = Line.ByStartPointEndPoint(origin_3, endPoint_3)
XAxis_4 = Vector.XAxis()
byOriginNormal_2 = Plane.ByOriginNormal(origin_3, XAxis_4)
code_block_19 = CodeBlock { 90; }
rotate_3 = Geometry.Rotate(byStartPointEndPoint_6, byOriginNormal_2, code_block_19)
startPoint_4 = Curve.StartPoint(rotate_3)
endPoint_4 = Curve.EndPoint(rotate_3)
byTwoPoints_6 = Vector.ByTwoPoints(endPoint_4, startPoint_4)
code_block_20 = CodeBlock { 13.5; }
translate_8 = Geometry.Translate(startPoint_4, byTwoPoints_6, code_block_20)
byTwoPoints_7 = Vector.ByTwoPoints(endPoint_3, startPoint_3)
code_block_21 = CodeBlock { 0.55; }
translate_9 = Geometry.Translate(endPoint_3, byTwoPoints_7, code_block_21)
byTwoPoints_8 = Vector.ByTwoPoints(translate_8, translate_9)
code_block_22 = CodeBlock { 6; }
translate_10 = Geometry.Translate(translate_8, byTwoPoints_8, code_block_22)
byTwoPoints_9 = Vector.ByTwoPoints(startPoint_3, endPoint_3)
translate_11 = Geometry.Translate(startPoint_3, byTwoPoints_9, code_block_21)
byTwoPoints_10 = Vector.ByTwoPoints(translate_8, translate_11)
translate_12 = Geometry.Translate(translate_8, byTwoPoints_10, code_block_22)
byStartPointEndPoint_7 = Line.ByStartPointEndPoint(translate_10, translate_12)
code_block_23 = CodeBlock { 0.25..0.75..0.05; }
planeAtParameter_5 = Curve.PlaneAtParameter(byStartPointEndPoint_7, code_block_23)
origin_4 = Plane.Origin(planeAtParameter_5)
byStartPointEndPoint_8 = Line.ByStartPointEndPoint(translate_9, translate_11)
planeAtParameter_6 = Curve.PlaneAtParameter(byStartPointEndPoint_8, code_block_23)
origin_5 = Plane.Origin(planeAtParameter_6)
byStartPointEndPoint_9 = Line.ByStartPointEndPoint(origin_4, origin_5)
code_block_24 = CodeBlock { 0..1..1; }
planeAtParameter_7 = Curve.PlaneAtParameter(byStartPointEndPoint_9, code_block_24, lacing=CrossProduct)
code_block_25 = CodeBlock { 0.05; }
byPlaneRadius_3 = Circle.ByPlaneRadius(planeAtParameter_7, code_block_25)
byLoft_3 = Surface.ByLoft(byPlaneRadius_3)
XAxis_5 = Vector.XAxis()
code_block_26 = CodeBlock { 15; }
code_block_27 = CodeBlock(x=code_block_26) { x-0.4; }
translate_13 = Geometry.Translate(byLoft_3, XAxis_5, code_block_27)
extrude_2 = Curve.Extrude(byStartPointEndPoint_8, XAxis_5, code_block_26)
code_block_28 = CodeBlock { 0.4; }
thicken_3 = Surface.Thicken(extrude_2, code_block_28)
create_3 = List.Create(translate_9, translate_11, translate_12, translate_10)
code_block_29 = CodeBlock { 1; }
boolean_2 = BoolSelector(true)
byControlPoints_3 = NurbsCurve.ByControlPoints(create_3, code_block_29, boolean_2)
code_block_30 = CodeBlock { 3; }
byControlPoints_4 = NurbsCurve.ByControlPoints(create_3, code_block_30, boolean_2)
create_4 = List.Create(byControlPoints_3, byControlPoints_4)
byLoft_4 = Surface.ByLoft(create_4)
thicken_4 = Surface.Thicken(byLoft_4, code_block_28)
translate_14 = Geometry.Translate(thicken_4, XAxis_5, code_block_26)
code_block_31 = CodeBlock { 0.5; }
planeAtParameter_8 = Curve.PlaneAtParameter(getItemAtIndex, code_block_31)
origin_6 = Plane.Origin(planeAtParameter_8)
distanceTo = Geometry.DistanceTo(centerPoint, origin_6)
code_block_32 = CodeBlock(x=distanceTo) { x-5; }
endPoint_5 = Curve.EndPoint(rotate_2)
startPoint_5 = Curve.StartPoint(rotate_2)
byTwoPoints_11 = Vector.ByTwoPoints(startPoint_5, endPoint_5)
byStartPointEndPoint_10 = Line.ByStartPointEndPoint(endPoint_5, startPoint_5)
length_2 = Curve.Length(byStartPointEndPoint_10)
byStartPointDirectionLength_2 = Line.ByStartPointDirectionLength(endPoint_5, byTwoPoints_11, length_2)
XAxis_6 = Vector.XAxis()
rotate_4 = Geometry.Rotate(byStartPointDirectionLength_2, endPoint_5, XAxis_6, number_slider)
endPoint_6 = Curve.EndPoint(rotate_4)
startPoint_6 = Curve.StartPoint(rotate_4)
byStartPointEndPoint_11 = Line.ByStartPointEndPoint(endPoint_6, startPoint_6)
code_block_33 = CodeBlock { 0.5; }
planeAtParameter_9 = Curve.PlaneAtParameter(byStartPointEndPoint_11, code_block_33)
origin_7 = Plane.Origin(planeAtParameter_9)
byStartPointEndPoint_12 = Line.ByStartPointEndPoint(origin_7, endPoint_6)
XAxis_7 = Vector.XAxis()
byOriginNormal_3 = Plane.ByOriginNormal(origin_7, XAxis_7)
code_block_34 = CodeBlock { 90; }
rotate_5 = Geometry.Rotate(byStartPointEndPoint_12, byOriginNormal_3, code_block_34)
startPoint_7 = Curve.StartPoint(rotate_5)
endPoint_7 = Curve.EndPoint(rotate_5)
byTwoPoints_12 = Vector.ByTwoPoints(endPoint_7, startPoint_7)
code_block_35 = CodeBlock { 13.5; }
translate_15 = Geometry.Translate(startPoint_7, byTwoPoints_12, code_block_35)
byTwoPoints_13 = Vector.ByTwoPoints(endPoint_6, startPoint_6)
code_block_36 = CodeBlock { 0.55; }
translate_16 = Geometry.Translate(endPoint_6, byTwoPoints_13, code_block_36)
byTwoPoints_14 = Vector.ByTwoPoints(translate_15, translate_16)
code_block_37 = CodeBlock { 6; }
translate_17 = Geometry.Translate(translate_15, byTwoPoints_14, code_block_37)
byTwoPoints_15 = Vector.ByTwoPoints(startPoint_6, endPoint_6)
translate_18 = Geometry.Translate(startPoint_6, byTwoPoints_15, code_block_36)
byTwoPoints_16 = Vector.ByTwoPoints(translate_15, translate_18)
translate_19 = Geometry.Translate(translate_15, byTwoPoints_16, code_block_37)
byStartPointEndPoint_13 = Line.ByStartPointEndPoint(translate_17, translate_19)
code_block_38 = CodeBlock { 0.25..0.75..0.05; }
planeAtParameter_10 = Curve.PlaneAtParameter(byStartPointEndPoint_13, code_block_38)
origin_8 = Plane.Origin(planeAtParameter_10)
byStartPointEndPoint_14 = Line.ByStartPointEndPoint(translate_16, translate_18)
planeAtParameter_11 = Curve.PlaneAtParameter(byStartPointEndPoint_14, code_block_38)
origin_9 = Plane.Origin(planeAtParameter_11)
byStartPointEndPoint_15 = Line.ByStartPointEndPoint(origin_8, origin_9)
code_block_39 = CodeBlock { 0..1..1; }
planeAtParameter_12 = Curve.PlaneAtParameter(byStartPointEndPoint_15, code_block_39, lacing=CrossProduct)
code_block_40 = CodeBlock { 0.05; }
byPlaneRadius_4 = Circle.ByPlaneRadius(planeAtParameter_12, code_block_40)
byLoft_5 = Surface.ByLoft(byPlaneRadius_4)
XAxis_8 = Vector.XAxis()
code_block_41 = CodeBlock { 15; }
code_block_42 = CodeBlock(x=code_block_41) { x-0.4; }
translate_20 = Geometry.Translate(byLoft_5, XAxis_8, code_block_42)
extrude_3 = Curve.Extrude(byStartPointEndPoint_14, XAxis_8, code_block_41)
code_block_43 = CodeBlock { 0.4; }
thicken_5 = Surface.Thicken(extrude_3, code_block_43)
create_5 = List.Create(translate_16, translate_18, translate_19, translate_17)
code_block_44 = CodeBlock { 1; }
boolean_3 = BoolSelector(true)
byControlPoints_5 = NurbsCurve.ByControlPoints(create_5, code_block_44, boolean_3)
code_block_45 = CodeBlock { 3; }
byControlPoints_6 = NurbsCurve.ByControlPoints(create_5, code_block_45, boolean_3)
create_6 = List.Create(byControlPoints_5, byControlPoints_6)
byLoft_6 = Surface.ByLoft(create_6)
thicken_6 = Surface.Thicken(byLoft_6, code_block_43)
translate_21 = Geometry.Translate(thicken_6, XAxis_8, code_block_41)
endPoint_8 = Curve.EndPoint(rotate_4)
startPoint_8 = Curve.StartPoint(rotate_4)
byTwoPoints_17 = Vector.ByTwoPoints(startPoint_8, endPoint_8)
byStartPointEndPoint_16 = Line.ByStartPointEndPoint(endPoint_8, startPoint_8)
length_3 = Curve.Length(byStartPointEndPoint_16)
byStartPointDirectionLength_3 = Line.ByStartPointDirectionLength(endPoint_8, byTwoPoints_17, length_3)
XAxis_9 = Vector.XAxis()
rotate_6 = Geometry.Rotate(byStartPointDirectionLength_3, endPoint_8, XAxis_9, number_slider)
endPoint_9 = Curve.EndPoint(rotate_6)
startPoint_9 = Curve.StartPoint(rotate_6)
byStartPointEndPoint_17 = Line.ByStartPointEndPoint(endPoint_9, startPoint_9)
code_block_46 = CodeBlock { 0.5; }
planeAtParameter_13 = Curve.PlaneAtParameter(byStartPointEndPoint_17, code_block_46)
origin_10 = Plane.Origin(planeAtParameter_13)
byStartPointEndPoint_18 = Line.ByStartPointEndPoint(origin_10, endPoint_9)
XAxis_10 = Vector.XAxis()
byOriginNormal_4 = Plane.ByOriginNormal(origin_10, XAxis_10)
code_block_47 = CodeBlock { 90; }
rotate_7 = Geometry.Rotate(byStartPointEndPoint_18, byOriginNormal_4, code_block_47)
startPoint_10 = Curve.StartPoint(rotate_7)
endPoint_10 = Curve.EndPoint(rotate_7)
byTwoPoints_18 = Vector.ByTwoPoints(endPoint_10, startPoint_10)
code_block_48 = CodeBlock { 13.5; }
translate_22 = Geometry.Translate(startPoint_10, byTwoPoints_18, code_block_48)
byTwoPoints_19 = Vector.ByTwoPoints(endPoint_9, startPoint_9)
code_block_49 = CodeBlock { 0.55; }
translate_23 = Geometry.Translate(endPoint_9, byTwoPoints_19, code_block_49)
byTwoPoints_20 = Vector.ByTwoPoints(translate_22, translate_23)
code_block_50 = CodeBlock { 6; }
translate_24 = Geometry.Translate(translate_22, byTwoPoints_20, code_block_50)
byTwoPoints_21 = Vector.ByTwoPoints(startPoint_9, endPoint_9)
translate_25 = Geometry.Translate(startPoint_9, byTwoPoints_21, code_block_49)
byTwoPoints_22 = Vector.ByTwoPoints(translate_22, translate_25)
translate_26 = Geometry.Translate(translate_22, byTwoPoints_22, code_block_50)
byStartPointEndPoint_19 = Line.ByStartPointEndPoint(translate_24, translate_26)
code_block_51 = CodeBlock { 0.25..0.75..0.05; }
planeAtParameter_14 = Curve.PlaneAtParameter(byStartPointEndPoint_19, code_block_51)
origin_11 = Plane.Origin(planeAtParameter_14)
byStartPointEndPoint_20 = Line.ByStartPointEndPoint(translate_23, translate_25)
planeAtParameter_15 = Curve.PlaneAtParameter(byStartPointEndPoint_20, code_block_51)
origin_12 = Plane.Origin(planeAtParameter_15)
byStartPointEndPoint_21 = Line.ByStartPointEndPoint(origin_11, origin_12)
code_block_52 = CodeBlock { 0..1..1; }
planeAtParameter_16 = Curve.PlaneAtParameter(byStartPointEndPoint_21, code_block_52, lacing=CrossProduct)
code_block_53 = CodeBlock { 0.05; }
byPlaneRadius_5 = Circle.ByPlaneRadius(planeAtParameter_16, code_block_53)
byLoft_7 = Surface.ByLoft(byPlaneRadius_5)
XAxis_11 = Vector.XAxis()
code_block_54 = CodeBlock { 15; }
code_block_55 = CodeBlock(x=code_block_54) { x-0.4; }
translate_27 = Geometry.Translate(byLoft_7, XAxis_11, code_block_55)
extrude_4 = Curve.Extrude(byStartPointEndPoint_20, XAxis_11, code_block_54)
code_block_56 = CodeBlock { 0.4; }
thicken_7 = Surface.Thicken(extrude_4, code_block_56)
create_7 = List.Create(translate_23, translate_25, translate_26, translate_24)
code_block_57 = CodeBlock { 1; }
boolean_4 = BoolSelector(true)
byControlPoints_7 = NurbsCurve.ByControlPoints(create_7, code_block_57, boolean_4)
code_block_58 = CodeBlock { 3; }
byControlPoints_8 = NurbsCurve.ByControlPoints(create_7, code_block_58, boolean_4)
create_8 = List.Create(byControlPoints_7, byControlPoints_8)
byLoft_8 = Surface.ByLoft(create_8)
thicken_8 = Surface.Thicken(byLoft_8, code_block_56)
translate_28 = Geometry.Translate(thicken_8, XAxis_11, code_block_54)
endPoint_11 = Curve.EndPoint(rotate_6)
startPoint_11 = Curve.StartPoint(rotate_6)
byTwoPoints_23 = Vector.ByTwoPoints(startPoint_11, endPoint_11)
byStartPointEndPoint_22 = Line.ByStartPointEndPoint(endPoint_11, startPoint_11)
length_4 = Curve.Length(byStartPointEndPoint_22)
byStartPointDirectionLength_4 = Line.ByStartPointDirectionLength(endPoint_11, byTwoPoints_23, length_4)
XAxis_12 = Vector.XAxis()
rotate_8 = Geometry.Rotate(byStartPointDirectionLength_4, endPoint_11, XAxis_12, number_slider)
endPoint_12 = Curve.EndPoint(rotate_8)
startPoint_12 = Curve.StartPoint(rotate_8)
byStartPointEndPoint_23 = Line.ByStartPointEndPoint(endPoint_12, startPoint_12)
code_block_59 = CodeBlock { 0.5; }
planeAtParameter_17 = Curve.PlaneAtParameter(byStartPointEndPoint_23, code_block_59)
origin_13 = Plane.Origin(planeAtParameter_17)
byStartPointEndPoint_24 = Line.ByStartPointEndPoint(origin_13, endPoint_12)
XAxis_13 = Vector.XAxis()
byOriginNormal_5 = Plane.ByOriginNormal(origin_13, XAxis_13)
code_block_60 = CodeBlock { 90; }
rotate_9 = Geometry.Rotate(byStartPointEndPoint_24, byOriginNormal_5, code_block_60)
startPoint_13 = Curve.StartPoint(rotate_9)
endPoint_13 = Curve.EndPoint(rotate_9)
byTwoPoints_24 = Vector.ByTwoPoints(endPoint_13, startPoint_13)
code_block_61 = CodeBlock { 13.5; }
translate_29 = Geometry.Translate(startPoint_13, byTwoPoints_24, code_block_61)
byTwoPoints_25 = Vector.ByTwoPoints(endPoint_12, startPoint_12)
code_block_62 = CodeBlock { 0.55; }
translate_30 = Geometry.Translate(endPoint_12, byTwoPoints_25, code_block_62)
byTwoPoints_26 = Vector.ByTwoPoints(translate_29, translate_30)
code_block_63 = CodeBlock { 6; }
translate_31 = Geometry.Translate(translate_29, byTwoPoints_26, code_block_63)
byTwoPoints_27 = Vector.ByTwoPoints(startPoint_12, endPoint_12)
translate_32 = Geometry.Translate(startPoint_12, byTwoPoints_27, code_block_62)
byTwoPoints_28 = Vector.ByTwoPoints(translate_29, translate_32)
translate_33 = Geometry.Translate(translate_29, byTwoPoints_28, code_block_63)
byStartPointEndPoint_25 = Line.ByStartPointEndPoint(translate_31, translate_33)
code_block_64 = CodeBlock { 0.25..0.75..0.05; }
planeAtParameter_18 = Curve.PlaneAtParameter(byStartPointEndPoint_25, code_block_64)
origin_14 = Plane.Origin(planeAtParameter_18)
byStartPointEndPoint_26 = Line.ByStartPointEndPoint(translate_30, translate_32)
planeAtParameter_19 = Curve.PlaneAtParameter(byStartPointEndPoint_26, code_block_64)
origin_15 = Plane.Origin(planeAtParameter_19)
byStartPointEndPoint_27 = Line.ByStartPointEndPoint(origin_14, origin_15)
code_block_65 = CodeBlock { 0..1..1; }
planeAtParameter_20 = Curve.PlaneAtParameter(byStartPointEndPoint_27, code_block_65, lacing=CrossProduct)
code_block_66 = CodeBlock { 0.05; }
byPlaneRadius_6 = Circle.ByPlaneRadius(planeAtParameter_20, code_block_66)
byLoft_9 = Surface.ByLoft(byPlaneRadius_6)
XAxis_14 = Vector.XAxis()
code_block_67 = CodeBlock { 15; }
code_block_68 = CodeBlock(x=code_block_67) { x-0.4; }
translate_34 = Geometry.Translate(byLoft_9, XAxis_14, code_block_68)
extrude_5 = Curve.Extrude(byStartPointEndPoint_26, XAxis_14, code_block_67)
code_block_69 = CodeBlock { 0.4; }
thicken_9 = Surface.Thicken(extrude_5, code_block_69)
create_9 = List.Create(translate_30, translate_32, translate_33, translate_31)
code_block_70 = CodeBlock { 1; }
boolean_5 = BoolSelector(true)
byControlPoints_9 = NurbsCurve.ByControlPoints(create_9, code_block_70, boolean_5)
code_block_71 = CodeBlock { 3; }
byControlPoints_10 = NurbsCurve.ByControlPoints(create_9, code_block_71, boolean_5)
create_10 = List.Create(byControlPoints_9, byControlPoints_10)
byLoft_10 = Surface.ByLoft(create_10)
thicken_10 = Surface.Thicken(byLoft_10, code_block_69)
translate_35 = Geometry.Translate(thicken_10, XAxis_14, code_block_67)
endPoint_14 = Curve.EndPoint(rotate_8)
startPoint_14 = Curve.StartPoint(rotate_8)
byTwoPoints_29 = Vector.ByTwoPoints(startPoint_14, endPoint_14)
byStartPointEndPoint_28 = Line.ByStartPointEndPoint(endPoint_14, startPoint_14)
length_5 = Curve.Length(byStartPointEndPoint_28)
byStartPointDirectionLength_5 = Line.ByStartPointDirectionLength(endPoint_14, byTwoPoints_29, length_5)
XAxis_15 = Vector.XAxis()
rotate_10 = Geometry.Rotate(byStartPointDirectionLength_5, endPoint_14, XAxis_15, number_slider)
endPoint_15 = Curve.EndPoint(rotate_10)
startPoint_15 = Curve.StartPoint(rotate_10)
byStartPointEndPoint_29 = Line.ByStartPointEndPoint(endPoint_15, startPoint_15)
code_block_72 = CodeBlock { 0.5; }
planeAtParameter_21 = Curve.PlaneAtParameter(byStartPointEndPoint_29, code_block_72)
origin_16 = Plane.Origin(planeAtParameter_21)
byStartPointEndPoint_30 = Line.ByStartPointEndPoint(origin_16, endPoint_15)
XAxis_16 = Vector.XAxis()
byOriginNormal_6 = Plane.ByOriginNormal(origin_16, XAxis_16)
code_block_73 = CodeBlock { 90; }
rotate_11 = Geometry.Rotate(byStartPointEndPoint_30, byOriginNormal_6, code_block_73)
startPoint_16 = Curve.StartPoint(rotate_11)
endPoint_16 = Curve.EndPoint(rotate_11)
byTwoPoints_30 = Vector.ByTwoPoints(endPoint_16, startPoint_16)
code_block_74 = CodeBlock { 13.5; }
translate_36 = Geometry.Translate(startPoint_16, byTwoPoints_30, code_block_74)
byTwoPoints_31 = Vector.ByTwoPoints(endPoint_15, startPoint_15)
code_block_75 = CodeBlock { 0.55; }
translate_37 = Geometry.Translate(endPoint_15, byTwoPoints_31, code_block_75)
byTwoPoints_32 = Vector.ByTwoPoints(translate_36, translate_37)
code_block_76 = CodeBlock { 6; }
translate_38 = Geometry.Translate(translate_36, byTwoPoints_32, code_block_76)
byTwoPoints_33 = Vector.ByTwoPoints(startPoint_15, endPoint_15)
translate_39 = Geometry.Translate(startPoint_15, byTwoPoints_33, code_block_75)
byTwoPoints_34 = Vector.ByTwoPoints(translate_36, translate_39)
translate_40 = Geometry.Translate(translate_36, byTwoPoints_34, code_block_76)
byStartPointEndPoint_31 = Line.ByStartPointEndPoint(translate_38, translate_40)
code_block_77 = CodeBlock { 0.25..0.75..0.05; }
planeAtParameter_22 = Curve.PlaneAtParameter(byStartPointEndPoint_31, code_block_77)
origin_17 = Plane.Origin(planeAtParameter_22)
byStartPointEndPoint_32 = Line.ByStartPointEndPoint(translate_37, translate_39)
planeAtParameter_23 = Curve.PlaneAtParameter(byStartPointEndPoint_32, code_block_77)
origin_18 = Plane.Origin(planeAtParameter_23)
byStartPointEndPoint_33 = Line.ByStartPointEndPoint(origin_17, origin_18)
code_block_78 = CodeBlock { 0..1..1; }
planeAtParameter_24 = Curve.PlaneAtParameter(byStartPointEndPoint_33, code_block_78, lacing=CrossProduct)
code_block_79 = CodeBlock { 0.05; }
byPlaneRadius_7 = Circle.ByPlaneRadius(planeAtParameter_24, code_block_79)
byLoft_11 = Surface.ByLoft(byPlaneRadius_7)
XAxis_17 = Vector.XAxis()
code_block_80 = CodeBlock { 15; }
code_block_81 = CodeBlock(x=code_block_80) { x-0.4; }
translate_41 = Geometry.Translate(byLoft_11, XAxis_17, code_block_81)
extrude_6 = Curve.Extrude(byStartPointEndPoint_32, XAxis_17, code_block_80)
code_block_82 = CodeBlock { 0.4; }
thicken_11 = Surface.Thicken(extrude_6, code_block_82)
create_11 = List.Create(translate_37, translate_39, translate_40, translate_38)
code_block_83 = CodeBlock { 1; }
boolean_6 = BoolSelector(true)
byControlPoints_11 = NurbsCurve.ByControlPoints(create_11, code_block_83, boolean_6)
code_block_84 = CodeBlock { 3; }
byControlPoints_12 = NurbsCurve.ByControlPoints(create_11, code_block_84, boolean_6)
create_12 = List.Create(byControlPoints_11, byControlPoints_12)
byLoft_12 = Surface.ByLoft(create_12)
thicken_12 = Surface.Thicken(byLoft_12, code_block_82)
translate_42 = Geometry.Translate(thicken_12, XAxis_17, code_block_80)
endPoint_17 = Curve.EndPoint(rotate_10)
startPoint_17 = Curve.StartPoint(rotate_10)
byTwoPoints_35 = Vector.ByTwoPoints(startPoint_17, endPoint_17)
byStartPointEndPoint_34 = Line.ByStartPointEndPoint(endPoint_17, startPoint_17)
length_6 = Curve.Length(byStartPointEndPoint_34)
byStartPointDirectionLength_6 = Line.ByStartPointDirectionLength(endPoint_17, byTwoPoints_35, length_6)
XAxis_18 = Vector.XAxis()
rotate_12 = Geometry.Rotate(byStartPointDirectionLength_6, endPoint_17, XAxis_18, number_slider)
endPoint_18 = Curve.EndPoint(rotate_12)
startPoint_18 = Curve.StartPoint(rotate_12)
byStartPointEndPoint_35 = Line.ByStartPointEndPoint(endPoint_18, startPoint_18)
code_block_85 = CodeBlock { 0.5; }
planeAtParameter_25 = Curve.PlaneAtParameter(byStartPointEndPoint_35, code_block_85)
origin_19 = Plane.Origin(planeAtParameter_25)
byStartPointEndPoint_36 = Line.ByStartPointEndPoint(origin_19, endPoint_18)
XAxis_19 = Vector.XAxis()
byOriginNormal_7 = Plane.ByOriginNormal(origin_19, XAxis_19)
code_block_86 = CodeBlock { 90; }
rotate_13 = Geometry.Rotate(byStartPointEndPoint_36, byOriginNormal_7, code_block_86)
startPoint_19 = Curve.StartPoint(rotate_13)
endPoint_19 = Curve.EndPoint(rotate_13)
byTwoPoints_36 = Vector.ByTwoPoints(endPoint_19, startPoint_19)
code_block_87 = CodeBlock { 13.5; }
translate_43 = Geometry.Translate(startPoint_19, byTwoPoints_36, code_block_87)
byTwoPoints_37 = Vector.ByTwoPoints(endPoint_18, startPoint_18)
code_block_88 = CodeBlock { 0.55; }
translate_44 = Geometry.Translate(endPoint_18, byTwoPoints_37, code_block_88)
byTwoPoints_38 = Vector.ByTwoPoints(translate_43, translate_44)
code_block_89 = CodeBlock { 6; }
translate_45 = Geometry.Translate(translate_43, byTwoPoints_38, code_block_89)
byTwoPoints_39 = Vector.ByTwoPoints(startPoint_18, endPoint_18)
translate_46 = Geometry.Translate(startPoint_18, byTwoPoints_39, code_block_88)
byTwoPoints_40 = Vector.ByTwoPoints(translate_43, translate_46)
translate_47 = Geometry.Translate(translate_43, byTwoPoints_40, code_block_89)
byStartPointEndPoint_37 = Line.ByStartPointEndPoint(translate_45, translate_47)
code_block_90 = CodeBlock { 0.25..0.75..0.05; }
planeAtParameter_26 = Curve.PlaneAtParameter(byStartPointEndPoint_37, code_block_90)
origin_20 = Plane.Origin(planeAtParameter_26)
byStartPointEndPoint_38 = Line.ByStartPointEndPoint(translate_44, translate_46)
planeAtParameter_27 = Curve.PlaneAtParameter(byStartPointEndPoint_38, code_block_90)
origin_21 = Plane.Origin(planeAtParameter_27)
byStartPointEndPoint_39 = Line.ByStartPointEndPoint(origin_20, origin_21)
code_block_91 = CodeBlock { 0..1..1; }
planeAtParameter_28 = Curve.PlaneAtParameter(byStartPointEndPoint_39, code_block_91, lacing=CrossProduct)
code_block_92 = CodeBlock { 0.05; }
byPlaneRadius_8 = Circle.ByPlaneRadius(planeAtParameter_28, code_block_92)
byLoft_13 = Surface.ByLoft(byPlaneRadius_8)
XAxis_20 = Vector.XAxis()
code_block_93 = CodeBlock { 15; }
code_block_94 = CodeBlock(x=code_block_93) { x-0.4; }
translate_48 = Geometry.Translate(byLoft_13, XAxis_20, code_block_94)
extrude_7 = Curve.Extrude(byStartPointEndPoint_38, XAxis_20, code_block_93)
code_block_95 = CodeBlock { 0.4; }
thicken_13 = Surface.Thicken(extrude_7, code_block_95)
create_13 = List.Create(translate_44, translate_46, translate_47, translate_45)
code_block_96 = CodeBlock { 1; }
boolean_7 = BoolSelector(true)
byControlPoints_13 = NurbsCurve.ByControlPoints(create_13, code_block_96, boolean_7)
code_block_97 = CodeBlock { 3; }
byControlPoints_14 = NurbsCurve.ByControlPoints(create_13, code_block_97, boolean_7)
create_14 = List.Create(byControlPoints_13, byControlPoints_14)
byLoft_14 = Surface.ByLoft(create_14)
thicken_14 = Surface.Thicken(byLoft_14, code_block_95)
translate_49 = Geometry.Translate(thicken_14, XAxis_20, code_block_93)
endPoint_20 = Curve.EndPoint(rotate_12)
startPoint_20 = Curve.StartPoint(rotate_12)
byTwoPoints_41 = Vector.ByTwoPoints(startPoint_20, endPoint_20)
byStartPointEndPoint_40 = Line.ByStartPointEndPoint(endPoint_20, startPoint_20)
length_7 = Curve.Length(byStartPointEndPoint_40)
byStartPointDirectionLength_7 = Line.ByStartPointDirectionLength(endPoint_20, byTwoPoints_41, length_7)
XAxis_21 = Vector.XAxis()
rotate_14 = Geometry.Rotate(byStartPointDirectionLength_7, endPoint_20, XAxis_21, number_slider)
endPoint_21 = Curve.EndPoint(rotate_14)
startPoint_21 = Curve.StartPoint(rotate_14)
byStartPointEndPoint_41 = Line.ByStartPointEndPoint(endPoint_21, startPoint_21)
code_block_98 = CodeBlock { 0.5; }
planeAtParameter_29 = Curve.PlaneAtParameter(byStartPointEndPoint_41, code_block_98)
origin_22 = Plane.Origin(planeAtParameter_29)
byStartPointEndPoint_42 = Line.ByStartPointEndPoint(origin_22, endPoint_21)
XAxis_22 = Vector.XAxis()
byOriginNormal_8 = Plane.ByOriginNormal(origin_22, XAxis_22)
code_block_99 = CodeBlock { 90; }
rotate_15 = Geometry.Rotate(byStartPointEndPoint_42, byOriginNormal_8, code_block_99)
startPoint_22 = Curve.StartPoint(rotate_15)
endPoint_22 = Curve.EndPoint(rotate_15)
byTwoPoints_42 = Vector.ByTwoPoints(endPoint_22, startPoint_22)
code_block_100 = CodeBlock { 13.5; }
translate_50 = Geometry.Translate(startPoint_22, byTwoPoints_42, code_block_100)
byTwoPoints_43 = Vector.ByTwoPoints(endPoint_21, startPoint_21)
code_block_101 = CodeBlock { 0.55; }
translate_51 = Geometry.Translate(endPoint_21, byTwoPoints_43, code_block_101)
byTwoPoints_44 = Vector.ByTwoPoints(translate_50, translate_51)
code_block_102 = CodeBlock { 6; }
translate_52 = Geometry.Translate(translate_50, byTwoPoints_44, code_block_102)
byTwoPoints_45 = Vector.ByTwoPoints(startPoint_21, endPoint_21)
translate_53 = Geometry.Translate(startPoint_21, byTwoPoints_45, code_block_101)
byTwoPoints_46 = Vector.ByTwoPoints(translate_50, translate_53)
translate_54 = Geometry.Translate(translate_50, byTwoPoints_46, code_block_102)
byStartPointEndPoint_43 = Line.ByStartPointEndPoint(translate_52, translate_54)
code_block_103 = CodeBlock { 0.25..0.75..0.05; }
planeAtParameter_30 = Curve.PlaneAtParameter(byStartPointEndPoint_43, code_block_103)
origin_23 = Plane.Origin(planeAtParameter_30)
byStartPointEndPoint_44 = Line.ByStartPointEndPoint(translate_51, translate_53)
planeAtParameter_31 = Curve.PlaneAtParameter(byStartPointEndPoint_44, code_block_103)
origin_24 = Plane.Origin(planeAtParameter_31)
byStartPointEndPoint_45 = Line.ByStartPointEndPoint(origin_23, origin_24)
code_block_104 = CodeBlock { 0..1..1; }
planeAtParameter_32 = Curve.PlaneAtParameter(byStartPointEndPoint_45, code_block_104, lacing=CrossProduct)
code_block_105 = CodeBlock { 0.05; }
byPlaneRadius_9 = Circle.ByPlaneRadius(planeAtParameter_32, code_block_105)
byLoft_15 = Surface.ByLoft(byPlaneRadius_9)
XAxis_23 = Vector.XAxis()
code_block_106 = CodeBlock { 15; }
code_block_107 = CodeBlock(x=code_block_106) { x-0.4; }
translate_55 = Geometry.Translate(byLoft_15, XAxis_23, code_block_107)
extrude_8 = Curve.Extrude(byStartPointEndPoint_44, XAxis_23, code_block_106)
code_block_108 = CodeBlock { 0.4; }
thicken_15 = Surface.Thicken(extrude_8, code_block_108)
create_15 = List.Create(translate_51, translate_53, translate_54, translate_52)
code_block_109 = CodeBlock { 1; }
boolean_8 = BoolSelector(true)
byControlPoints_15 = NurbsCurve.ByControlPoints(create_15, code_block_109, boolean_8)
code_block_110 = CodeBlock { 3; }
byControlPoints_16 = NurbsCurve.ByControlPoints(create_15, code_block_110, boolean_8)
create_16 = List.Create(byControlPoints_15, byControlPoints_16)
byLoft_16 = Surface.ByLoft(create_16)
thicken_16 = Surface.Thicken(byLoft_16, code_block_108)
translate_56 = Geometry.Translate(thicken_16, XAxis_23, code_block_106)
XAxis_24 = Vector.XAxis()
code_block_111 = CodeBlock(x=number_slider) { 180-x; }
code_block_112 = CodeBlock(x=code_block_111) { x/2; }
code_block_113 = CodeBlock(x=code_block_112) { -x; }
rotate_16 = Geometry.Rotate(byStartPointDirectionLength, startPoint_2, XAxis_24, code_block_113)
code_block_114 = CodeBlock { 5; 0; 180; }
XAxis_25 = Vector.XAxis()
byCenterPointRadiusAngle = Arc.ByCenterPointRadiusAngle(translate_4, code_block_114.out0, code_block_114.out1, code_block_114.out2, XAxis_25)
intersect = Geometry.Intersect(rotate_16, byCenterPointRadiusAngle)
startPoint_23 = Curve.StartPoint(rotate_16)
endPoint_23 = Curve.EndPoint(rotate_16)
byTwoPoints_47 = Vector.ByTwoPoints(startPoint_23, endPoint_23)
reverse_2 = Vector.Reverse(byTwoPoints_47)
code_block_115 = CodeBlock { 7.5; }
byStartPointDirectionLength_8 = Line.ByStartPointDirectionLength(intersect, reverse_2, code_block_115)
flatten = Flatten(byStartPointDirectionLength_8)
code_block_116 = CodeBlock { 0..1..1; }
planeAtParameter_33 = Curve.PlaneAtParameter(flatten, code_block_116, lacing=CrossProduct)
code_block_117 = CodeBlock { 0.25; }
byPlaneRadius_10 = Circle.ByPlaneRadius(planeAtParameter_33, code_block_117)
byLoft_17 = Surface.ByLoft(byPlaneRadius_10)
byStartPointEndPoint_46 = Line.ByStartPointEndPoint(translate_4, intersect)
code_block_118 = CodeBlock { 0..1..1; }
planeAtParameter_34 = Curve.PlaneAtParameter(byStartPointEndPoint_46, code_block_118, lacing=CrossProduct)
code_block_119 = CodeBlock { 0.25; }
byPlaneRadius_11 = Circle.ByPlaneRadius(planeAtParameter_34, code_block_119)
byLoft_18 = Surface.ByLoft(byPlaneRadius_11)
byStartPointEndPoint_47 = Line.ByStartPointEndPoint(translate_12, intersect)
code_block_120 = CodeBlock { 0..1..1; }
planeAtParameter_35 = Curve.PlaneAtParameter(byStartPointEndPoint_47, code_block_120, lacing=CrossProduct)
code_block_121 = CodeBlock { 0.25; }
byPlaneRadius_12 = Circle.ByPlaneRadius(planeAtParameter_35, code_block_121)
byLoft_19 = Surface.ByLoft(byPlaneRadius_12)
byStartPointDirectionLength_9 = Line.ByStartPointDirectionLength(startPoint_23, byTwoPoints_47, code_block_115)
code_block_122 = CodeBlock { 0..1..1; }
planeAtParameter_36 = Curve.PlaneAtParameter(byStartPointDirectionLength_9, code_block_122)
code_block_123 = CodeBlock { 0.65; }
byPlaneRadius_13 = Circle.ByPlaneRadius(planeAtParameter_36, code_block_123)
byLoft_20 = Surface.ByLoft(byPlaneRadius_13)
create_17 = List.Create(byLoft_17, byLoft_18, byLoft_19, byLoft_20)
XAxis_26 = Vector.XAxis()
code_block_124 = CodeBlock { 15; }
translate_57 = Geometry.Translate(create_17, XAxis_26, code_block_124)
rotate_17 = Geometry.Rotate(byStartPointDirectionLength_2, endPoint_5, XAxis_6, code_block_113)
code_block_125 = CodeBlock { 5; 0; 180; }
XAxis_27 = Vector.XAxis()
byCenterPointRadiusAngle_2 = Arc.ByCenterPointRadiusAngle(translate_10, code_block_125.out0, code_block_125.out1, code_block_125.out2, XAxis_27)
centerPoint_2 = Arc.CenterPoint(byCenterPointRadiusAngle_2)
XAxis_28 = Vector.XAxis()
byOriginNormal_9 = Plane.ByOriginNormal(centerPoint_2, XAxis_28)
code_block_126 = CodeBlock(x=number_slider) { x*2; }
rotate_18 = Geometry.Rotate(byCenterPointRadiusAngle_2, byOriginNormal_9, code_block_126)
intersect_2 = Geometry.Intersect(rotate_17, rotate_18)
startPoint_24 = Curve.StartPoint(rotate_17)
endPoint_24 = Curve.EndPoint(rotate_17)
byTwoPoints_48 = Vector.ByTwoPoints(startPoint_24, endPoint_24)
reverse_3 = Vector.Reverse(byTwoPoints_48)
code_block_127 = CodeBlock { 7.5; }
byStartPointDirectionLength_10 = Line.ByStartPointDirectionLength(intersect_2, reverse_3, code_block_127)
flatten_2 = Flatten(byStartPointDirectionLength_10)
code_block_128 = CodeBlock { 0..1..1; }
planeAtParameter_37 = Curve.PlaneAtParameter(flatten_2, code_block_128, lacing=CrossProduct)
code_block_129 = CodeBlock { 0.25; }
byPlaneRadius_14 = Circle.ByPlaneRadius(planeAtParameter_37, code_block_129)
byLoft_21 = Surface.ByLoft(byPlaneRadius_14)
byStartPointEndPoint_48 = Line.ByStartPointEndPoint(translate_10, intersect_2)
code_block_130 = CodeBlock { 0..1..1; }
planeAtParameter_38 = Curve.PlaneAtParameter(byStartPointEndPoint_48, code_block_130, lacing=CrossProduct)
code_block_131 = CodeBlock { 0.25; }
byPlaneRadius_15 = Circle.ByPlaneRadius(planeAtParameter_38, code_block_131)
byLoft_22 = Surface.ByLoft(byPlaneRadius_15)
byStartPointEndPoint_49 = Line.ByStartPointEndPoint(translate_19, intersect_2)
code_block_132 = CodeBlock { 0..1..1; }
planeAtParameter_39 = Curve.PlaneAtParameter(byStartPointEndPoint_49, code_block_132, lacing=CrossProduct)
code_block_133 = CodeBlock { 0.25; }
byPlaneRadius_16 = Circle.ByPlaneRadius(planeAtParameter_39, code_block_133)
byLoft_23 = Surface.ByLoft(byPlaneRadius_16)
byStartPointDirectionLength_11 = Line.ByStartPointDirectionLength(startPoint_24, byTwoPoints_48, code_block_127)
code_block_134 = CodeBlock { 0..1..1; }
planeAtParameter_40 = Curve.PlaneAtParameter(byStartPointDirectionLength_11, code_block_134)
code_block_135 = CodeBlock { 0.65; }
byPlaneRadius_17 = Circle.ByPlaneRadius(planeAtParameter_40, code_block_135)
byLoft_24 = Surface.ByLoft(byPlaneRadius_17)
create_18 = List.Create(byLoft_21, byLoft_22, byLoft_23, byLoft_24)
XAxis_29 = Vector.XAxis()
code_block_136 = CodeBlock { 15; }
translate_58 = Geometry.Translate(create_18, XAxis_29, code_block_136)
rotate_19 = Geometry.Rotate(byStartPointDirectionLength_3, endPoint_8, XAxis_9, code_block_113)
code_block_137 = CodeBlock { 5; 0; 180; }
XAxis_30 = Vector.XAxis()
byCenterPointRadiusAngle_3 = Arc.ByCenterPointRadiusAngle(translate_17, code_block_137.out0, code_block_137.out1, code_block_137.out2, XAxis_30)
centerPoint_3 = Arc.CenterPoint(byCenterPointRadiusAngle_3)
XAxis_31 = Vector.XAxis()
byOriginNormal_10 = Plane.ByOriginNormal(centerPoint_3, XAxis_31)
code_block_138 = CodeBlock(x=number_slider) { x*3; }
rotate_20 = Geometry.Rotate(byCenterPointRadiusAngle_3, byOriginNormal_10, code_block_138)
intersect_3 = Geometry.Intersect(rotate_19, rotate_20)
startPoint_25 = Curve.StartPoint(rotate_19)
endPoint_25 = Curve.EndPoint(rotate_19)
byTwoPoints_49 = Vector.ByTwoPoints(startPoint_25, endPoint_25)
reverse_4 = Vector.Reverse(byTwoPoints_49)
code_block_139 = CodeBlock { 7.5; }
byStartPointDirectionLength_12 = Line.ByStartPointDirectionLength(intersect_3, reverse_4, code_block_139)
flatten_3 = Flatten(byStartPointDirectionLength_12)
code_block_140 = CodeBlock { 0..1..1; }
planeAtParameter_41 = Curve.PlaneAtParameter(flatten_3, code_block_140, lacing=CrossProduct)
code_block_141 = CodeBlock { 0.25; }
byPlaneRadius_18 = Circle.ByPlaneRadius(planeAtParameter_41, code_block_141)
byLoft_25 = Surface.ByLoft(byPlaneRadius_18)
byStartPointEndPoint_50 = Line.ByStartPointEndPoint(translate_17, intersect_3)
code_block_142 = CodeBlock { 0..1..1; }
planeAtParameter_42 = Curve.PlaneAtParameter(byStartPointEndPoint_50, code_block_142, lacing=CrossProduct)
code_block_143 = CodeBlock { 0.25; }
byPlaneRadius_19 = Circle.ByPlaneRadius(planeAtParameter_42, code_block_143)
byLoft_26 = Surface.ByLoft(byPlaneRadius_19)
byStartPointEndPoint_51 = Line.ByStartPointEndPoint(translate_26, intersect_3)
code_block_144 = CodeBlock { 0..1..1; }
planeAtParameter_43 = Curve.PlaneAtParameter(byStartPointEndPoint_51, code_block_144, lacing=CrossProduct)
code_block_145 = CodeBlock { 0.25; }
byPlaneRadius_20 = Circle.ByPlaneRadius(planeAtParameter_43, code_block_145)
byLoft_27 = Surface.ByLoft(byPlaneRadius_20)
byStartPointDirectionLength_13 = Line.ByStartPointDirectionLength(startPoint_25, byTwoPoints_49, code_block_139)
code_block_146 = CodeBlock { 0..1..1; }
planeAtParameter_44 = Curve.PlaneAtParameter(byStartPointDirectionLength_13, code_block_146)
code_block_147 = CodeBlock { 0.65; }
byPlaneRadius_21 = Circle.ByPlaneRadius(planeAtParameter_44, code_block_147)
byLoft_28 = Surface.ByLoft(byPlaneRadius_21)
create_19 = List.Create(byLoft_25, byLoft_26, byLoft_27, byLoft_28)
XAxis_32 = Vector.XAxis()
code_block_148 = CodeBlock { 15; }
translate_59 = Geometry.Translate(create_19, XAxis_32, code_block_148)
rotate_21 = Geometry.Rotate(byStartPointDirectionLength_4, endPoint_11, XAxis_12, code_block_113)
code_block_149 = CodeBlock { 5; 0; 180; }
XAxis_33 = Vector.XAxis()
byCenterPointRadiusAngle_4 = Arc.ByCenterPointRadiusAngle(translate_24, code_block_149.out0, code_block_149.out1, code_block_149.out2, XAxis_33)
centerPoint_4 = Arc.CenterPoint(byCenterPointRadiusAngle_4)
XAxis_34 = Vector.XAxis()
byOriginNormal_11 = Plane.ByOriginNormal(centerPoint_4, XAxis_34)
code_block_150 = CodeBlock(x=number_slider) { x*4; }
rotate_22 = Geometry.Rotate(byCenterPointRadiusAngle_4, byOriginNormal_11, code_block_150)
intersect_4 = Geometry.Intersect(rotate_21, rotate_22)
startPoint_26 = Curve.StartPoint(rotate_21)
endPoint_26 = Curve.EndPoint(rotate_21)
byTwoPoints_50 = Vector.ByTwoPoints(startPoint_26, endPoint_26)
reverse_5 = Vector.Reverse(byTwoPoints_50)
code_block_151 = CodeBlock { 7.5; }
byStartPointDirectionLength_14 = Line.ByStartPointDirectionLength(intersect_4, reverse_5, code_block_151)
flatten_4 = Flatten(byStartPointDirectionLength_14)
code_block_152 = CodeBlock { 0..1..1; }
planeAtParameter_45 = Curve.PlaneAtParameter(flatten_4, code_block_152, lacing=CrossProduct)
code_block_153 = CodeBlock { 0.25; }
byPlaneRadius_22 = Circle.ByPlaneRadius(planeAtParameter_45, code_block_153)
byLoft_29 = Surface.ByLoft(byPlaneRadius_22)
byStartPointEndPoint_52 = Line.ByStartPointEndPoint(translate_24, intersect_4)
code_block_154 = CodeBlock { 0..1..1; }
planeAtParameter_46 = Curve.PlaneAtParameter(byStartPointEndPoint_52, code_block_154, lacing=CrossProduct)
code_block_155 = CodeBlock { 0.25; }
byPlaneRadius_23 = Circle.ByPlaneRadius(planeAtParameter_46, code_block_155)
byLoft_30 = Surface.ByLoft(byPlaneRadius_23)
byStartPointEndPoint_53 = Line.ByStartPointEndPoint(translate_33, intersect_4)
code_block_156 = CodeBlock { 0..1..1; }
planeAtParameter_47 = Curve.PlaneAtParameter(byStartPointEndPoint_53, code_block_156, lacing=CrossProduct)
code_block_157 = CodeBlock { 0.25; }
byPlaneRadius_24 = Circle.ByPlaneRadius(planeAtParameter_47, code_block_157)
byLoft_31 = Surface.ByLoft(byPlaneRadius_24)
byStartPointDirectionLength_15 = Line.ByStartPointDirectionLength(startPoint_26, byTwoPoints_50, code_block_151)
code_block_158 = CodeBlock { 0..1..1; }
planeAtParameter_48 = Curve.PlaneAtParameter(byStartPointDirectionLength_15, code_block_158)
code_block_159 = CodeBlock { 0.65; }
byPlaneRadius_25 = Circle.ByPlaneRadius(planeAtParameter_48, code_block_159)
byLoft_32 = Surface.ByLoft(byPlaneRadius_25)
create_20 = List.Create(byLoft_29, byLoft_30, byLoft_31, byLoft_32)
XAxis_35 = Vector.XAxis()
code_block_160 = CodeBlock { 15; }
translate_60 = Geometry.Translate(create_20, XAxis_35, code_block_160)
rotate_23 = Geometry.Rotate(byStartPointDirectionLength_5, endPoint_14, XAxis_15, code_block_113)
code_block_161 = CodeBlock { 5; 0; 180; }
XAxis_36 = Vector.XAxis()
byCenterPointRadiusAngle_5 = Arc.ByCenterPointRadiusAngle(translate_31, code_block_161.out0, code_block_161.out1, code_block_161.out2, XAxis_36)
centerPoint_5 = Arc.CenterPoint(byCenterPointRadiusAngle_5)
XAxis_37 = Vector.XAxis()
byOriginNormal_12 = Plane.ByOriginNormal(centerPoint_5, XAxis_37)
code_block_162 = CodeBlock(x=number_slider) { x*5; }
rotate_24 = Geometry.Rotate(byCenterPointRadiusAngle_5, byOriginNormal_12, code_block_162)
intersect_5 = Geometry.Intersect(rotate_23, rotate_24)
startPoint_27 = Curve.StartPoint(rotate_23)
endPoint_27 = Curve.EndPoint(rotate_23)
byTwoPoints_51 = Vector.ByTwoPoints(startPoint_27, endPoint_27)
reverse_6 = Vector.Reverse(byTwoPoints_51)
code_block_163 = CodeBlock { 7.5; }
byStartPointDirectionLength_16 = Line.ByStartPointDirectionLength(intersect_5, reverse_6, code_block_163)
flatten_5 = Flatten(byStartPointDirectionLength_16)
code_block_164 = CodeBlock { 0..1..1; }
planeAtParameter_49 = Curve.PlaneAtParameter(flatten_5, code_block_164, lacing=CrossProduct)
code_block_165 = CodeBlock { 0.25; }
byPlaneRadius_26 = Circle.ByPlaneRadius(planeAtParameter_49, code_block_165)
byLoft_33 = Surface.ByLoft(byPlaneRadius_26)
byStartPointEndPoint_54 = Line.ByStartPointEndPoint(translate_31, intersect_5)
code_block_166 = CodeBlock { 0..1..1; }
planeAtParameter_50 = Curve.PlaneAtParameter(byStartPointEndPoint_54, code_block_166, lacing=CrossProduct)
code_block_167 = CodeBlock { 0.25; }
byPlaneRadius_27 = Circle.ByPlaneRadius(planeAtParameter_50, code_block_167)
byLoft_34 = Surface.ByLoft(byPlaneRadius_27)
byStartPointEndPoint_55 = Line.ByStartPointEndPoint(translate_40, intersect_5)
code_block_168 = CodeBlock { 0..1..1; }
planeAtParameter_51 = Curve.PlaneAtParameter(byStartPointEndPoint_55, code_block_168, lacing=CrossProduct)
code_block_169 = CodeBlock { 0.25; }
byPlaneRadius_28 = Circle.ByPlaneRadius(planeAtParameter_51, code_block_169)
byLoft_35 = Surface.ByLoft(byPlaneRadius_28)
byStartPointDirectionLength_17 = Line.ByStartPointDirectionLength(startPoint_27, byTwoPoints_51, code_block_163)
code_block_170 = CodeBlock { 0..1..1; }
planeAtParameter_52 = Curve.PlaneAtParameter(byStartPointDirectionLength_17, code_block_170)
code_block_171 = CodeBlock { 0.65; }
byPlaneRadius_29 = Circle.ByPlaneRadius(planeAtParameter_52, code_block_171)
byLoft_36 = Surface.ByLoft(byPlaneRadius_29)
create_21 = List.Create(byLoft_33, byLoft_34, byLoft_35, byLoft_36)
XAxis_38 = Vector.XAxis()
code_block_172 = CodeBlock { 15; }
translate_61 = Geometry.Translate(create_21, XAxis_38, code_block_172)
rotate_25 = Geometry.Rotate(byStartPointDirectionLength_6, endPoint_17, XAxis_18, code_block_113)
code_block_173 = CodeBlock { 5; 0; 180; }
XAxis_39 = Vector.XAxis()
byCenterPointRadiusAngle_6 = Arc.ByCenterPointRadiusAngle(translate_38, code_block_173.out0, code_block_173.out1, code_block_173.out2, XAxis_39)
centerPoint_6 = Arc.CenterPoint(byCenterPointRadiusAngle_6)
XAxis_40 = Vector.XAxis()
byOriginNormal_13 = Plane.ByOriginNormal(centerPoint_6, XAxis_40)
code_block_174 = CodeBlock(x=number_slider) { x*6; }
rotate_26 = Geometry.Rotate(byCenterPointRadiusAngle_6, byOriginNormal_13, code_block_174)
intersect_6 = Geometry.Intersect(rotate_25, rotate_26)
startPoint_28 = Curve.StartPoint(rotate_25)
endPoint_28 = Curve.EndPoint(rotate_25)
byTwoPoints_52 = Vector.ByTwoPoints(startPoint_28, endPoint_28)
reverse_7 = Vector.Reverse(byTwoPoints_52)
code_block_175 = CodeBlock { 7.5; }
byStartPointDirectionLength_18 = Line.ByStartPointDirectionLength(intersect_6, reverse_7, code_block_175)
flatten_6 = Flatten(byStartPointDirectionLength_18)
code_block_176 = CodeBlock { 0..1..1; }
planeAtParameter_53 = Curve.PlaneAtParameter(flatten_6, code_block_176, lacing=CrossProduct)
code_block_177 = CodeBlock { 0.25; }
byPlaneRadius_30 = Circle.ByPlaneRadius(planeAtParameter_53, code_block_177)
byLoft_37 = Surface.ByLoft(byPlaneRadius_30)
byStartPointEndPoint_56 = Line.ByStartPointEndPoint(translate_38, intersect_6)
code_block_178 = CodeBlock { 0..1..1; }
planeAtParameter_54 = Curve.PlaneAtParameter(byStartPointEndPoint_56, code_block_178, lacing=CrossProduct)
code_block_179 = CodeBlock { 0.25; }
byPlaneRadius_31 = Circle.ByPlaneRadius(planeAtParameter_54, code_block_179)
byLoft_38 = Surface.ByLoft(byPlaneRadius_31)
byStartPointEndPoint_57 = Line.ByStartPointEndPoint(translate_47, intersect_6)
code_block_180 = CodeBlock { 0..1..1; }
planeAtParameter_55 = Curve.PlaneAtParameter(byStartPointEndPoint_57, code_block_180, lacing=CrossProduct)
code_block_181 = CodeBlock { 0.25; }
byPlaneRadius_32 = Circle.ByPlaneRadius(planeAtParameter_55, code_block_181)
byLoft_39 = Surface.ByLoft(byPlaneRadius_32)
byStartPointDirectionLength_19 = Line.ByStartPointDirectionLength(startPoint_28, byTwoPoints_52, code_block_175)
code_block_182 = CodeBlock { 0..1..1; }
planeAtParameter_56 = Curve.PlaneAtParameter(byStartPointDirectionLength_19, code_block_182)
code_block_183 = CodeBlock { 0.65; }
byPlaneRadius_33 = Circle.ByPlaneRadius(planeAtParameter_56, code_block_183)
byLoft_40 = Surface.ByLoft(byPlaneRadius_33)
create_22 = List.Create(byLoft_37, byLoft_38, byLoft_39, byLoft_40)
XAxis_41 = Vector.XAxis()
code_block_184 = CodeBlock { 15; }
translate_62 = Geometry.Translate(create_22, XAxis_41, code_block_184)
rotate_27 = Geometry.Rotate(byStartPointDirectionLength_7, endPoint_20, XAxis_21, code_block_113)
code_block_185 = CodeBlock { 5; 0; 180; }
XAxis_42 = Vector.XAxis()
byCenterPointRadiusAngle_7 = Arc.ByCenterPointRadiusAngle(translate_45, code_block_185.out0, code_block_185.out1, code_block_185.out2, XAxis_42)
centerPoint_7 = Arc.CenterPoint(byCenterPointRadiusAngle_7)
XAxis_43 = Vector.XAxis()
byOriginNormal_14 = Plane.ByOriginNormal(centerPoint_7, XAxis_43)
code_block_186 = CodeBlock(x=number_slider) { x*7; }
rotate_28 = Geometry.Rotate(byCenterPointRadiusAngle_7, byOriginNormal_14, code_block_186)
intersect_7 = Geometry.Intersect(rotate_27, rotate_28)
startPoint_29 = Curve.StartPoint(rotate_27)
endPoint_29 = Curve.EndPoint(rotate_27)
byTwoPoints_53 = Vector.ByTwoPoints(startPoint_29, endPoint_29)
reverse_8 = Vector.Reverse(byTwoPoints_53)
code_block_187 = CodeBlock { 7.5; }
byStartPointDirectionLength_20 = Line.ByStartPointDirectionLength(intersect_7, reverse_8, code_block_187)
flatten_7 = Flatten(byStartPointDirectionLength_20)
code_block_188 = CodeBlock { 0..1..1; }
planeAtParameter_57 = Curve.PlaneAtParameter(flatten_7, code_block_188, lacing=CrossProduct)
code_block_189 = CodeBlock { 0.25; }
byPlaneRadius_34 = Circle.ByPlaneRadius(planeAtParameter_57, code_block_189)
byLoft_41 = Surface.ByLoft(byPlaneRadius_34)
byStartPointEndPoint_58 = Line.ByStartPointEndPoint(translate_45, intersect_7)
code_block_190 = CodeBlock { 0..1..1; }
planeAtParameter_58 = Curve.PlaneAtParameter(byStartPointEndPoint_58, code_block_190, lacing=CrossProduct)
code_block_191 = CodeBlock { 0.25; }
byPlaneRadius_35 = Circle.ByPlaneRadius(planeAtParameter_58, code_block_191)
byLoft_42 = Surface.ByLoft(byPlaneRadius_35)
byStartPointEndPoint_59 = Line.ByStartPointEndPoint(translate_54, intersect_7)
code_block_192 = CodeBlock { 0..1..1; }
planeAtParameter_59 = Curve.PlaneAtParameter(byStartPointEndPoint_59, code_block_192, lacing=CrossProduct)
code_block_193 = CodeBlock { 0.25; }
byPlaneRadius_36 = Circle.ByPlaneRadius(planeAtParameter_59, code_block_193)
byLoft_43 = Surface.ByLoft(byPlaneRadius_36)
byStartPointDirectionLength_21 = Line.ByStartPointDirectionLength(startPoint_29, byTwoPoints_53, code_block_187)
code_block_194 = CodeBlock { 0..1..1; }
planeAtParameter_60 = Curve.PlaneAtParameter(byStartPointDirectionLength_21, code_block_194)
code_block_195 = CodeBlock { 0.65; }
byPlaneRadius_37 = Circle.ByPlaneRadius(planeAtParameter_60, code_block_195)
byLoft_44 = Surface.ByLoft(byPlaneRadius_37)
create_23 = List.Create(byLoft_41, byLoft_42, byLoft_43, byLoft_44)
XAxis_44 = Vector.XAxis()
code_block_196 = CodeBlock { 15; }
translate_63 = Geometry.Translate(create_23, XAxis_44, code_block_196)
