# Dynamo graph D_3-Math.Sin.dyn (Dynamo 1.3.4.6666)

# group: INPUTS
code_block = CodeBlock { 0; 360; 10; }
code_block_2 = CodeBlock(x=code_block.out0, y=code_block.out1, z=code_block.out2) { x..y..z; }

code_block_3 = CodeBlock { 10; }
add = code_block_2 + code_block_3
sin = Math.Sin(add)
code_block_4 = CodeBlock { 50; }
mul = sin * code_block_4
byCoordinates = Point.ByCoordinates(x=code_block_2, z=mul)
code_block_5 = CodeBlock { 3; }
byControlPoints = NurbsCurve.ByControlPoints(byCoordinates, code_block_5)
