# Dynamo graph D_3-Math.Sin_Code Block.dyn (Dynamo 1.3.4.6666)

# group: INPUTS
# note: THSI SCRIPT CAN CREATE A CURVE BASED ON SEVERAL NUMERICAL INPUTS
startnumber = DoubleSlider(0, range=0..100 step 0.1)
end_number = DoubleSlider(360, range=0..360 step 0.1)
step = DoubleSlider(10, range=0..100 step 0.1)
phase_value = DoubleSlider(30, range=0..100 step 0.1)
amphlitude = DoubleSlider(50, range=0..100 step 0.1)
degree = DoubleSlider(3, range=1..3 step 1)

# group: CURVE
code_block = CodeBlock(startnumber=startnumber, endnumber=end_number, step=step, phasevalue=phase_value, amphlitudevalue=amphlitude, degree=degree)
# ---------- code_block.designscript (4 lines) ----------
x=startnumber..endnumber..step;
z=Math.Sin(x+phasevalue)*amphlitudevalue;
points=Point.ByCoordinates(x,0,z);
NurbsCurve.ByControlPoints(points,degree);
# ----------------------------------------
