# Dynamo graph D_5-Add and modify parameters of the elements of a project in Revit with Dynamo.dyn (Dynamo 1.3.4.6666)

# group: List of all elements of a specific category
categories = Categories("DuctCurves")
all_elements_of_category = ElementsOfCategory(categories)

# group: Instance parameter
parameters = Element.Parameters(all_elements_of_category)

# group: Type parameter
elementType = Element.ElementType(all_elements_of_category)
parameters_2 = Element.Parameters(elementType)

# group: Get Parameter Name
code_block = CodeBlock { "Reference Level"; "Size"; "Length"; "Area"; }

# group: Size
getParameterValueByName = Element.GetParameterValueByName(element=all_elements_of_category, parameterName=code_block.out1)

# group: Length
getParameterValueByName_2 = Element.GetParameterValueByName(element=all_elements_of_category, parameterName=code_block.out2)

# group: Area
getParameterValueByName_3 = Element.GetParameterValueByName(element=all_elements_of_category, parameterName=code_block.out3)

convert_between_units = DynamoConvert(getParameterValueByName_3, conversionMetric=Area, conversionFrom=SquareMeter, conversionTo=SquareFoot)

# group: Set Parameter
code_block_2 = CodeBlock { "Element id"; "Element Level"; }

# group: Element ID
id = Element.Id(all_elements_of_category)
string_from_object = FromObject(id)

# group: Element ID
setParameterByName = Element.SetParameterByName(element=all_elements_of_category, parameterName=code_block_2.out0, value=string_from_object)

# group: Levels
getParameterValueByName_4 = Element.GetParameterValueByName(element=all_elements_of_category, parameterName=code_block.out0)
name = Element.Name(getParameterValueByName_4)

# group: Element Level
setParameterByName_2 = Element.SetParameterByName(element=all_elements_of_category, parameterName=code_block_2.out1, value=name)
