# Dynamo graph D_5-Export data to Excel with a script of Dynamo instead a plug-in of Revit.dyn (Dynamo 1.3.4.6666)

# group: List of all elements of a specific category
categories = Categories("DuctCurves")
all_elements_of_category = ElementsOfCategory(categories)

# group: Instance parameter
parameters = Element.Parameters(all_elements_of_category)

# group: Type parameter
elementType = Element.ElementType(all_elements_of_category)
parameters_2 = Element.Parameters(elementType)

# group: Set Parameter
code_block = CodeBlock { "Element id"; "Element Level"; }

# group: Element ID
id = Element.Id(all_elements_of_category)
string_from_object = FromObject(id)

# group: Element ID
setParameterByName = Element.SetParameterByName(element=all_elements_of_category, parameterName=code_block.out0, value=string_from_object)

# group: Get Parameter Name
code_block_2 = CodeBlock { "Reference Level"; "Size"; "Length"; "Area"; }

# group: Levels
getParameterValueByName = Element.GetParameterValueByName(element=all_elements_of_category, parameterName=code_block_2.out0)
name = Element.Name(getParameterValueByName)

# group: Element Level
setParameterByName_2 = Element.SetParameterByName(element=all_elements_of_category, parameterName=code_block.out1, value=name)

# group: Element Name
name_2 = Element.Name(all_elements_of_category)

# group: Size
getParameterValueByName_2 = Element.GetParameterValueByName(element=all_elements_of_category, parameterName=code_block_2.out1)

# group: Length
getParameterValueByName_3 = Element.GetParameterValueByName(element=all_elements_of_category, parameterName=code_block_2.out2)

# group: Area
getParameterValueByName_4 = Element.GetParameterValueByName(element=all_elements_of_category, parameterName=code_block_2.out3)

convert_between_units = DynamoConvert(getParameterValueByName_4, conversionMetric=Area, conversionFrom=SquareMeter, conversionTo=SquareFoot)

# group: Export to Excel
file_path = Filename(".\Duct Excel.xlsx")
code_block_3 = CodeBlock { "Duct Export"; }
code_block_4 = CodeBlock { 1; }
code_block_5 = CodeBlock { 0; }
create = List.Create(name_2, string_from_object, name, getParameterValueByName_2, getParameterValueByName_3, convert_between_units)
transpose = List.Transpose(create)
boolean = BoolSelector(true)
writeToFile = Excel.WriteToFile(filePath=file_path, sheetName=code_block_3, startRow=code_block_4, startCol=code_block_5, data=transpose, overWrite=boolean)

# group: Type Name
name_3 = Element.Name(elementType)
