# Dynamo graph D_6-Add name of columns on top of Excel.dyn (Dynamo 1.3.4.6666)

file_path = Filename("D:\TSA\My Documents\Dynamo\My Scripts\Room Export.xlsx")
code_block = CodeBlock { "Rooms"; }
code_block_2 = CodeBlock { 0; }
code_block_3 = CodeBlock()
# ---------- code_block_3.designscript (6 lines) ----------
{"Level",
"Number",
"Department",
"Area",
"Name"
};
# ----------------------------------------
categories = Categories("Rooms")
all_elements_of_category = ElementsOfCategory(categories)
getParameterValueByName = Element.GetParameterValueByName(element=all_elements_of_category, parameterName=code_block_3, lacing=CrossProduct)

# group: Add Name of colum on top
transpose = List.Transpose(getParameterValueByName)
addItemToFront = List.AddItemToFront(item=code_block_3, list=transpose, lacing=Longest)

transpose_2 = List.Transpose(addItemToFront)
boolean = BoolSelector(true)
writeToFile = Excel.WriteToFile(filePath=file_path, sheetName=code_block, startRow=code_block_2, startCol=code_block_2, data=transpose_2, overWrite=boolean)
