# Dynamo graph D_6-Import data from Excel back into Revit.dyn (Dynamo 1.3.4.6666)

categories = Categories("Rooms")
all_elements_of_category = ElementsOfCategory(categories)
code_block = CodeBlock { "Department"; }
file_path = Filename("D:\TSA\My Documents\Dynamo\My Scripts\Room Export.xlsx")
fromPath = FileObject(file_path)  # "File.FromPath"
code_block_2 = CodeBlock { "Rooms"; }
readFromFile = Excel.ReadFromFile(file=fromPath, sheetName=code_block_2)

# group: Clean the list from column names
restOfItems = List.RestOfItems(readFromFile)

transpose = List.Transpose(restOfItems)
code_block_3 = CodeBlock { 2; }
getItemAtIndex = List.GetItemAtIndex(list=transpose, index=code_block_3)
setParameterByName = Element.SetParameterByName(element=all_elements_of_category, parameterName=code_block, value=getItemAtIndex)
