# Dynamo graph D_7.dyn (Dynamo 2.3.0.5885)

# group: Category
categories = Categories("OST_DuctCurves")
all_elements_of_category = ElementsOfCategory(Category=categories)

# group: Extract Offset
# note: For Lower Revit Versions
code_block = CodeBlock { "Middle Elevation"; "Height"; }
list_create = List.Create(item0=code_block.out0, item1=code_block.out1)
getParameterValueByName = Element.GetParameterValueByName(element=all_elements_of_category, parameterName=list_create, lacing=CrossProduct)
code_block_2 = CodeBlock { 0; }
getItemAtIndex = List.GetItemAtIndex(list=getParameterValueByName, index=code_block_2, lacing=CrossProduct)
code_block_3 = CodeBlock { 1; }
getItemAtIndex_2 = List.GetItemAtIndex(list=getParameterValueByName, index=code_block_3, lacing=CrossProduct)

# group: Calculate Bottom of Duct
code_block_4 = CodeBlock(x=getItemAtIndex_2) { (x/2); }
code_block_5 = CodeBlock(Elevation=getItemAtIndex, halfsection=code_block_4) { Elevation-halfsection; }

# group: for revit above 2019
code_block_6 = CodeBlock { "Bottom Elevation"; }
getParameterValueByName_2 = Element.GetParameterValueByName(element=all_elements_of_category, parameterName=code_block_6, lacing=CrossProduct)
