# Dynamo graph Export Multiple Schedules.dyn (Dynamo 2.6.1.8786)
# packages: Data-Shapes 2021.2.94, Crumple 2021.5.27, bimorphNodes 3.0.3, BumbleBee 2021.25.3

code_block = CodeBlock { "SCRIPT COMPLETE"; }
# note: Custom Node: Crumple v.2021.5.27
# note: Author : Pragatheesh Kumar
# Linkedin : https://www.linkedin.com/in/pragatheeshkumar6/
# Script Summary:
# 1.Run the script in Dynamo Player.
# 2.Select the Schedules that need to export.
# 3.Choose the excel sheet file from path (Create a plain excel sheet before running the script )
# Dynamo Package Used:
# - Data Shapes
# - Crumple
# - Bimorph Nodes
# - Bumblebee or archilab_bumblebee
# Thank You !
schedulesbytype = Custom[© SchedulesByType]()  # package Crumple; Returns all schedules in a document, separated into key and non-key schedules.

# group: To Filter the Schedules (optional)
name = Element.Name(element=schedulesbytype.schedules)
code_block_2 = CodeBlock { " Internal"; false; }
contains = String.Contains(str=name, searchFor=code_block_2.out0, ignoreCase=code_block_2.out1)
filterByBoolMask = List.FilterByBoolMask(list=schedulesbytype.schedules, mask=contains)
name_2 = Element.Name(element=filterByBoolMask.out)

# group: Custom UI using Datashape
code_block_3 = CodeBlock { "EXPORT SCHEDULE"; "EXPORT"; "CANCEL"; 900; 600; 200; }
code_block_4 = CodeBlock { "SCHEDULES"; 400; true; false; }
listview_data = Custom[Listview Data](InputName=code_block_4.out0, Keys=name_2, Values=filterByBoolMask.out, Height_optionnal=code_block_4.out1, HilightInView_optionnal=code_block_4.out3, DisplayModeOnly_optionnal=code_block_4.out3, ShowElementCount_optionnal=code_block_4.out3, SortItems_optionnal=code_block_4.out2, ShowId_optionnal=code_block_4.out3)  # package Data-Shapes; Create data for ListView input in UI.MultiInputForm ++ . Check out www.data-shapes.net for more infos.
code_block_5 = CodeBlock { "FILE PATH"; "Select a file..."; }
# note: Custom Node: Data-Shapes v.2021.2.94
filepath_data = Custom[FilePath Data](InputName=code_block_5.out0, ButtonText=code_block_5.out1)  # package Data-Shapes; Create filepath input for UI.MultipleInputForm ++ . Check out www.data-shapes.net for more infos !
list_create = List.Create(item0=listview_data, item1=filepath_data)
boolean = BoolSelector(true)
multipleinputform = Custom[MultipleInputForm ++](Description_optional=code_block_3.out0, ButtonText_optional=code_block_3.out1, Inputs=list_create, Toggle=boolean, CancelButtonText_optional=code_block_3.out2, MaxHeight_optional=code_block_3.out3, Width_optional=code_block_3.out4, LabelWidth_optional=code_block_3.out5)  # package Data-Shapes; Create a form with multiple inputs. see www.data-shapes.net for tutorials and infos!

# group: Write Data to Excel
code_block_6 = CodeBlock(out=multipleinputform.User_Inputs) { sched = out[0]; path  = out[1]; }
code_block_7 = CodeBlock { true; }
name_3 = Element.Name(element=code_block_6.sched)
code_block_8 = CodeBlock { "A1"; }
code_block_9 = CodeBlock { false; }
# note: Custom Node: BimorphNodes v.3.0.3
getData = Revit.Schedule.GetData(scheduleView=code_block_6.sched, refresh=code_block_9)
bb_data = Custom[BB Data](sheetName=name_3, origin=code_block_8, data=getData@L4)  # package BumbleBee; This node is a building block for different modes of writing to Excel files. You can combines this node into a list to write to multiple sheets or use just one to write to a single sheet.
write_excel = Custom[Write Excel](filePath=code_block_6.path, runIt=code_block_7, BBData=bb_data)  # package BumbleBee; This node will write data to Excel file and based on how your BBData nodes are structured it will either override the exsting file, create a new one and write a single worksheet or write multiple worksheets.

uimessenger = Custom[© UIMessenger](title=code_block, body=write_excel)  # package Crumple; Displays a message box with a title/body and OK/cancel button. If OK is selected, the third input's data will be passed through.
