# Dynamo graph Find errors in Revit managing data in Dynamo.dyn "D_7-Find errors in Revit managing data in Dynamo" (Dynamo 2.3.0.5885)
# packages: Data-Shapes 2021.2.92

# group: Categories
categories = Categories("OST_DuctCurves")
all_elements_of_category = ElementsOfCategory(Category=categories)
code_block = CodeBlock()
# ---------- code_block.designscript (2 lines) ----------
//Elevation to check
4000;
# ----------------------------------------

# group: Extract Offset
# note: For Lower Revit Versions
code_block_2 = CodeBlock { "Middle Elevation"; "Height"; }
list_create = List.Create(item0=code_block_2.out0, item1=code_block_2.out1)
getParameterValueByName = Element.GetParameterValueByName(element=all_elements_of_category, parameterName=list_create, lacing=CrossProduct)
code_block_3 = CodeBlock { 0; }
getItemAtIndex = List.GetItemAtIndex(list=getParameterValueByName, index=code_block_3, lacing=CrossProduct)
code_block_4 = CodeBlock { 1; }
getItemAtIndex_2 = List.GetItemAtIndex(list=getParameterValueByName, index=code_block_4, lacing=CrossProduct)

# group: Calculate Bottom of Duct
code_block_5 = CodeBlock(x=getItemAtIndex_2) { (x/2); }
code_block_6 = CodeBlock(Elevation=getItemAtIndex, halfsection=code_block_5) { Elevation-halfsection; }

# group: for revit above 2019
code_block_7 = CodeBlock { "Bottom Elevation"; }
getParameterValueByName_2 = Element.GetParameterValueByName(element=all_elements_of_category, parameterName=code_block_7, lacing=CrossProduct)

round = Math.Round(number=getParameterValueByName_2)
code_block_8 = CodeBlock(x=round, y=code_block) { x<y; }
filterByBoolMask = List.FilterByBoolMask(list=all_elements_of_category, mask=code_block_8)
code_block_9 = CodeBlock { "Comments"; "Notverified"; }
setParameterByName = Element.SetParameterByName(element=filterByBoolMask.in, parameterName=code_block_9.out0, value=code_block_9.out1)
code_block_10 = CodeBlock { "Tool to check duct elevation"; "Ok"; "Cancel"; }
file_path = Filename("C:\Users\Pragatheesh\Pictures\InShot_20200413_133553881.jpg")
file_from_path = FileObject(path=file_path)
readFromFile = Image.ReadFromFile(file=file_from_path)
code_block_11 = CodeBlock { "Category"; }
categories_list = Custom[Categories list]()  # package Data-Shapes; Gives list of all Revit categories and a matching list of their names
dropdown_data = Custom[DropDown Data](InputName=code_block_11, Keys=categories_list.Category_name_s, Values=categories_list.Revit_Categories)  # package Data-Shapes; Create data for DropDown input in UI.MultiInputForm ++ . Check out www.data-shapes.net for more infos.
code_block_12 = CodeBlock { "Elevation Check"; "2500"; }
textbox_data = Custom[TextBox Data](InputName=code_block_12.out0, DefaultText=code_block_12.out1)  # package Data-Shapes; Create Data for TextBox input in UI.MultipleInputForm ++ . Check out www.data-shapes.net for more informations
list_create_2 = List.Create(item0=dropdown_data, item1=textbox_data)
boolean = BoolSelector(true)
multipleinputform = Custom[MultipleInputForm ++](Description_optional=code_block_10.out0, Logo_optional=readFromFile, ButtonText_optional=code_block_10.out1, Inputs=list_create_2, Toggle=boolean, CancelButtonText_optional=code_block_10.out2)  # package Data-Shapes; Create a form with multiple inputs. see www.data-shapes.net for tutorials and infos!
