# Dynamo graph Foster and Partners - Stanstead Remixed - final - four.dyn (Dynamo 0.8.1.1052)

mega_slider = DoubleSlider(20, range=0..20 step 0.01)
code_block = CodeBlock { 0; 20; }
mega_slider_2 = DoubleSlider(15, range=0..20 step 0.01)
create = List.Create(code_block.out0, mega_slider_2, code_block.out1)
code_block_2 = CodeBlock { 10.5; }
code_block_3 = CodeBlock { 2.9; }
remapRange = Math.RemapRange(numbers=create, newMin=code_block_2, newMax=code_block_3)
watch = Watch(remapRange)
code_block_4 = CodeBlock { 1; }
getItemAtIndex = List.GetItemAtIndex(list=watch, index=code_block_4)
watch_2 = Watch(getItemAtIndex)
code_block_5 = CodeBlock { (1/7)*6; }
XY = Plane.XY()
code_block_6 = CodeBlock { 100; }
byWidthHeight = Rectangle.ByWidthHeight(XY, code_block_6, code_block_6)
explode = Geometry.Explode(byWidthHeight)
code_block_7 = CodeBlock { 0; }
getItemAtIndex_2 = List.GetItemAtIndex(list=explode, index=code_block_7)
startPoint = Curve.StartPoint(getItemAtIndex_2)
code_block_8 = CodeBlock { 0.5; }
planeAtParameter = Curve.PlaneAtParameter(curve=getItemAtIndex_2, param=code_block_8)
origin = Plane.Origin(planeAtParameter)
YAxis = Plane.YAxis(planeAtParameter)
reverse = Vector.Reverse(YAxis)
translate = Geometry.Translate(geometry=origin, direction=reverse, distance=mega_slider_2)
endPoint = Curve.EndPoint(getItemAtIndex_2)
byThreePoints = Arc.ByThreePoints(firstPoint=startPoint, secondPoint=translate, thirdPoint=endPoint)
code_block_9 = CodeBlock { 2; }
getItemAtIndex_3 = List.GetItemAtIndex(list=explode, index=code_block_9)
startPoint_2 = Curve.StartPoint(getItemAtIndex_3)
code_block_10 = CodeBlock { 0.5; }
planeAtParameter_2 = Curve.PlaneAtParameter(curve=getItemAtIndex_3, param=code_block_10)
origin_2 = Plane.Origin(planeAtParameter_2)
YAxis_2 = Plane.YAxis(planeAtParameter_2)
reverse_2 = Vector.Reverse(YAxis_2)
translate_2 = Geometry.Translate(geometry=origin_2, direction=reverse_2, distance=mega_slider_2)
endPoint_2 = Curve.EndPoint(getItemAtIndex_3)
byThreePoints_2 = Arc.ByThreePoints(firstPoint=startPoint_2, secondPoint=translate_2, thirdPoint=endPoint_2)
create_2 = List.Create(byThreePoints, byThreePoints_2)
code_block_11 = CodeBlock { 1; }
getItemAtIndex_4 = List.GetItemAtIndex(list=explode, index=code_block_11)
startPoint_3 = Curve.StartPoint(getItemAtIndex_4)
code_block_12 = CodeBlock { 0.5; }
planeAtParameter_3 = Curve.PlaneAtParameter(curve=getItemAtIndex_4, param=code_block_12)
origin_3 = Plane.Origin(planeAtParameter_3)
YAxis_3 = Plane.YAxis(planeAtParameter_3)
reverse_3 = Vector.Reverse(YAxis_3)
translate_3 = Geometry.Translate(geometry=origin_3, direction=reverse_3, distance=mega_slider_2)
endPoint_3 = Curve.EndPoint(getItemAtIndex_4)
byThreePoints_3 = Arc.ByThreePoints(firstPoint=startPoint_3, secondPoint=translate_3, thirdPoint=endPoint_3)
code_block_13 = CodeBlock { 3; }
getItemAtIndex_5 = List.GetItemAtIndex(list=explode, index=code_block_13)
startPoint_4 = Curve.StartPoint(getItemAtIndex_5)
code_block_14 = CodeBlock { 0.5; }
planeAtParameter_4 = Curve.PlaneAtParameter(curve=getItemAtIndex_5, param=code_block_14)
origin_4 = Plane.Origin(planeAtParameter_4)
YAxis_4 = Plane.YAxis(planeAtParameter_4)
reverse_4 = Vector.Reverse(YAxis_4)
translate_4 = Geometry.Translate(geometry=origin_4, direction=reverse_4, distance=mega_slider_2)
endPoint_4 = Curve.EndPoint(getItemAtIndex_5)
byThreePoints_4 = Arc.ByThreePoints(firstPoint=startPoint_4, secondPoint=translate_4, thirdPoint=endPoint_4)
create_3 = List.Create(byThreePoints_3, byThreePoints_4)
byLoft = Surface.ByLoft(create_2, create_3)
code_block_15 = CodeBlock { 1; }
code_block_16 = CodeBlock { (1/7)*6; }
byIsoCurveOnSurface = Curve.ByIsoCurveOnSurface(baseSurface=byLoft, direction=code_block_15, parameter=code_block_16)
ZAxis = Vector.ZAxis()
code_block_17 = CodeBlock { 18; }
translate_5 = Geometry.Translate(geometry=startPoint, direction=ZAxis, distance=code_block_17)
translate_6 = Geometry.Translate(geometry=endPoint, direction=ZAxis, distance=code_block_17)
byStartPointEndPoint = Line.ByStartPointEndPoint(startPoint=translate_5, endPoint=translate_6)
XAxis = Vector.XAxis()
reverse_5 = Vector.Reverse(XAxis)
code_block_18 = CodeBlock(x=code_block_6) { x/2; }
translate_7 = Geometry.Translate(geometry=byStartPointEndPoint, direction=reverse_5, distance=code_block_18)
startPoint_5 = Curve.StartPoint(translate_7)
code_block_19 = CodeBlock { 0.5; }
planeAtParameter_5 = Curve.PlaneAtParameter(curve=translate_7, param=code_block_19)
origin_5 = Plane.Origin(planeAtParameter_5)
XAxis_2 = Plane.XAxis(planeAtParameter_5)
reverse_6 = Vector.Reverse(XAxis_2)
code_block_20 = CodeBlock(x=mega_slider_2) { x*0.67; }
translate_8 = Geometry.Translate(geometry=origin_5, direction=reverse_6, distance=code_block_20)
endPoint_5 = Curve.EndPoint(translate_7)
byThreePoints_5 = Arc.ByThreePoints(firstPoint=startPoint_5, secondPoint=translate_8, thirdPoint=endPoint_5)
translate_9 = Geometry.Translate(geometry=translate_7, direction=reverse_5, distance=code_block_18)
create_4 = List.Create(byStartPointEndPoint, byThreePoints_5, translate_9)
byLoft_2 = Surface.ByLoft(create_4)
ZAxis_2 = Vector.ZAxis()
projectInputOnto = Surface.ProjectInputOnto(byLoft_2, byIsoCurveOnSurface, ZAxis_2)
create_5 = List.Create(byIsoCurveOnSurface, projectInputOnto)
flatten = Flatten(create_5)
byLoft_3 = Surface.ByLoft(flatten)
code_block_21 = CodeBlock { 1; 0; }
byIsoCurveOnSurface_2 = Curve.ByIsoCurveOnSurface(baseSurface=byLoft, direction=code_block_21.out0, parameter=code_block_21.out1)
ZAxis_3 = Vector.ZAxis()
projectInputOnto_2 = Surface.ProjectInputOnto(byLoft_2, byIsoCurveOnSurface_2, ZAxis_3)
create_6 = List.Create(byIsoCurveOnSurface_2, projectInputOnto_2)
flatten_2 = Flatten(create_6)
byLoft_4 = Surface.ByLoft(flatten_2)
code_block_22 = CodeBlock { 0; 0; }
byIsoCurveOnSurface_3 = Curve.ByIsoCurveOnSurface(baseSurface=byLoft, direction=code_block_22.out0, parameter=code_block_22.out1)
split = Geometry.Split(geometry=byIsoCurveOnSurface_3, other=byIsoCurveOnSurface)
flatten_3 = Flatten(split)
code_block_23 = CodeBlock { 0; }
getItemAtIndex_6 = List.GetItemAtIndex(list=flatten_3, index=code_block_23)
ZAxis_4 = Vector.ZAxis()
projectInputOnto_3 = Surface.ProjectInputOnto(byLoft_2, getItemAtIndex_6, ZAxis_4)
create_7 = List.Create(getItemAtIndex_6, projectInputOnto_3)
flatten_4 = Flatten(create_7)
byLoft_5 = Surface.ByLoft(flatten_4)
code_block_24 = CodeBlock { 0; 1; }
byIsoCurveOnSurface_4 = Curve.ByIsoCurveOnSurface(baseSurface=byLoft, direction=code_block_24.out0, parameter=code_block_24.out1)
split_2 = Geometry.Split(geometry=byIsoCurveOnSurface_4, other=byIsoCurveOnSurface)
flatten_5 = Flatten(split_2)
code_block_25 = CodeBlock { 0; }
getItemAtIndex_7 = List.GetItemAtIndex(list=flatten_5, index=code_block_25)
ZAxis_5 = Vector.ZAxis()
projectInputOnto_4 = Surface.ProjectInputOnto(byLoft_2, getItemAtIndex_7, ZAxis_5)
create_8 = List.Create(getItemAtIndex_7, projectInputOnto_4)
flatten_6 = Flatten(create_8)
byLoft_6 = Surface.ByLoft(flatten_6)
create_9 = List.Create(byLoft_3, byLoft_4, byLoft_5, byLoft_6)
code_block_26 = CodeBlock { 0; }
code_block_27 = CodeBlock { 0.1..0.9..0.1; }
byIsoCurveOnSurface_5 = Curve.ByIsoCurveOnSurface(baseSurface=create_9, direction=code_block_26, parameter=code_block_27, lacing=CrossProduct)
code_block_28 = CodeBlock { 1; }
flatten_7 = List.Flatten(list=byIsoCurveOnSurface_5, amt=code_block_28)
transpose = List.Transpose(flatten_7)
byJoinedCurves = PolyCurve.ByJoinedCurves(transpose)
code_block_29 = CodeBlock { 1; }
planeAtParameter_6 = Curve.PlaneAtParameter(curve=byIsoCurveOnSurface_5, param=code_block_29)
code_block_30 = CodeBlock { 0.2; }
byWidthHeight_2 = Rectangle.ByWidthHeight(planeAtParameter_6, code_block_30, code_block_30)
bySweep = PolySurface.BySweep(byIsoCurveOnSurface_5, byWidthHeight_2)
byGeometry = ImportInstance.ByGeometry(bySweep)
code_block_31 = CodeBlock { 7; }
lunchbox_quad_grid_by_face = Custom[LunchBox Quad Grid by Face](Surface=byLoft, U=code_block_31, V=code_block_31)  # Create a quadrangular XYZ grid on a face. The face surface must have an untrimmed UV parameter space.
code_block_32 = CodeBlock { true; false; true; false; true; false; true; }
code_block_33 = CodeBlock { false; }
cycle = List.Cycle(list=code_block_33, amount=code_block_31)
create_10 = List.Create(code_block_32.out0, code_block_32.out1, code_block_32.out2, code_block_32.out3, code_block_32.out4, code_block_32.out5, code_block_32.out6, cycle)
flatten_8 = Flatten(create_10)
code_block_34 = CodeBlock { 3; }
cycle_2 = List.Cycle(list=flatten_8, amount=code_block_34)
create_11 = List.Create(cycle_2, code_block_32.out0, code_block_32.out1, code_block_32.out2, code_block_32.out3, code_block_32.out4, code_block_32.out5, code_block_32.out6)
flatten_9 = Flatten(create_11)
filterByBoolMask = List.FilterByBoolMask(list=lunchbox_quad_grid_by_face.Panel_Pts, mask=flatten_9)
ZAxis_6 = Vector.ZAxis()
projectInputOnto_5 = Surface.ProjectInputOnto(byLoft_2, filterByBoolMask.out, ZAxis_6)
transpose_2 = List.Transpose(projectInputOnto_5)
code_block_35 = CodeBlock { 0; }
getItemAtIndex_8 = List.GetItemAtIndex(list=transpose_2, index=code_block_35)
flatten_10 = Flatten(getItemAtIndex_8)
code_block_36 = CodeBlock { 2; }
getItemAtIndex_9 = List.GetItemAtIndex(list=transpose_2, index=code_block_36)
byStartPointEndPoint_2 = Line.ByStartPointEndPoint(startPoint=getItemAtIndex_8, endPoint=getItemAtIndex_9)
code_block_37 = CodeBlock { 0.5; }
planeAtParameter_7 = Curve.PlaneAtParameter(curve=byStartPointEndPoint_2, param=code_block_37)
origin_6 = Plane.Origin(planeAtParameter_7)
flatten_11 = Flatten(origin_6)
ZAxis_7 = Vector.ZAxis()
code_block_38 = CodeBlock { 3; }
translate_10 = Geometry.Translate(geometry=flatten_11, direction=ZAxis_7, distance=code_block_38)
flatten_12 = Flatten(getItemAtIndex_9)
byThreePoints_6 = Arc.ByThreePoints(firstPoint=flatten_10, secondPoint=translate_10, thirdPoint=flatten_12)
code_block_39 = CodeBlock { 1; }
getItemAtIndex_10 = List.GetItemAtIndex(list=transpose_2, index=code_block_39)
flatten_13 = Flatten(getItemAtIndex_10)
code_block_40 = CodeBlock { 3; }
getItemAtIndex_11 = List.GetItemAtIndex(list=transpose_2, index=code_block_40)
flatten_14 = Flatten(getItemAtIndex_11)
byThreePoints_7 = Arc.ByThreePoints(firstPoint=flatten_13, secondPoint=translate_10, thirdPoint=flatten_14)
split_3 = Geometry.Split(geometry=byThreePoints_6, other=byThreePoints_7)
transpose_3 = List.Transpose(split_3)
code_block_41 = CodeBlock { 0; }
getItemAtIndex_12 = List.GetItemAtIndex(list=transpose_3, index=code_block_41)
code_block_42 = CodeBlock { 3; }
divideEqually = Curve.DivideEqually(getItemAtIndex_12, code_block_42)
startPoint_6 = Curve.StartPoint(divideEqually)
split_4 = Geometry.Split(geometry=byThreePoints_7, other=byThreePoints_6)
transpose_4 = List.Transpose(split_4)
code_block_43 = CodeBlock { 0; }
getItemAtIndex_13 = List.GetItemAtIndex(list=transpose_4, index=code_block_43)
divideEqually_2 = Curve.DivideEqually(getItemAtIndex_13, code_block_42)
startPoint_7 = Curve.StartPoint(divideEqually_2)
byStartPointEndPoint_3 = Line.ByStartPointEndPoint(startPoint=startPoint_6, endPoint=startPoint_7)
byLoft_7 = Surface.ByLoft(byStartPointEndPoint_3)
code_block_44 = CodeBlock { 1; }
getItemAtIndex_14 = List.GetItemAtIndex(list=transpose_3, index=code_block_44)
reverse_7 = Curve.Reverse(getItemAtIndex_14)
divideEqually_3 = Curve.DivideEqually(reverse_7, code_block_42)
startPoint_8 = Curve.StartPoint(divideEqually_3)
byStartPointEndPoint_4 = Line.ByStartPointEndPoint(startPoint=startPoint_8, endPoint=startPoint_7)
byLoft_8 = Surface.ByLoft(byStartPointEndPoint_4)
code_block_45 = CodeBlock { 1; }
getItemAtIndex_15 = List.GetItemAtIndex(list=transpose_4, index=code_block_45)
reverse_8 = Curve.Reverse(getItemAtIndex_15)
divideEqually_4 = Curve.DivideEqually(reverse_8, code_block_42)
startPoint_9 = Curve.StartPoint(divideEqually_4)
byStartPointEndPoint_5 = Line.ByStartPointEndPoint(startPoint=startPoint_8, endPoint=startPoint_9)
byLoft_9 = Surface.ByLoft(byStartPointEndPoint_5)
byStartPointEndPoint_6 = Line.ByStartPointEndPoint(startPoint=startPoint_6, endPoint=startPoint_9)
byLoft_10 = Surface.ByLoft(byStartPointEndPoint_6)
create_12 = List.Create(byLoft_7, byLoft_8, byLoft_9, byLoft_10)
byGeometry_2 = ImportInstance.ByGeometry(create_12)
ZAxis_8 = Vector.ZAxis()
projectInputOnto_6 = Surface.ProjectInputOnto(byLoft_2, filterByBoolMask.in, ZAxis_8)
transpose_5 = List.Transpose(projectInputOnto_6)
code_block_46 = CodeBlock { 0; }
getItemAtIndex_16 = List.GetItemAtIndex(list=transpose_5, index=code_block_46)
flatten_15 = Flatten(getItemAtIndex_16)
code_block_47 = CodeBlock { 2; }
getItemAtIndex_17 = List.GetItemAtIndex(list=transpose_5, index=code_block_47)
byStartPointEndPoint_7 = Line.ByStartPointEndPoint(startPoint=getItemAtIndex_16, endPoint=getItemAtIndex_17)
code_block_48 = CodeBlock { 0.5; }
planeAtParameter_8 = Curve.PlaneAtParameter(curve=byStartPointEndPoint_7, param=code_block_48)
origin_7 = Plane.Origin(planeAtParameter_8)
flatten_16 = Flatten(origin_7)
ZAxis_9 = Vector.ZAxis()
code_block_49 = CodeBlock { 3; }
translate_11 = Geometry.Translate(geometry=flatten_16, direction=ZAxis_9, distance=code_block_49)
flatten_17 = Flatten(getItemAtIndex_17)
byThreePoints_8 = Arc.ByThreePoints(firstPoint=flatten_15, secondPoint=translate_11, thirdPoint=flatten_17)
code_block_50 = CodeBlock { 1; }
getItemAtIndex_18 = List.GetItemAtIndex(list=transpose_5, index=code_block_50)
flatten_18 = Flatten(getItemAtIndex_18)
code_block_51 = CodeBlock { 3; }
getItemAtIndex_19 = List.GetItemAtIndex(list=transpose_5, index=code_block_51)
flatten_19 = Flatten(getItemAtIndex_19)
byThreePoints_9 = Arc.ByThreePoints(firstPoint=flatten_18, secondPoint=translate_11, thirdPoint=flatten_19)
split_5 = Geometry.Split(geometry=byThreePoints_8, other=byThreePoints_9)
transpose_6 = List.Transpose(split_5)
code_block_52 = CodeBlock { 0; }
getItemAtIndex_20 = List.GetItemAtIndex(list=transpose_6, index=code_block_52)
code_block_53 = CodeBlock { 3; }
divideEqually_5 = Curve.DivideEqually(getItemAtIndex_20, code_block_53)
startPoint_10 = Curve.StartPoint(divideEqually_5)
split_6 = Geometry.Split(geometry=byThreePoints_9, other=byThreePoints_8)
transpose_7 = List.Transpose(split_6)
code_block_54 = CodeBlock { 0; }
getItemAtIndex_21 = List.GetItemAtIndex(list=transpose_7, index=code_block_54)
divideEqually_6 = Curve.DivideEqually(getItemAtIndex_21, code_block_53)
startPoint_11 = Curve.StartPoint(divideEqually_6)
byStartPointEndPoint_8 = Line.ByStartPointEndPoint(startPoint=startPoint_10, endPoint=startPoint_11)
byLoft_11 = Surface.ByLoft(byStartPointEndPoint_8)
code_block_55 = CodeBlock { 1; }
getItemAtIndex_22 = List.GetItemAtIndex(list=transpose_6, index=code_block_55)
reverse_9 = Curve.Reverse(getItemAtIndex_22)
divideEqually_7 = Curve.DivideEqually(reverse_9, code_block_53)
startPoint_12 = Curve.StartPoint(divideEqually_7)
byStartPointEndPoint_9 = Line.ByStartPointEndPoint(startPoint=startPoint_12, endPoint=startPoint_11)
byLoft_12 = Surface.ByLoft(byStartPointEndPoint_9)
code_block_56 = CodeBlock { 1; }
getItemAtIndex_23 = List.GetItemAtIndex(list=transpose_7, index=code_block_56)
reverse_10 = Curve.Reverse(getItemAtIndex_23)
divideEqually_8 = Curve.DivideEqually(reverse_10, code_block_53)
startPoint_13 = Curve.StartPoint(divideEqually_8)
byStartPointEndPoint_10 = Line.ByStartPointEndPoint(startPoint=startPoint_12, endPoint=startPoint_13)
byLoft_13 = Surface.ByLoft(byStartPointEndPoint_10)
byStartPointEndPoint_11 = Line.ByStartPointEndPoint(startPoint=startPoint_10, endPoint=startPoint_13)
byLoft_14 = Surface.ByLoft(byStartPointEndPoint_11)
create_13 = List.Create(byLoft_11, byLoft_12, byLoft_13, byLoft_14)
byGeometry_3 = ImportInstance.ByGeometry(create_13)
transpose_8 = List.Transpose(projectInputOnto_6)
code_block_57 = CodeBlock { 0; }
getItemAtIndex_24 = List.GetItemAtIndex(list=transpose_8, index=code_block_57)
flatten_20 = Flatten(getItemAtIndex_24)
code_block_58 = CodeBlock { 1; }
getItemAtIndex_25 = List.GetItemAtIndex(list=transpose_8, index=code_block_58)
flatten_21 = Flatten(getItemAtIndex_25)
code_block_59 = CodeBlock { 2; }
getItemAtIndex_26 = List.GetItemAtIndex(list=transpose_8, index=code_block_59)
flatten_22 = Flatten(getItemAtIndex_26)
code_block_60 = CodeBlock { 3; }
getItemAtIndex_27 = List.GetItemAtIndex(list=transpose_8, index=code_block_60)
flatten_23 = Flatten(getItemAtIndex_27)
create_14 = List.Create(flatten_20, flatten_21, flatten_22, flatten_23)
transpose_9 = List.Transpose(create_14)
code_block_61 = CodeBlock { 1; }
boolean = BoolSelector(true)
byControlPoints = NurbsCurve.ByControlPoints(transpose_9, code_block_61, boolean)
byPatch = Surface.ByPatch(byControlPoints)
code_block_62 = CodeBlock { 0.01; }
thicken = Surface.Thicken(surface=byPatch, thickness=code_block_62)
centroid = Solid.Centroid(thicken)
ZAxis_10 = Vector.ZAxis()
byOriginNormal = Plane.ByOriginNormal(origin=centroid, normal=ZAxis_10)
byStartPointEndPoint_12 = Line.ByStartPointEndPoint(startPoint=centroid, endPoint=flatten_23)
code_block_63 = CodeBlock { 0.035; }
planeAtParameter_9 = Curve.PlaneAtParameter(curve=byStartPointEndPoint_12, param=code_block_63)
origin_8 = Plane.Origin(planeAtParameter_9)
code_block_64 = CodeBlock { 0.01; }
planeAtParameter_10 = Curve.PlaneAtParameter(curve=byStartPointEndPoint_12, param=code_block_64)
origin_9 = Plane.Origin(planeAtParameter_10)
scale2D = Geometry.Scale2D(byControlPoints, byOriginNormal, origin_8, origin_9)
ZAxis_11 = Vector.ZAxis()
reverse_11 = Vector.Reverse(ZAxis_11)
translate_12 = Geometry.Translate(geometry=scale2D, direction=reverse_11, distance=getItemAtIndex)
explode_2 = Geometry.Explode(translate_12)
endPoint_6 = Curve.EndPoint(explode_2)
transpose_10 = List.Transpose(endPoint_6)
code_block_65 = CodeBlock { 3; }
getItemAtIndex_28 = List.GetItemAtIndex(list=transpose_10, index=code_block_65)
byStartPointEndPoint_13 = Line.ByStartPointEndPoint(startPoint=flatten_20, endPoint=getItemAtIndex_28)
code_block_66 = CodeBlock { 0; }
planeAtParameter_11 = Curve.PlaneAtParameter(curve=byStartPointEndPoint_13, param=code_block_66)
code_block_67 = CodeBlock { 0.3; }
byPlaneRadius = Circle.ByPlaneRadius(plane=planeAtParameter_11, radius=code_block_67)
bySweep_2 = Surface.BySweep(byPlaneRadius, byStartPointEndPoint_13)
code_block_68 = CodeBlock { 0; }
getItemAtIndex_29 = List.GetItemAtIndex(list=transpose_10, index=code_block_68)
byStartPointEndPoint_14 = Line.ByStartPointEndPoint(startPoint=flatten_21, endPoint=getItemAtIndex_29)
code_block_69 = CodeBlock { 0; }
planeAtParameter_12 = Curve.PlaneAtParameter(curve=byStartPointEndPoint_14, param=code_block_69)
code_block_70 = CodeBlock { 0.3; }
byPlaneRadius_2 = Circle.ByPlaneRadius(plane=planeAtParameter_12, radius=code_block_70)
bySweep_3 = Surface.BySweep(byPlaneRadius_2, byStartPointEndPoint_14)
code_block_71 = CodeBlock { 1; }
getItemAtIndex_30 = List.GetItemAtIndex(list=transpose_10, index=code_block_71)
byStartPointEndPoint_15 = Line.ByStartPointEndPoint(startPoint=flatten_22, endPoint=getItemAtIndex_30)
code_block_72 = CodeBlock { 0; }
planeAtParameter_13 = Curve.PlaneAtParameter(curve=byStartPointEndPoint_15, param=code_block_72)
code_block_73 = CodeBlock { 0.3; }
byPlaneRadius_3 = Circle.ByPlaneRadius(plane=planeAtParameter_13, radius=code_block_73)
bySweep_4 = Surface.BySweep(byPlaneRadius_3, byStartPointEndPoint_15)
code_block_74 = CodeBlock { 2; }
getItemAtIndex_31 = List.GetItemAtIndex(list=transpose_10, index=code_block_74)
byStartPointEndPoint_16 = Line.ByStartPointEndPoint(startPoint=flatten_23, endPoint=getItemAtIndex_31)
code_block_75 = CodeBlock { 0; }
planeAtParameter_14 = Curve.PlaneAtParameter(curve=byStartPointEndPoint_16, param=code_block_75)
code_block_76 = CodeBlock { 0.3; }
byPlaneRadius_4 = Circle.ByPlaneRadius(plane=planeAtParameter_14, radius=code_block_76)
bySweep_5 = Surface.BySweep(byPlaneRadius_4, byStartPointEndPoint_16)
create_15 = List.Create(bySweep_2, bySweep_3, bySweep_4, bySweep_5)
byGeometry_4 = ImportInstance.ByGeometry(create_15)
XY_2 = Plane.XY()
ZAxis_12 = Vector.ZAxis()
reverse_12 = Vector.Reverse(ZAxis_12)
project = Point.Project(getItemAtIndex_29, XY_2, reverse_12)
flatten_24 = Flatten(project)
byStartPointEndPoint_17 = Line.ByStartPointEndPoint(startPoint=getItemAtIndex_29, endPoint=flatten_24)
code_block_77 = CodeBlock { 0; }
planeAtParameter_15 = Curve.PlaneAtParameter(curve=byStartPointEndPoint_17, param=code_block_77)
code_block_78 = CodeBlock { 0.5; }
byPlaneRadius_5 = Circle.ByPlaneRadius(plane=planeAtParameter_15, radius=code_block_78)
bySweep_6 = Surface.BySweep(byPlaneRadius_5, byStartPointEndPoint_17)
project_2 = Point.Project(getItemAtIndex_30, XY_2, reverse_12)
flatten_25 = Flatten(project_2)
byStartPointEndPoint_18 = Line.ByStartPointEndPoint(startPoint=getItemAtIndex_30, endPoint=flatten_25)
code_block_79 = CodeBlock { 0; }
planeAtParameter_16 = Curve.PlaneAtParameter(curve=byStartPointEndPoint_18, param=code_block_79)
code_block_80 = CodeBlock { 0.5; }
byPlaneRadius_6 = Circle.ByPlaneRadius(plane=planeAtParameter_16, radius=code_block_80)
bySweep_7 = Surface.BySweep(byPlaneRadius_6, byStartPointEndPoint_18)
project_3 = Point.Project(getItemAtIndex_31, XY_2, reverse_12)
flatten_26 = Flatten(project_3)
byStartPointEndPoint_19 = Line.ByStartPointEndPoint(startPoint=getItemAtIndex_31, endPoint=flatten_26)
code_block_81 = CodeBlock { 0; }
planeAtParameter_17 = Curve.PlaneAtParameter(curve=byStartPointEndPoint_19, param=code_block_81)
code_block_82 = CodeBlock { 0.5; }
byPlaneRadius_7 = Circle.ByPlaneRadius(plane=planeAtParameter_17, radius=code_block_82)
bySweep_8 = Surface.BySweep(byPlaneRadius_7, byStartPointEndPoint_19)
project_4 = Point.Project(getItemAtIndex_28, XY_2, reverse_12)
flatten_27 = Flatten(project_4)
byStartPointEndPoint_20 = Line.ByStartPointEndPoint(startPoint=getItemAtIndex_28, endPoint=flatten_27)
code_block_83 = CodeBlock { 0; }
planeAtParameter_18 = Curve.PlaneAtParameter(curve=byStartPointEndPoint_20, param=code_block_83)
code_block_84 = CodeBlock { 0.5; }
byPlaneRadius_8 = Circle.ByPlaneRadius(plane=planeAtParameter_18, radius=code_block_84)
bySweep_9 = Surface.BySweep(byPlaneRadius_8, byStartPointEndPoint_20)
create_16 = List.Create(bySweep_6, bySweep_7, bySweep_8, bySweep_9)
byGeometry_5 = ImportInstance.ByGeometry(create_16)
byGeometries = ImportInstance.ByGeometries(create_9)
byGeometries_2 = ImportInstance.ByGeometries(lunchbox_quad_grid_by_face.Panel_Faces)
