# Dynamo graph GET VIEW NAME FOR SPECIFIC CAD LINK.dyn (Dynamo 1.2.0.2690)

element_types = ElementTypes("CADLinkType")
all_elements_of_type = ElementsOfType(element_types)
watch = Watch(all_elements_of_type)
name_of_cad_file_searching_for = CodeBlock { "15.063_12.10.16_Ground Floor building outline Draft.dwg"; }
fromElementNameMatch = Custom[GetElementInfo.FromElementNameMatch](List=all_elements_of_type, string=name_of_cad_file_searching_for)  # Gets the element ID from a list by matching a string to the name of the element.
watch_2 = Watch(fromElementNameMatch.ElementID_int)
views = Views("Level 0")
views_2 = Views("Level 0 Copy 1")
views_3 = Views("Level 0 Copy 1 Copy 1")
views_4 = Views("Level 0 Copy 1 Copy 1 Copy 1")
views_5 = Views("Level 0 Copy 1 Copy 1 Copy 1 Copy 1")
create = List.Create(views, views_2, views_3, views_4, views_5)
code_block = CodeBlock { 0; }
count = Count(create)
code_block_2 = CodeBlock(input=count) { input-1; }
lt = _ < code_block_2  # unwired: arg0
code_block_3 = CodeBlock { 1; }
add = _ + code_block_3  # unwired: arg0
loopWhile = LoopWhile(code_block, lt, add)
code_block_4 = CodeBlock(input=create, x=loopWhile) { input[x]; }
python_script = Python(IN[0]=code_block_4)
# ---------- python_script.python (20 lines) ----------
import clr

# Import DocumentManager and TransactionManager
clr.AddReference("RevitServices")
import RevitServices
from RevitServices.Persistence import DocumentManager

# Import RevitAPI
clr.AddReference("RevitAPI")
import Autodesk
from Autodesk.Revit.DB import *

doc = DocumentManager.Instance.CurrentDBDocument

view = UnwrapElement(IN[0])

collector = FilteredElementCollector(doc, view.Id).OfClass(ImportInstance)
collector.ToElements()

OUT = view
# ----------------------------------------
watch_3 = Watch(python_script)
python_script_2 = Python(IN[0]=code_block_4)
# ---------- python_script_2.python (20 lines) ----------
import clr

# Import DocumentManager and TransactionManager
clr.AddReference("RevitServices")
import RevitServices
from RevitServices.Persistence import DocumentManager

# Import RevitAPI
clr.AddReference("RevitAPI")
import Autodesk
from Autodesk.Revit.DB import *

doc = DocumentManager.Instance.CurrentDBDocument

view = UnwrapElement(IN[0])

collector = FilteredElementCollector(doc, view.Id).OfClass(ImportInstance)
collector.ToElements()

OUT = collector
# ----------------------------------------
copying_things = Python(IN[0]=watch_3, IN[1]=python_script_2, IN[2]=views)
# ---------- copying_things.python (34 lines) ----------
import clr

# IMPORT REVIT API
clr.AddReference('RevitAPI')
from Autodesk.Revit.DB import *

clr.AddReference("System")
from System.Collections.Generic import List

# import document manager and transaction manager
clr.AddReference("RevitServices")
import RevitServices
from RevitServices.Persistence import DocumentManager
from RevitServices.Transactions import TransactionManager

#the inputs to this node will be stored as a list in the in varible
doc = 	DocumentManager.Instance.CurrentDBDocument

view1 = UnwrapElement(IN[0])
elements = UnwrapElement(IN[1])
view2 = UnwrapElement(IN[2])

elementsId = List[ElementId]([el.Id for el in elements])

#start transaction
TransactionManager.Instance.EnsureInTransaction(doc)

c = ElementTransformUtils.CopyElements(view1,elementsId,view2,None,None)

#End transaction
TransactionManager.Instance.TransactionTaskDone()

#Assign your output to the OUT variable.
OUT = c
# ----------------------------------------
code_block_5 = CodeBlock()
# ---------- code_block_5.designscript (1 lines) ----------
http://dynamobim.org/forums/topic/how-to-copy-element-from-view-to-another-view/
# ----------------------------------------
watch_4 = Watch(python_script_2)
python_script_3 = Python(IN[1]=code_block_4)  # unwired: IN[0]
# ---------- python_script_3.python (20 lines) ----------
import clr

# Import DocumentManager and TransactionManager
clr.AddReference("RevitServices")
import RevitServices
from RevitServices.Persistence import DocumentManager

# Import RevitAPI
clr.AddReference("RevitAPI")
import Autodesk
from Autodesk.Revit.DB import *

doc = UnwrapElement(IN[0])

view = UnwrapElement(IN[1])

collector = FilteredElementCollector(doc, view.Id).OfClass(ImportInstance)
collector.ToElements()

OUT = collector
# ----------------------------------------
views_6 = Custom[Document.Views]()  # Gets all views in the document - except for 3D view templates (as long as this bug is not fixed: https://github.com/DynamoDS/Dynamo/issues/2970)
