# Dynamo graph Lines and Curves.dyn (Dynamo 1.3.3.4111)

code_block = CodeBlock { 500; }
byCoordinates = Point.ByCoordinates(x=code_block)
byOriginNormal = Plane.ByOriginNormal(origin=byCoordinates)
code_block_2 = CodeBlock { 50; }
byPlaneRadius = Circle.ByPlaneRadius(plane=byOriginNormal, radius=code_block_2)
code_block_3 = CodeBlock { 0..1..#20; }
pointAtParameter = Curve.PointAtParameter(curve=byPlaneRadius, param=code_block_3)
code_block_4 = CodeBlock { 500; }
byCoordinates_2 = Point.ByCoordinates(x=code_block_4, z=code_block_4)
byOriginNormal_2 = Plane.ByOriginNormal(origin=byCoordinates_2)
code_block_5 = CodeBlock { 5; }
byPlaneRadius_2 = Circle.ByPlaneRadius(plane=byOriginNormal_2, radius=code_block_5)
pointAtParameter_2 = Curve.PointAtParameter(curve=byPlaneRadius_2, param=code_block_3)
byStartPointEndPoint = Line.ByStartPointEndPoint(startPoint=pointAtParameter, endPoint=pointAtParameter_2)
