# Dynamo graph Lines and curves.dyn (Dynamo 1.3.4.6666)

number = DoubleInput(0)
byCoordinates = Point.ByCoordinates(x=number, y=number, z=number)
number_2 = DoubleInput(5)
byCoordinates_2 = Point.ByCoordinates(x=number, y=number_2, z=number)
byCoordinates_3 = Point.ByCoordinates(x=number_2, y=number_2)
byCoordinates_4 = Point.ByCoordinates(x=number_2)
number_3 = DoubleInput(10)
byCoordinates_5 = Point.ByCoordinates(x=number_3)
byCoordinates_6 = Point.ByCoordinates(x=number_3, y=number_2)
number_4 = DoubleInput(15)
byCoordinates_7 = Point.ByCoordinates(x=number_4, y=number_2)
number_5 = DoubleInput(-5)
byCoordinates_8 = Point.ByCoordinates(x=number_4, y=number_5)
create = List.Create(byCoordinates, byCoordinates_2, byCoordinates_3, byCoordinates_4, byCoordinates_5, byCoordinates_6, byCoordinates_7, byCoordinates_8)
