# Dynamo graph Multi Level Pier - FINAL - four.dyn (Dynamo 0.8.1.1052)

code_block = CodeBlock { 0; 8; }
distance_between_planes = DoubleSlider(26.4, range=5..30 step 0.1)
number_sequence = NumberSeq(code_block.out0, code_block.out1, distance_between_planes, lacing=Longest)
code_block_2 = CodeBlock { 0; }
getItemAtIndex = List.GetItemAtIndex(list=number_sequence, index=code_block_2)
number_slider = DoubleSlider(13.4, range=0..30 step 0.1)
number_slider_2 = DoubleSlider(5, range=0..10 step 0.1)
byCoordinates = Point.ByCoordinates(x=getItemAtIndex, y=number_slider, z=number_slider_2)
code_block_3 = CodeBlock { 1; }
getItemAtIndex_2 = List.GetItemAtIndex(list=number_sequence, index=code_block_3)
number_slider_3 = DoubleSlider(19.9, range=0..30 step 0.1)
byCoordinates_2 = Point.ByCoordinates(x=getItemAtIndex_2, y=number_slider_3, z=number_slider_2)
code_block_4 = CodeBlock { 2; }
getItemAtIndex_3 = List.GetItemAtIndex(list=number_sequence, index=code_block_4)
number_slider_4 = DoubleSlider(33.4, range=0..40 step 0.1)
number_slider_5 = DoubleSlider(5, range=0..10 step 0.1)
byCoordinates_3 = Point.ByCoordinates(x=getItemAtIndex_3, y=number_slider_4, z=number_slider_5)
code_block_5 = CodeBlock { 3; }
getItemAtIndex_4 = List.GetItemAtIndex(list=number_sequence, index=code_block_5)
number_slider_6 = DoubleSlider(17.4, range=0..40 step 0.1)
number_slider_7 = DoubleSlider(5, range=0..10 step 0.1)
byCoordinates_4 = Point.ByCoordinates(x=getItemAtIndex_4, y=number_slider_6, z=number_slider_7)
code_block_6 = CodeBlock { 4; }
getItemAtIndex_5 = List.GetItemAtIndex(list=number_sequence, index=code_block_6)
number_slider_8 = DoubleSlider(6.1, range=0..40 step 0.1)
number_slider_9 = DoubleSlider(5, range=0..10 step 0.1)
byCoordinates_5 = Point.ByCoordinates(x=getItemAtIndex_5, y=number_slider_8, z=number_slider_9)
code_block_7 = CodeBlock { 5; }
getItemAtIndex_6 = List.GetItemAtIndex(list=number_sequence, index=code_block_7)
number_slider_10 = DoubleSlider(2.2, range=0..20 step 0.1)
number_slider_11 = DoubleSlider(5, range=0..10 step 0.1)
byCoordinates_6 = Point.ByCoordinates(x=getItemAtIndex_6, y=number_slider_10, z=number_slider_11)
code_block_8 = CodeBlock { 6; }
getItemAtIndex_7 = List.GetItemAtIndex(list=number_sequence, index=code_block_8)
number_slider_12 = DoubleSlider(-0.3, range=-10..20 step 0.1)
number_slider_13 = DoubleSlider(2.79, range=0..10 step 0.1)
byCoordinates_7 = Point.ByCoordinates(x=getItemAtIndex_7, y=number_slider_12, z=number_slider_13)
code_block_9 = CodeBlock { 7; }
getItemAtIndex_8 = List.GetItemAtIndex(list=number_sequence, index=code_block_9)
number_slider_14 = DoubleSlider(-1.1, range=-10..20 step 0.1)
number_slider_15 = DoubleSlider(2.5, range=0..10 step 0.1)
byCoordinates_8 = Point.ByCoordinates(x=getItemAtIndex_8, y=number_slider_14, z=number_slider_15)
create = List.Create(byCoordinates, byCoordinates_2, byCoordinates_3, byCoordinates_4, byCoordinates_5, byCoordinates_6, byCoordinates_7, byCoordinates_8)
code_block_10 = CodeBlock { 2; }
byControlPoints = NurbsCurve.ByControlPoints(create, code_block_10)
code_block_11 = CodeBlock { 0; }
getItemAtIndex_9 = List.GetItemAtIndex(list=number_sequence, index=code_block_11)
number_slider_16 = DoubleSlider(10, range=0..10 step 0.1)
number_slider_17 = DoubleSlider(5, range=0..10 step 0.1)
byCoordinates_9 = Point.ByCoordinates(x=getItemAtIndex_9, y=number_slider_16, z=number_slider_17)
code_block_12 = CodeBlock { 1; }
getItemAtIndex_10 = List.GetItemAtIndex(list=number_sequence, index=code_block_12)
number_slider_18 = DoubleSlider(10.8, range=0..20 step 0.1)
byCoordinates_10 = Point.ByCoordinates(x=getItemAtIndex_10, y=number_slider_18, z=number_slider_17)
code_block_13 = CodeBlock { 2; }
getItemAtIndex_11 = List.GetItemAtIndex(list=number_sequence, index=code_block_13)
number_slider_19 = DoubleSlider(11, range=0..20 step 0.1)
number_slider_20 = DoubleSlider(3, range=0..10 step 0.1)
byCoordinates_11 = Point.ByCoordinates(x=getItemAtIndex_11, y=number_slider_19, z=number_slider_20)
code_block_14 = CodeBlock { 3; }
getItemAtIndex_12 = List.GetItemAtIndex(list=number_sequence, index=code_block_14)
number_slider_21 = DoubleSlider(28.3, range=0..30 step 0.1)
number_slider_22 = DoubleSlider(0.5, range=0..10 step 0.1)
byCoordinates_12 = Point.ByCoordinates(x=getItemAtIndex_12, y=number_slider_21, z=number_slider_22)
code_block_15 = CodeBlock { 4; }
getItemAtIndex_13 = List.GetItemAtIndex(list=number_sequence, index=code_block_15)
number_slider_23 = DoubleSlider(28.6, range=0..40 step 0.1)
number_slider_24 = DoubleSlider(3, range=0..10 step 0.1)
byCoordinates_13 = Point.ByCoordinates(x=getItemAtIndex_13, y=number_slider_23, z=number_slider_24)
code_block_16 = CodeBlock { 5; }
getItemAtIndex_14 = List.GetItemAtIndex(list=number_sequence, index=code_block_16)
number_slider_25 = DoubleSlider(15.8, range=0..20 step 0.1)
number_slider_26 = DoubleSlider(5, range=0..10 step 0.1)
byCoordinates_14 = Point.ByCoordinates(x=getItemAtIndex_14, y=number_slider_25, z=number_slider_26)
code_block_17 = CodeBlock { 6; }
getItemAtIndex_15 = List.GetItemAtIndex(list=number_sequence, index=code_block_17)
number_slider_27 = DoubleSlider(7.6, range=0..20 step 0.1)
number_slider_28 = DoubleSlider(5, range=0..10 step 0.1)
byCoordinates_15 = Point.ByCoordinates(x=getItemAtIndex_15, y=number_slider_27, z=number_slider_28)
code_block_18 = CodeBlock { 7; }
getItemAtIndex_16 = List.GetItemAtIndex(list=number_sequence, index=code_block_18)
number_slider_29 = DoubleSlider(6.3, range=0..20 step 0.1)
number_slider_30 = DoubleSlider(5, range=0..10 step 0.1)
byCoordinates_16 = Point.ByCoordinates(x=getItemAtIndex_16, y=number_slider_29, z=number_slider_30)
create_2 = List.Create(byCoordinates_9, byCoordinates_10, byCoordinates_11, byCoordinates_12, byCoordinates_13, byCoordinates_14, byCoordinates_15, byCoordinates_16)
code_block_19 = CodeBlock { 2; }
byControlPoints_2 = NurbsCurve.ByControlPoints(create_2, code_block_19)
code_block_20 = CodeBlock { 0; }
getItemAtIndex_17 = List.GetItemAtIndex(list=number_sequence, index=code_block_20)
number_slider_31 = DoubleSlider(10, range=0..10 step 0.1)
number_slider_32 = DoubleSlider(5, range=0..10 step 0.1)
byCoordinates_17 = Point.ByCoordinates(x=getItemAtIndex_17, y=number_slider_31, z=number_slider_32)
code_block_21 = CodeBlock { 1; }
getItemAtIndex_18 = List.GetItemAtIndex(list=number_sequence, index=code_block_21)
number_slider_33 = DoubleSlider(10, range=0..20 step 0.1)
number_slider_34 = DoubleSlider(4.5, range=0..10 step 0.1)
byCoordinates_18 = Point.ByCoordinates(x=getItemAtIndex_18, y=number_slider_33, z=number_slider_34)
code_block_22 = CodeBlock { 2; }
getItemAtIndex_19 = List.GetItemAtIndex(list=number_sequence, index=code_block_22)
number_slider_35 = DoubleSlider(2.8, range=0..20 step 0.1)
number_slider_36 = DoubleSlider(4.1, range=0..10 step 0.1)
byCoordinates_19 = Point.ByCoordinates(x=getItemAtIndex_19, y=number_slider_35, z=number_slider_36)
code_block_23 = CodeBlock { 3; }
getItemAtIndex_20 = List.GetItemAtIndex(list=number_sequence, index=code_block_23)
number_slider_37 = DoubleSlider(1.6, range=0..20 step 0.1)
number_slider_38 = DoubleSlider(5, range=0..10 step 0.1)
byCoordinates_20 = Point.ByCoordinates(x=getItemAtIndex_20, y=number_slider_37, z=number_slider_38)
code_block_24 = CodeBlock { 4; }
getItemAtIndex_21 = List.GetItemAtIndex(list=number_sequence, index=code_block_24)
number_slider_39 = DoubleSlider(6.8, range=0..20 step 0.1)
number_slider_40 = DoubleSlider(5, range=0..10 step 0.1)
byCoordinates_21 = Point.ByCoordinates(x=getItemAtIndex_21, y=number_slider_39, z=number_slider_40)
code_block_25 = CodeBlock { 5; }
getItemAtIndex_22 = List.GetItemAtIndex(list=number_sequence, index=code_block_25)
number_slider_41 = DoubleSlider(8.7, range=0..20 step 0.1)
number_slider_42 = DoubleSlider(5, range=0..10 step 0.1)
byCoordinates_22 = Point.ByCoordinates(x=getItemAtIndex_22, y=number_slider_41, z=number_slider_42)
code_block_26 = CodeBlock { 6; }
getItemAtIndex_23 = List.GetItemAtIndex(list=number_sequence, index=code_block_26)
number_slider_43 = DoubleSlider(6.8, range=0..20 step 0.1)
number_slider_44 = DoubleSlider(5, range=0..10 step 0.1)
byCoordinates_23 = Point.ByCoordinates(x=getItemAtIndex_23, y=number_slider_43, z=number_slider_44)
code_block_27 = CodeBlock { 7; }
getItemAtIndex_24 = List.GetItemAtIndex(list=number_sequence, index=code_block_27)
number_slider_45 = DoubleSlider(5.3, range=0..20 step 0.1)
number_slider_46 = DoubleSlider(5, range=0..10 step 0.1)
byCoordinates_24 = Point.ByCoordinates(x=getItemAtIndex_24, y=number_slider_45, z=number_slider_46)
create_3 = List.Create(byCoordinates_17, byCoordinates_18, byCoordinates_19, byCoordinates_20, byCoordinates_21, byCoordinates_22, byCoordinates_23, byCoordinates_24)
code_block_28 = CodeBlock { 2; }
byControlPoints_3 = NurbsCurve.ByControlPoints(create_3, code_block_28)
YAxis = Vector.YAxis()
code_block_29 = CodeBlock { 14; 5; -1.1; }
number_range = NumberRange(code_block_29.out0, code_block_29.out1, code_block_29.out2, lacing=Longest)
code_block_30 = CodeBlock(x=number_range) { x/2; }
byStartPointDirectionLength = Line.ByStartPointDirectionLength(startPoint=create_3, direction=YAxis, length=code_block_30)
endPoint = Curve.EndPoint(byStartPointDirectionLength)
reverse = Vector.Reverse(YAxis)
byStartPointDirectionLength_2 = Line.ByStartPointDirectionLength(startPoint=create_3, direction=reverse, length=code_block_30)
endPoint_2 = Curve.EndPoint(byStartPointDirectionLength_2)
byStartPointEndPoint = Line.ByStartPointEndPoint(startPoint=endPoint, endPoint=endPoint_2)
byLoft = Surface.ByLoft(byStartPointEndPoint)
code_block_31 = CodeBlock { 1; }
code_block_32 = CodeBlock { 0..1..0.1; }
byIsoCurveOnSurface = Curve.ByIsoCurveOnSurface(baseSurface=byLoft, direction=code_block_31, parameter=code_block_32)
code_block_33 = CodeBlock { 2; -2; }
takeEveryNthItem = List.TakeEveryNthItem(byIsoCurveOnSurface, code_block_33.out0, code_block_33.out1)
code_block_34 = CodeBlock { 0; }
planeAtParameter = Curve.PlaneAtParameter(curve=takeEveryNthItem, param=code_block_34)
YAxis_2 = Vector.YAxis()
code_block_35 = CodeBlock(x=number_range) { x/2; }
byStartPointDirectionLength_3 = Line.ByStartPointDirectionLength(startPoint=create_2, direction=YAxis_2, length=code_block_35)
endPoint_3 = Curve.EndPoint(byStartPointDirectionLength_3)
reverse_2 = Vector.Reverse(YAxis_2)
byStartPointDirectionLength_4 = Line.ByStartPointDirectionLength(startPoint=create_2, direction=reverse_2, length=code_block_35)
endPoint_4 = Curve.EndPoint(byStartPointDirectionLength_4)
byStartPointEndPoint_2 = Line.ByStartPointEndPoint(startPoint=endPoint_3, endPoint=endPoint_4)
byLoft_2 = Surface.ByLoft(byStartPointEndPoint_2)
code_block_36 = CodeBlock { 1; }
code_block_37 = CodeBlock { 0..1..0.1; }
byIsoCurveOnSurface_2 = Curve.ByIsoCurveOnSurface(baseSurface=byLoft_2, direction=code_block_36, parameter=code_block_37)
code_block_38 = CodeBlock { 2; -2; }
takeEveryNthItem_2 = List.TakeEveryNthItem(byIsoCurveOnSurface_2, code_block_38.out0, code_block_38.out1)
code_block_39 = CodeBlock { 0; }
planeAtParameter_2 = Curve.PlaneAtParameter(curve=takeEveryNthItem_2, param=code_block_39)
YAxis_3 = Vector.YAxis()
code_block_40 = CodeBlock(x=number_range) { x/2; }
byStartPointDirectionLength_5 = Line.ByStartPointDirectionLength(startPoint=create, direction=YAxis_3, length=code_block_40)
endPoint_5 = Curve.EndPoint(byStartPointDirectionLength_5)
reverse_3 = Vector.Reverse(YAxis_3)
byStartPointDirectionLength_6 = Line.ByStartPointDirectionLength(startPoint=create, direction=reverse_3, length=code_block_40)
endPoint_6 = Curve.EndPoint(byStartPointDirectionLength_6)
byStartPointEndPoint_3 = Line.ByStartPointEndPoint(startPoint=endPoint_5, endPoint=endPoint_6)
byLoft_3 = Surface.ByLoft(byStartPointEndPoint_3)
code_block_41 = CodeBlock { 1; }
code_block_42 = CodeBlock { 0..1..0.1; }
byIsoCurveOnSurface_3 = Curve.ByIsoCurveOnSurface(baseSurface=byLoft_3, direction=code_block_41, parameter=code_block_42)
code_block_43 = CodeBlock { 2; -2; }
takeEveryNthItem_3 = List.TakeEveryNthItem(byIsoCurveOnSurface_3, code_block_43.out0, code_block_43.out1)
code_block_44 = CodeBlock { 0; }
planeAtParameter_3 = Curve.PlaneAtParameter(curve=takeEveryNthItem_3, param=code_block_44)
number_slider_47 = DoubleSlider(1, range=0..1 step 0.001)
number_slider_48 = DoubleSlider(0.585, range=0..1 step 0.001)
number_slider_49 = DoubleSlider(0.3, range=0..1 step 0.001)
number_slider_50 = DoubleSlider(0.7, range=0..1 step 0.001)
number_slider_51 = DoubleSlider(0.165, range=0..1 step 0.001)
number_slider_52 = DoubleSlider(0.585, range=0..1 step 0.001)
number_slider_53 = DoubleSlider(0, range=0..1 step 0.001)
number_slider_54 = DoubleSlider(0.585, range=0..1 step 0.001)
number_slider_55 = DoubleSlider(0, range=0..1 step 0.001)
number_slider_56 = DoubleSlider(0.585, range=0..1 step 0.001)
number_slider_57 = DoubleSlider(0.15, range=0..1 step 0.001)
number_slider_58 = DoubleSlider(0.5, range=0..1 step 0.001)
number_slider_59 = DoubleSlider(0, range=0..1 step 0.001)
number_slider_60 = DoubleSlider(0.585, range=0..1 step 0.001)
number_slider_61 = DoubleSlider(0, range=0..1 step 0.001)
number_slider_62 = DoubleSlider(0.585, range=0..1 step 0.001)
code_block_45 = CodeBlock { 0..1..0.2; }
byIsoCurveOnSurface_4 = Curve.ByIsoCurveOnSurface(baseSurface=byLoft, direction=code_block_31, parameter=code_block_45)
firstItem = List.FirstItem(byIsoCurveOnSurface_4)
code_block_46 = CodeBlock { 0.565; 0.70; }
parameterTrim = Curve.ParameterTrim(firstItem, code_block_46.out0, code_block_46.out1)
ZAxis = Vector.ZAxis()
code_block_47 = CodeBlock { 1.7; }
translate = Geometry.Translate(geometry=parameterTrim, direction=ZAxis, distance=code_block_47)
code_block_48 = CodeBlock { 0.32; 0.47; }
parameterTrim_2 = Curve.ParameterTrim(firstItem, code_block_48.out0, code_block_48.out1)
ZAxis_2 = Vector.ZAxis()
code_block_49 = CodeBlock { 1.7; }
translate_2 = Geometry.Translate(geometry=parameterTrim_2, direction=ZAxis_2, distance=code_block_49)
lastItem = List.LastItem(byIsoCurveOnSurface_4)
code_block_50 = CodeBlock { 0; 0.565; }
parameterTrim_3 = Curve.ParameterTrim(lastItem, code_block_50.out0, code_block_50.out1)
ZAxis_3 = Vector.ZAxis()
code_block_51 = CodeBlock { 1.7; }
translate_3 = Geometry.Translate(geometry=parameterTrim_3, direction=ZAxis_3, distance=code_block_51)
code_block_52 = CodeBlock { 0.73; 1; }
parameterTrim_4 = Curve.ParameterTrim(lastItem, code_block_52.out0, code_block_52.out1)
ZAxis_4 = Vector.ZAxis()
code_block_53 = CodeBlock { 1.7; }
translate_4 = Geometry.Translate(geometry=parameterTrim_4, direction=ZAxis_4, distance=code_block_53)
create_4 = List.Create(translate, translate_2, translate_3, translate_4)
code_block_54 = CodeBlock { 0; }
planeAtParameter_4 = Curve.PlaneAtParameter(curve=create_4, param=code_block_54)
code_block_55 = CodeBlock { 0.1; }
byPlaneRadius = Circle.ByPlaneRadius(plane=planeAtParameter_4, radius=code_block_55)
bySweep = Surface.BySweep(byPlaneRadius, create_4)
code_block_56 = CodeBlock { 0..1..0.03; }
planeAtParameter_5 = Curve.PlaneAtParameter(curve=parameterTrim, param=code_block_56)
origin = Plane.Origin(planeAtParameter_5)
planeAtParameter_6 = Curve.PlaneAtParameter(curve=translate, param=code_block_56)
origin_2 = Plane.Origin(planeAtParameter_6)
byStartPointEndPoint_4 = Line.ByStartPointEndPoint(startPoint=origin, endPoint=origin_2)
code_block_57 = CodeBlock { 0..1..0.03; }
planeAtParameter_7 = Curve.PlaneAtParameter(curve=parameterTrim_2, param=code_block_57)
origin_3 = Plane.Origin(planeAtParameter_7)
planeAtParameter_8 = Curve.PlaneAtParameter(curve=translate_2, param=code_block_57)
origin_4 = Plane.Origin(planeAtParameter_8)
byStartPointEndPoint_5 = Line.ByStartPointEndPoint(startPoint=origin_3, endPoint=origin_4)
code_block_58 = CodeBlock { 0..1..0.01; }
planeAtParameter_9 = Curve.PlaneAtParameter(curve=parameterTrim_3, param=code_block_58)
origin_5 = Plane.Origin(planeAtParameter_9)
planeAtParameter_10 = Curve.PlaneAtParameter(curve=translate_3, param=code_block_58)
origin_6 = Plane.Origin(planeAtParameter_10)
byStartPointEndPoint_6 = Line.ByStartPointEndPoint(startPoint=origin_5, endPoint=origin_6)
code_block_59 = CodeBlock { 0..1..0.03; }
planeAtParameter_11 = Curve.PlaneAtParameter(curve=parameterTrim_4, param=code_block_59)
origin_7 = Plane.Origin(planeAtParameter_11)
planeAtParameter_12 = Curve.PlaneAtParameter(curve=translate_4, param=code_block_59)
origin_8 = Plane.Origin(planeAtParameter_12)
byStartPointEndPoint_7 = Line.ByStartPointEndPoint(startPoint=origin_7, endPoint=origin_8)
create_5 = List.Create(byStartPointEndPoint_4, byStartPointEndPoint_5, byStartPointEndPoint_6, byStartPointEndPoint_7)
code_block_60 = CodeBlock { 0..1..0.2; }
byIsoCurveOnSurface_5 = Curve.ByIsoCurveOnSurface(baseSurface=byLoft_2, direction=code_block_36, parameter=code_block_60)
firstItem_2 = List.FirstItem(byIsoCurveOnSurface_5)
code_block_61 = CodeBlock { 0.165; 1; }
parameterTrim_5 = Curve.ParameterTrim(firstItem_2, code_block_61.out0, code_block_61.out1)
ZAxis_5 = Vector.ZAxis()
code_block_62 = CodeBlock { 1.7; }
translate_5 = Geometry.Translate(geometry=parameterTrim_5, direction=ZAxis_5, distance=code_block_62)
lastItem_2 = List.LastItem(byIsoCurveOnSurface_5)
code_block_63 = CodeBlock { 0.3; 0.7; }
parameterTrim_6 = Curve.ParameterTrim(lastItem_2, code_block_63.out0, code_block_63.out1)
ZAxis_6 = Vector.ZAxis()
code_block_64 = CodeBlock { 1.7; }
translate_6 = Geometry.Translate(geometry=parameterTrim_6, direction=ZAxis_6, distance=code_block_64)
create_6 = List.Create(translate_5, translate_6)
code_block_65 = CodeBlock { 0; }
planeAtParameter_13 = Curve.PlaneAtParameter(curve=create_6, param=code_block_65)
code_block_66 = CodeBlock { 0.1; }
byPlaneRadius_2 = Circle.ByPlaneRadius(plane=planeAtParameter_13, radius=code_block_66)
bySweep_2 = Surface.BySweep(byPlaneRadius_2, create_6)
code_block_67 = CodeBlock { 0..1..0.005; }
planeAtParameter_14 = Curve.PlaneAtParameter(curve=parameterTrim_5, param=code_block_67)
origin_9 = Plane.Origin(planeAtParameter_14)
planeAtParameter_15 = Curve.PlaneAtParameter(curve=translate_5, param=code_block_67)
origin_10 = Plane.Origin(planeAtParameter_15)
byStartPointEndPoint_8 = Line.ByStartPointEndPoint(startPoint=origin_9, endPoint=origin_10)
code_block_68 = CodeBlock { 0..1..0.01; }
planeAtParameter_16 = Curve.PlaneAtParameter(curve=parameterTrim_6, param=code_block_68)
origin_11 = Plane.Origin(planeAtParameter_16)
planeAtParameter_17 = Curve.PlaneAtParameter(curve=translate_6, param=code_block_68)
origin_12 = Plane.Origin(planeAtParameter_17)
byStartPointEndPoint_9 = Line.ByStartPointEndPoint(startPoint=origin_11, endPoint=origin_12)
create_7 = List.Create(byStartPointEndPoint_8, byStartPointEndPoint_9)
code_block_69 = CodeBlock { 0..1..0.2; }
byIsoCurveOnSurface_6 = Curve.ByIsoCurveOnSurface(baseSurface=byLoft_3, direction=code_block_41, parameter=code_block_69)
firstItem_3 = List.FirstItem(byIsoCurveOnSurface_6)
code_block_70 = CodeBlock { 0; 0.585; }
parameterTrim_7 = Curve.ParameterTrim(firstItem_3, code_block_70.out0, code_block_70.out1)
ZAxis_7 = Vector.ZAxis()
code_block_71 = CodeBlock { 1.7; }
translate_7 = Geometry.Translate(geometry=parameterTrim_7, direction=ZAxis_7, distance=code_block_71)
code_block_72 = CodeBlock { 0.83; 1; }
parameterTrim_8 = Curve.ParameterTrim(firstItem_3, code_block_72.out0, code_block_72.out1)
ZAxis_8 = Vector.ZAxis()
code_block_73 = CodeBlock { 1.7; }
translate_8 = Geometry.Translate(geometry=parameterTrim_8, direction=ZAxis_8, distance=code_block_73)
lastItem_3 = List.LastItem(byIsoCurveOnSurface_6)
code_block_74 = CodeBlock { 0.176; 0.5; }
parameterTrim_9 = Curve.ParameterTrim(lastItem_3, code_block_74.out0, code_block_74.out1)
ZAxis_9 = Vector.ZAxis()
code_block_75 = CodeBlock { 1.7; }
translate_9 = Geometry.Translate(geometry=parameterTrim_9, direction=ZAxis_9, distance=code_block_75)
code_block_76 = CodeBlock { 0.585; 1; }
parameterTrim_10 = Curve.ParameterTrim(lastItem_3, code_block_76.out0, code_block_76.out1)
ZAxis_10 = Vector.ZAxis()
code_block_77 = CodeBlock { 1.7; }
translate_10 = Geometry.Translate(geometry=parameterTrim_10, direction=ZAxis_10, distance=code_block_77)
create_8 = List.Create(translate_7, translate_8, translate_9, translate_10)
code_block_78 = CodeBlock { 0; }
planeAtParameter_18 = Curve.PlaneAtParameter(curve=create_8, param=code_block_78)
code_block_79 = CodeBlock { 0.1; }
byPlaneRadius_3 = Circle.ByPlaneRadius(plane=planeAtParameter_18, radius=code_block_79)
bySweep_3 = Surface.BySweep(byPlaneRadius_3, create_8)
code_block_80 = CodeBlock { 0..1..0.01; }
planeAtParameter_19 = Curve.PlaneAtParameter(curve=parameterTrim_7, param=code_block_80)
origin_13 = Plane.Origin(planeAtParameter_19)
planeAtParameter_20 = Curve.PlaneAtParameter(curve=translate_7, param=code_block_80)
origin_14 = Plane.Origin(planeAtParameter_20)
byStartPointEndPoint_10 = Line.ByStartPointEndPoint(startPoint=origin_13, endPoint=origin_14)
code_block_81 = CodeBlock { 0..1..0.04; }
planeAtParameter_21 = Curve.PlaneAtParameter(curve=parameterTrim_8, param=code_block_81)
origin_15 = Plane.Origin(planeAtParameter_21)
planeAtParameter_22 = Curve.PlaneAtParameter(curve=translate_8, param=code_block_81)
origin_16 = Plane.Origin(planeAtParameter_22)
byStartPointEndPoint_11 = Line.ByStartPointEndPoint(startPoint=origin_15, endPoint=origin_16)
code_block_82 = CodeBlock { 0..1..0.025; }
planeAtParameter_23 = Curve.PlaneAtParameter(curve=parameterTrim_9, param=code_block_82)
origin_17 = Plane.Origin(planeAtParameter_23)
planeAtParameter_24 = Curve.PlaneAtParameter(curve=translate_9, param=code_block_82)
origin_18 = Plane.Origin(planeAtParameter_24)
byStartPointEndPoint_12 = Line.ByStartPointEndPoint(startPoint=origin_17, endPoint=origin_18)
code_block_83 = CodeBlock { 0..1..0.01; }
planeAtParameter_25 = Curve.PlaneAtParameter(curve=parameterTrim_10, param=code_block_83)
origin_19 = Plane.Origin(planeAtParameter_25)
planeAtParameter_26 = Curve.PlaneAtParameter(curve=translate_10, param=code_block_83)
origin_20 = Plane.Origin(planeAtParameter_26)
byStartPointEndPoint_13 = Line.ByStartPointEndPoint(startPoint=origin_19, endPoint=origin_20)
create_9 = List.Create(byStartPointEndPoint_10, byStartPointEndPoint_11, byStartPointEndPoint_12, byStartPointEndPoint_13)
code_block_84 = CodeBlock { {true, false, true, false, true, false, true, false, true, false, true}; }
ZAxis_11 = Vector.ZAxis()
reverse_4 = Vector.Reverse(ZAxis_11)
code_block_85 = CodeBlock { 1; }
translate_11 = Geometry.Translate(geometry=takeEveryNthItem, direction=reverse_4, distance=code_block_85)
python_script = Python(IN[0]=code_block_84, IN[1]=byIsoCurveOnSurface_4, IN[2]=translate_11)
# ---------- python_script.python (22 lines) ----------
import clr
clr.AddReference('ProtoGeometry')
from Autodesk.DesignScript.Geometry import *
#The inputs to this node will be stored as a list in the IN variable.
dataEnteringNode = IN


booleans = IN[0]
nurbsone = IN[1]
nurbstwo = IN[2]

elementlist = []
for boolean in booleans:
    if boolean:
        elementlist.append(nurbsone[0])
        nurbsone.pop(0)
    else:
        elementlist.append(nurbstwo[0])
        nurbstwo.pop(0)

#Assign your output to the OUT variable
OUT = elementlist
# ----------------------------------------
byLoft_4 = Surface.ByLoft(python_script)
create_10 = List.Create(byLoft_4, byLoft)
code_block_86 = CodeBlock { {true, false, true, false, true, false, true, false, true, false, true}; }
ZAxis_12 = Vector.ZAxis()
reverse_5 = Vector.Reverse(ZAxis_12)
code_block_87 = CodeBlock { 1; }
translate_12 = Geometry.Translate(geometry=takeEveryNthItem_2, direction=reverse_5, distance=code_block_87)
python_script_2 = Python(IN[0]=code_block_86, IN[1]=byIsoCurveOnSurface_5, IN[2]=translate_12)  # same code as python_script
byLoft_5 = Surface.ByLoft(python_script_2)
create_11 = List.Create(byLoft_5, byLoft_2)
code_block_88 = CodeBlock { {true, false, true, false, true, false, true, false, true, false, true}; }
ZAxis_13 = Vector.ZAxis()
reverse_6 = Vector.Reverse(ZAxis_13)
code_block_89 = CodeBlock { 1; }
translate_13 = Geometry.Translate(geometry=takeEveryNthItem_3, direction=reverse_6, distance=code_block_89)
python_script_3 = Python(IN[0]=code_block_88, IN[1]=byIsoCurveOnSurface_6, IN[2]=translate_13)  # same code as python_script
byLoft_6 = Surface.ByLoft(python_script_3)
create_12 = List.Create(byLoft_6, byLoft_3)
byCurve = ModelCurve.ByCurve()
byCurve_2 = ModelCurve.ByCurve()
byCurve_3 = ModelCurve.ByCurve()
byGeometries = ImportInstance.ByGeometries()
byGeometries_2 = ImportInstance.ByGeometries()
byGeometries_3 = ImportInstance.ByGeometries()
byGeometries_4 = ImportInstance.ByGeometries()
byGeometries_5 = ImportInstance.ByGeometries()
byGeometries_6 = ImportInstance.ByGeometries()
