# Dynamo graph Parametric Twisting Tower.dyn "D_8- Parametric Twisting Tower" (Dynamo 2.3.0.5885)
# packages: Lunchbox Quad Grid By Face Dalian 1.1.1

# group: First Type of Tower
tower_elevation = DoubleSlider(50, range=50..150 step 0.1)  # frozen
no_of_floors = DoubleSlider(10.7, range=10..25 step 0.1)  # frozen
code_block = CodeBlock(TowerElevation=tower_elevation, NumberofFloors=no_of_floors) { 0..TowerElevation..#NumberofFloors; }

# group: Tower Elevation and Floor
no_of_floors_2 = DoubleSlider(25, range=10..100 step 0.1)
floor_elevation = DoubleSlider(3, range=3..7 step 0.1)
shape_radius = DoubleSlider(10, range=10..50 step 0.1)
x_scale = DoubleSlider(4, range=0.5..5 step 0.1)
y_scale = DoubleSlider(3, range=0.5..5 step 0.1)
tower_rotation = DoubleSlider(138.2, range=10..360 step 0.1)
floor_types = FloorTypes("Generic 300mm")
shell_distance = DoubleSlider(1.7, range=0.5..2 step 0.1)
no_of_points_for_nurbs = IntegerSlider(20, range=10..100 step 1)
family_types = FamilyTypes("Adaptive Panel:Adaptive Panel")

# group: Initial Shape
code_block_2 = CodeBlock(Nooffloor=no_of_floors_2, floorelevation=floor_elevation) { Nooffloor*floorelevation; }
code_block_3 = CodeBlock(TowerElevation=code_block_2, FloorElevation=floor_elevation) { 0..TowerElevation..FloorElevation; }
byCenterPointRadius = Circle.ByCenterPointRadius(radius=shape_radius)
scale = Geometry.Scale(geometry=byCenterPointRadius, xamount=x_scale, yamount=y_scale)
ZAxis = Vector.ZAxis()
translate = Geometry.Translate(geometry=scale, direction=ZAxis, distance=code_block_3)
byCoordinates = Point.ByCoordinates(z=code_block_3)
code_block_4 = CodeBlock(MaxRotation=tower_rotation, numberoffloor=no_of_floors_2) { 0..MaxRotation..#numberoffloor+1; }
rotate = Geometry.Rotate(geometry=translate, origin=byCoordinates, axis=ZAxis, degrees=code_block_4)
offset = Curve.Offset(curve=rotate, distance=shell_distance)

# group: Create Levels and Plans
restOfItems = List.RestOfItems(list=code_block_3)
byElevation = Level.ByElevation(elevation=restOfItems)
byLevel = FloorPlanView.ByLevel(level=byElevation)
byLevel_2 = CeilingPlanView.ByLevel(level=byElevation)

no_of_points_for_floors = IntegerSlider(100, range=10..100 step 1)

# group: Rebuild the Floor Curve
code_block_5 = CodeBlock(Numberofpoints=no_of_points_for_floors) { 0..1..#Numberofpoints; }
pointAtParameter = Curve.PointAtParameter(curve=rotate, param=code_block_5, lacing=CrossProduct)
byPoints = PolyCurve.ByPoints(points=pointAtParameter)

byOutlineTypeAndLevel = Floor.ByOutlineTypeAndLevel(outline=byPoints, floorType=floor_types, level=byElevation)

# group: Rebuild the Shell Curve
code_block_6 = CodeBlock(Numberofpoints=no_of_points_for_nurbs) { 0..1..#Numberofpoints; }
pointAtParameter_2 = Curve.PointAtParameter(curve=offset, param=code_block_6, lacing=CrossProduct)
byControlPoints = NurbsCurve.ByControlPoints(points=pointAtParameter_2)
byLoft = Surface.ByLoft(crossSections=byControlPoints)

lunchbox_quad_grid_by_face = Custom[LunchBox Quad Grid by Face](byLoft, U=no_of_points_for_nurbs, V=no_of_floors_2)  # package Lunchbox Quad Grid By Face Dalian; Create a quadrangular XYZ grid on a face. The face surface must have an untrimmed UV parameter space.
byPoints_2 = AdaptiveComponent.ByPoints(points=lunchbox_quad_grid_by_face.Panel_Pts, familyType=family_types)
