# Dynamo graph Pier into the infinate - one.dyn (Dynamo 0.8.1.1052)

code_block = CodeBlock { 0; -50; }
byCoordinates = Point.ByCoordinates(x=code_block.out0, y=code_block.out1, z=code_block.out0)
XAxis = Vector.XAxis()
starting_width_of_pier = DoubleSlider(15.3, range=10..20 step 0.1)
byStartPointDirectionLength = Line.ByStartPointDirectionLength(startPoint=byCoordinates, direction=XAxis, length=starting_width_of_pier)
YAxis = Vector.YAxis()
total_length_of_pier = DoubleSlider(124.2, range=100..150 step 0.1)
translate = Geometry.Translate(geometry=byStartPointDirectionLength, direction=YAxis, distance=total_length_of_pier)
code_block_2 = CodeBlock { 0.5; }
planeAtParameter = Curve.PlaneAtParameter(curve=translate, param=code_block_2)
origin = Plane.Origin(planeAtParameter)
XAxis_2 = Vector.XAxis()
narrowness_of_end = DoubleSlider(0.33, range=0.1..0.45 step 0.01)
code_block_3 = CodeBlock(x=starting_width_of_pier, y=narrowness_of_end) { x*y; }
byStartPointDirectionLength_2 = Line.ByStartPointDirectionLength(startPoint=origin, direction=XAxis_2, length=code_block_3)
endPoint = Curve.EndPoint(byStartPointDirectionLength_2)
reverse = Vector.Reverse(XAxis_2)
code_block_4 = CodeBlock(x=code_block_3) { x*2; }
byStartPointDirectionLength_3 = Line.ByStartPointDirectionLength(startPoint=endPoint, direction=reverse, length=code_block_4)
