# Dynamo graph RR Station Entrance - two.dyn (Dynamo 0.7.6.4190)

XY = Plane.XY()
code_block = CodeBlock { 20; }
byPlaneRadius = Circle.ByPlaneRadius(XY, code_block)
code_block_2 = CodeBlock { 0..1..0.1; }
planeAtParameter = Curve.PlaneAtParameter(byPlaneRadius, code_block_2)
origin = Plane.Origin(planeAtParameter)
code_block_3 = CodeBlock { 100; }
code_block_4 = CodeBlock(x=code_block_3, y=code_block) { x-y; }
code_block_5 = CodeBlock(x=code_block_4) { x/2; }
code_block_6 = CodeBlock(x=code_block_5, y=code_block) { x+y; }
code_block_7 = CodeBlock(x=code_block_6) { x/2; }
code_block_8 = CodeBlock(x=code_block_7) { x*0.6; }
offset = Plane.Offset(XY, code_block_8)
byPlaneRadius_2 = Circle.ByPlaneRadius(offset, code_block_6)
code_block_9 = CodeBlock { 0..1..0.1; }
planeAtParameter_2 = Curve.PlaneAtParameter(byPlaneRadius_2, code_block_9)
origin_2 = Plane.Origin(planeAtParameter_2)
byPlaneRadius_3 = Circle.ByPlaneRadius(XY, code_block_3)
code_block_10 = CodeBlock { 0..1..0.1; }
planeAtParameter_3 = Curve.PlaneAtParameter(byPlaneRadius_3, code_block_10)
origin_3 = Plane.Origin(planeAtParameter_3)
byThreePoints = Arc.ByThreePoints(origin, origin_2, origin_3)
flatten = Flatten(byThreePoints)
byLoft = Surface.ByLoft(flatten, byPlaneRadius)
origin_4 = Plane.Origin(XY)
X = Point.X(origin_4)
code_block_11 = CodeBlock(x=X, y=code_block_6) { x+y; }
code_block_12 = CodeBlock(x=code_block_11) { x*1.2; }
Y = Point.Y(origin_4)
Z = Point.Z(origin_4)
byCoordinates = Point.ByCoordinates(code_block_12, Y, Z)
byStartPointEndPoint = Line.ByStartPointEndPoint(origin_4, byCoordinates)
ZAxis = Vector.ZAxis()
code_block_13 = CodeBlock { 0..360..60; }
rotate = Geometry.Rotate(byStartPointEndPoint, origin_4, ZAxis, code_block_13)
startPoint = Curve.StartPoint(rotate)
endPoint = Curve.EndPoint(rotate)
byTwoPoints = Vector.ByTwoPoints(startPoint, endPoint)
code_block_14 = CodeBlock { 40; 80; 40; 80; 50; 90; }
create = List.Create(code_block_14.out0, code_block_14.out1, code_block_14.out2, code_block_14.out3, code_block_14.out4, code_block_14.out5)
byStartPointDirectionLength = Line.ByStartPointDirectionLength(origin_4, byTwoPoints, create)
endPoint_2 = Curve.EndPoint(byStartPointDirectionLength)
code_block_15 = CodeBlock { 3; }
boolean = BoolSelector(true)
byControlPoints = NurbsCurve.ByControlPoints(endPoint_2, code_block_15, boolean)
ZAxis_2 = Vector.ZAxis()
code_block_16 = CodeBlock { 50; }
extrude = Curve.Extrude(byControlPoints, ZAxis_2, code_block_16)
split = Geometry.Split(byLoft, extrude)
flatten_2 = Flatten(split)
code_block_17 = CodeBlock { 1; }
getItemAtIndex = List.GetItemAtIndex(flatten_2, code_block_17)
code_block_18 = CodeBlock { 2; }
offset_2 = Surface.Offset(getItemAtIndex, code_block_18)
origin_5 = Plane.Origin(XY)
byPlane = CoordinateSystem.ByPlane(XY)
code_block_19 = CodeBlock { 0..360..5; }
code_block_20 = CodeBlock { 0; 10; }
byCylindricalCoordinates = Point.ByCylindricalCoordinates(byPlane, code_block_19, code_block_20.out0, code_block_20.out1)
code_block_21 = CodeBlock { 5; }
byCylindricalCoordinates_2 = Point.ByCylindricalCoordinates(byPlane, code_block_19, code_block_21, code_block_20.out1)
byThreePoints_2 = Plane.ByThreePoints(origin_5, byCylindricalCoordinates, byCylindricalCoordinates_2)
intersect = Geometry.Intersect(offset_2, byThreePoints_2)
code_block_22 = CodeBlock { 2; 2; }
takeEveryNthItem = List.TakeEveryNthItem(intersect, code_block_22.out0, code_block_22.out1)
flatten_3 = Flatten(takeEveryNthItem)
code_block_23 = CodeBlock { 0..1..0.1; }
planeAtParameter_4 = Curve.PlaneAtParameter(flatten_3, code_block_23, lacing=CrossProduct)
code_block_24 = CodeBlock { 0.35; }
byPlaneRadius_4 = Circle.ByPlaneRadius(planeAtParameter_4, code_block_24)
byLoft_2 = Surface.ByLoft(byPlaneRadius_4)
byGeometry = ImportInstance.ByGeometry()
byGeometry_2 = ImportInstance.ByGeometry()
byGeometry_3 = ImportInstance.ByGeometry()
origin_6 = Plane.Origin(XY)
byPlane_2 = CoordinateSystem.ByPlane(XY)
code_block_25 = CodeBlock { 0..360..10; }
code_block_26 = CodeBlock { 0; 10; }
byCylindricalCoordinates_3 = Point.ByCylindricalCoordinates(byPlane_2, code_block_25, code_block_26.out0, code_block_26.out1)
code_block_27 = CodeBlock { 5; }
byCylindricalCoordinates_4 = Point.ByCylindricalCoordinates(byPlane_2, code_block_25, code_block_27, code_block_26.out1)
byThreePoints_3 = Plane.ByThreePoints(origin_6, byCylindricalCoordinates_3, byCylindricalCoordinates_4)
intersect_2 = Geometry.Intersect(getItemAtIndex, byThreePoints_3)
code_block_28 = CodeBlock { 0.05; }
planeAtParameter_5 = Curve.PlaneAtParameter(intersect_2, code_block_28, lacing=CrossProduct)
origin_7 = Plane.Origin(planeAtParameter_5)
code_block_29 = CodeBlock { -1; }
shiftIndices = List.ShiftIndices(intersect_2, code_block_29)
code_block_30 = CodeBlock { 0.3; }
planeAtParameter_6 = Curve.PlaneAtParameter(shiftIndices, code_block_30, lacing=CrossProduct)
origin_8 = Plane.Origin(planeAtParameter_6)
byStartPointEndPoint_2 = Line.ByStartPointEndPoint(origin_7, origin_8)
flatten_4 = Flatten(byStartPointEndPoint_2)
code_block_31 = CodeBlock { 0..1..0.25; }
planeAtParameter_7 = Curve.PlaneAtParameter(flatten_4, code_block_31, lacing=CrossProduct)
code_block_32 = CodeBlock { 0.3; }
byWidthHeight = Rectangle.ByWidthHeight(planeAtParameter_7, code_block_32, code_block_32)
byLoft_3 = Surface.ByLoft(byWidthHeight)
code_block_33 = CodeBlock { 0.3; }
planeAtParameter_8 = Curve.PlaneAtParameter(intersect_2, code_block_33, lacing=CrossProduct)
origin_9 = Plane.Origin(planeAtParameter_8)
code_block_34 = CodeBlock { -1; }
shiftIndices_2 = List.ShiftIndices(intersect_2, code_block_34)
code_block_35 = CodeBlock { 0.6; }
planeAtParameter_9 = Curve.PlaneAtParameter(shiftIndices_2, code_block_35, lacing=CrossProduct)
origin_10 = Plane.Origin(planeAtParameter_9)
byStartPointEndPoint_3 = Line.ByStartPointEndPoint(origin_9, origin_10)
flatten_5 = Flatten(byStartPointEndPoint_3)
code_block_36 = CodeBlock { 0..1..0.25; }
planeAtParameter_10 = Curve.PlaneAtParameter(flatten_5, code_block_36, lacing=CrossProduct)
code_block_37 = CodeBlock { 0.3; }
byWidthHeight_2 = Rectangle.ByWidthHeight(planeAtParameter_10, code_block_37, code_block_37)
byLoft_4 = Surface.ByLoft(byWidthHeight_2)
code_block_38 = CodeBlock { 0.6; }
planeAtParameter_11 = Curve.PlaneAtParameter(intersect_2, code_block_38, lacing=CrossProduct)
origin_11 = Plane.Origin(planeAtParameter_11)
code_block_39 = CodeBlock { -1; }
shiftIndices_3 = List.ShiftIndices(intersect_2, code_block_39)
code_block_40 = CodeBlock { 0.9; }
planeAtParameter_12 = Curve.PlaneAtParameter(shiftIndices_3, code_block_40, lacing=CrossProduct)
origin_12 = Plane.Origin(planeAtParameter_12)
byStartPointEndPoint_4 = Line.ByStartPointEndPoint(origin_11, origin_12)
flatten_6 = Flatten(byStartPointEndPoint_4)
code_block_41 = CodeBlock { 0..1..0.25; }
planeAtParameter_13 = Curve.PlaneAtParameter(flatten_6, code_block_41, lacing=CrossProduct)
code_block_42 = CodeBlock { 0.3; }
byWidthHeight_3 = Rectangle.ByWidthHeight(planeAtParameter_13, code_block_42, code_block_42)
byLoft_5 = Surface.ByLoft(byWidthHeight_3)
code_block_43 = CodeBlock { 0.05; }
planeAtParameter_14 = Curve.PlaneAtParameter(intersect_2, code_block_43, lacing=CrossProduct)
origin_13 = Plane.Origin(planeAtParameter_14)
code_block_44 = CodeBlock { 1; }
shiftIndices_4 = List.ShiftIndices(intersect_2, code_block_44)
code_block_45 = CodeBlock { 0.3; }
planeAtParameter_15 = Curve.PlaneAtParameter(shiftIndices_4, code_block_45, lacing=CrossProduct)
origin_14 = Plane.Origin(planeAtParameter_15)
byStartPointEndPoint_5 = Line.ByStartPointEndPoint(origin_13, origin_14)
flatten_7 = Flatten(byStartPointEndPoint_5)
code_block_46 = CodeBlock { 0..1..0.25; }
planeAtParameter_16 = Curve.PlaneAtParameter(flatten_7, code_block_46, lacing=CrossProduct)
code_block_47 = CodeBlock { 0.3; }
byWidthHeight_4 = Rectangle.ByWidthHeight(planeAtParameter_16, code_block_47, code_block_47)
byLoft_6 = Surface.ByLoft(byWidthHeight_4)
code_block_48 = CodeBlock { 0.3; }
planeAtParameter_17 = Curve.PlaneAtParameter(intersect_2, code_block_48, lacing=CrossProduct)
origin_15 = Plane.Origin(planeAtParameter_17)
code_block_49 = CodeBlock { 1; }
shiftIndices_5 = List.ShiftIndices(intersect_2, code_block_49)
code_block_50 = CodeBlock { 0.6; }
planeAtParameter_18 = Curve.PlaneAtParameter(shiftIndices_5, code_block_50, lacing=CrossProduct)
origin_16 = Plane.Origin(planeAtParameter_18)
byStartPointEndPoint_6 = Line.ByStartPointEndPoint(origin_15, origin_16)
flatten_8 = Flatten(byStartPointEndPoint_6)
code_block_51 = CodeBlock { 0..1..0.25; }
planeAtParameter_19 = Curve.PlaneAtParameter(flatten_8, code_block_51, lacing=CrossProduct)
code_block_52 = CodeBlock { 0.3; }
byWidthHeight_5 = Rectangle.ByWidthHeight(planeAtParameter_19, code_block_52, code_block_52)
byLoft_7 = Surface.ByLoft(byWidthHeight_5)
code_block_53 = CodeBlock { 0.6; }
planeAtParameter_20 = Curve.PlaneAtParameter(intersect_2, code_block_53, lacing=CrossProduct)
origin_17 = Plane.Origin(planeAtParameter_20)
code_block_54 = CodeBlock { 1; }
shiftIndices_6 = List.ShiftIndices(intersect_2, code_block_54)
code_block_55 = CodeBlock { 0.9; }
planeAtParameter_21 = Curve.PlaneAtParameter(shiftIndices_6, code_block_55, lacing=CrossProduct)
origin_18 = Plane.Origin(planeAtParameter_21)
byStartPointEndPoint_7 = Line.ByStartPointEndPoint(origin_17, origin_18)
flatten_9 = Flatten(byStartPointEndPoint_7)
code_block_56 = CodeBlock { 0..1..0.25; }
planeAtParameter_22 = Curve.PlaneAtParameter(flatten_9, code_block_56, lacing=CrossProduct)
code_block_57 = CodeBlock { 0.3; }
byWidthHeight_6 = Rectangle.ByWidthHeight(planeAtParameter_22, code_block_57, code_block_57)
byLoft_8 = Surface.ByLoft(byWidthHeight_6)
create_2 = List.Create(byLoft_3, byLoft_4, byLoft_5, byLoft_6, byLoft_7, byLoft_8)
code_block_58 = CodeBlock { 0..0.9..0.05; }
planeAtParameter_23 = Curve.PlaneAtParameter(takeEveryNthItem, code_block_58, lacing=CrossProduct)
origin_19 = Plane.Origin(planeAtParameter_23)
planeAtParameter_24 = Curve.PlaneAtParameter(intersect_2, code_block_58, lacing=CrossProduct)
origin_20 = Plane.Origin(planeAtParameter_24)
byStartPointEndPoint_8 = Line.ByStartPointEndPoint(origin_19, origin_20)
normal = Plane.Normal(planeAtParameter_23)
code_block_59 = CodeBlock { 0.5; }
extrude_2 = Curve.Extrude(byStartPointEndPoint_8, normal, code_block_59)
code_block_60 = CodeBlock { -1; }
shiftIndices_7 = List.ShiftIndices(intersect_2, code_block_60)
planeAtParameter_25 = Curve.PlaneAtParameter(shiftIndices_7, code_block_58, lacing=CrossProduct)
origin_21 = Plane.Origin(planeAtParameter_25)
byStartPointEndPoint_9 = Line.ByStartPointEndPoint(origin_19, origin_21)
normal_2 = Plane.Normal(planeAtParameter_25)
code_block_61 = CodeBlock { 0.5; }
extrude_3 = Curve.Extrude(byStartPointEndPoint_9, normal_2, code_block_61)
create_3 = List.Create(extrude_2, extrude_3)
