# Dynamo graph Rectangle Section Church - three.dyn (Dynamo 0.7.6.4190)

code_block = CodeBlock { 180; }
code_block_2 = CodeBlock { 0..1..0.05; }
count = Count(code_block_2)
code_block_3 = CodeBlock(Y=code_block, x=count) { Y/x; }
ceiling = Math.Ceiling(code_block_3)
number_slider = DoubleSlider(100, range=1..100 step 0.1)
number_slider_2 = DoubleSlider(1, range=1..3 step 0.1)
code_block_4 = CodeBlock(t=code_block, p=ceiling, z=number_slider, q=number_slider_2) { (Math.Sin(0..t..p)*z)+q; }
maximumItem = List.MaximumItem(code_block_4)
code_block_5 = CodeBlock(x=maximumItem) { x/2; }
XY = Plane.XY()
rect_width = DoubleSlider(40, range=40..80 step 0.1)
rect_length = DoubleSlider(80, range=80..120 step 0.1)
byWidthHeight = Rectangle.ByWidthHeight(XY, rect_width, rect_length)
points = Polygon.Points(byWidthHeight)
code_block_6 = CodeBlock { 0; }
getItemAtIndex = List.GetItemAtIndex(points, code_block_6)
code_block_7 = CodeBlock(x=code_block_6) { x+1; }
code_block_8 = CodeBlock(x=code_block_7) { x+1; }
code_block_9 = CodeBlock(x=code_block_8) { x+1; }
getItemAtIndex_2 = List.GetItemAtIndex(points, code_block_9)
byTwoPoints = Vector.ByTwoPoints(getItemAtIndex, getItemAtIndex_2)
offset_from_corner = DoubleSlider(-0.25, range=-10..0.9 step 0.01)
code_block_10 = CodeBlock(x=rect_width, y=offset_from_corner) { x*y; }
lunchbox_vector_amplitude = Custom[LunchBox Vector Amplitude](Vector=byTwoPoints, Amplitude=code_block_10)  # Set the amplitude of a vector.
translate = Geometry.Translate(getItemAtIndex, lunchbox_vector_amplitude)
getItemAtIndex_3 = List.GetItemAtIndex(points, code_block_8)
getItemAtIndex_4 = List.GetItemAtIndex(points, code_block_7)
byTwoPoints_2 = Vector.ByTwoPoints(getItemAtIndex_3, getItemAtIndex_4)
lunchbox_vector_amplitude_2 = Custom[LunchBox Vector Amplitude](Vector=byTwoPoints_2, Amplitude=code_block_10)
translate_2 = Geometry.Translate(getItemAtIndex_3, lunchbox_vector_amplitude_2)
byStartPointEndPoint = Line.ByStartPointEndPoint(translate, translate_2)
planeAtParameter = Curve.PlaneAtParameter(byStartPointEndPoint, code_block_2)
origin = Plane.Origin(planeAtParameter)
YAxis = Plane.YAxis(planeAtParameter)
code_block_11 = CodeBlock(y=ceiling) { Math.Cos(0..180..y)/10; }
code_block_12 = CodeBlock(x=code_block_4, y=code_block_11) { x*y; }
translate_3 = Geometry.Translate(origin, YAxis, code_block_12)
byControlPoints = NurbsCurve.ByControlPoints(translate_3)
code_block_13 = CodeBlock { 0..1..0.037; }
flatten = Flatten(code_block_13)
planeAtParameter_2 = Curve.PlaneAtParameter(byControlPoints, flatten)
origin_2 = Plane.Origin(planeAtParameter_2)
code_block_14 = CodeBlock { 0.0175; 0.985; }
create = List.Create(code_block_14.out0, code_block_13, code_block_14.out1)
byPatch = Surface.ByPatch(byWidthHeight)
intersect = Geometry.Intersect(planeAtParameter_2, byPatch)
flatten_2 = Flatten(intersect)
ZAxis = Vector.ZAxis()
extrude = Curve.Extrude(flatten_2, ZAxis)
flatten_3 = Flatten(extrude)
byJoinedSurfaces = PolySurface.ByJoinedSurfaces(flatten_3)
split = Geometry.Split(byPatch, byJoinedSurfaces)
flatten_4 = Flatten(split)
code_block_15 = CodeBlock { 2; }
code_block_16 = CodeBlock { -1; }
takeEveryNthItem = List.TakeEveryNthItem(flatten_4, code_block_15, code_block_16)
flatten_5 = Flatten(takeEveryNthItem)
count_2 = Count(flatten_5)
code_block_17 = CodeBlock(x=count_2) { x-1; }
removeItemAtIndex = List.RemoveItemAtIndex(flatten_5, code_block_17)
code_block_18 = CodeBlock { 0; }
getItemAtIndex_5 = List.GetItemAtIndex(extrude, code_block_18)
split_2 = Geometry.Split(byPatch, getItemAtIndex_5)
code_block_19 = CodeBlock { 1; }
getItemAtIndex_6 = List.GetItemAtIndex(split_2, code_block_19)
create_2 = List.Create(removeItemAtIndex, getItemAtIndex_6)
code_block_20 = CodeBlock { 19; }
thicken = Surface.Thicken(create_2, code_block_20)
code_block_21 = CodeBlock(x=rect_width) { x*0.9; }
code_block_22 = CodeBlock(x=rect_length) { x*0.95; }
byWidthHeight_2 = Rectangle.ByWidthHeight(XY, code_block_21, code_block_22)
byPatch_2 = Surface.ByPatch(byWidthHeight_2)
code_block_23 = CodeBlock { 15; }
thicken_2 = Surface.Thicken(byPatch_2, code_block_23)
differenceAll = Solid.DifferenceAll(thicken, thicken_2)
explode = Geometry.Explode(thicken_2)
byGeometry = ImportInstance.ByGeometry()
byGeometry_2 = ImportInstance.ByGeometry()
views = Views("3D View 1")
code_block_24 = CodeBlock { 80; }
overrideTransparencyInView = Custom[Element.OverrideTransparencyInView](Element_s=byGeometry_2, View=views, Transparency=code_block_24)  # Overrides the transparency of an element in a given view
