# Dynamo graph Roof 1.dyn (Dynamo 1.3.4.6666)

byPoints = PolyCurve.ByPoints()  # unwired: points
select_model_elements = DSModelElementsSelection()
select_model_elements_2 = DSModelElementsSelection()
select_model_elements_3 = DSModelElementsSelection()
select_model_elements_4 = DSModelElementsSelection()
select_model_elements_5 = DSModelElementsSelection()
create = List.Create(select_model_elements, select_model_elements_2, select_model_elements_3, select_model_elements_4, select_model_elements_5)
geometry = Element.Geometry(create)
vertices = Face.Vertices(geometry)
pointGeometry = Vertex.PointGeometry(vertices)
byBestFitThroughPoints = Line.ByBestFitThroughPoints(pointGeometry)
endPoint = Curve.EndPoint(byBestFitThroughPoints)
code_block = CodeBlock { 1; }
flatten = List.Flatten(list=endPoint@L3, amt=code_block)
code_block_2 = CodeBlock { 1.5; }
byControlPoints = NurbsCurve.ByControlPoints(flatten, code_block_2)
byLoft = PolySurface.ByLoft(byControlPoints)
code_block_3 = CodeBlock { 1; }
thicken = Surface.Thicken(surface=byLoft, thickness=code_block_3)
file_path = Filename("No file selected.")
code_block_4 = CodeBlock { "Roof2"; }
categories = Categories("GenericModel")
byGeometry = Custom[Springs.FamilyInstance.ByGeometry](geometry=thicken, familyTemplatePath=file_path, familyName=code_block_4, category=categories)  # You must provide a valid family template path that will be used for all input geometry objects. The project units(and not the templates) will be used to determine the size of the output geometry. The provided category will be used only if the family template supports it. If not, the default template category will be used instead. Likewise, the family material(provided as a string) will be set only if a material with that name exists in the template. If not, the default material will be used instead ("By Category"). For void cuts, the material settings will be ignored. The Subcategory name is an optional input. If you'd like to skip assigning a Subcategory to any new instance, simply use null. The node expects a unique family name for each geometry object. The rest of the input lists will be processed as if the node lacing is set to longest.
