# Dynamo graph Solid from a loft of several curves in Dynamo.dyn (Dynamo 1.3.4.6666)

# group: Create Curve
number_slider = DoubleSlider(2, range=0..100 step 0.1)
number_slider_2 = DoubleSlider(38, range=0..100 step 0.1)
number_slider_3 = DoubleSlider(150, range=0..192 step 0.1)
code_block = CodeBlock(rotation=number_slider, a=number_slider_2, p=number_slider_3) { x= 0..360*rotation..5; y=a*Math.Cos(x+p); z=a*Math.Sin(x+p); }
byCoordinates = Point.ByCoordinates(x=code_block.x, y=code_block.y, z=code_block.z)
byControlPoints = NurbsCurve.ByControlPoints(byCoordinates)

# group: Create plane on curve
number_slider_4 = DoubleSlider(50, range=0..100 step 0.1)
code_block_2 = CodeBlock(subdivision=number_slider_4) { 0..1..#subdivision; }
planeAtParameter = Curve.PlaneAtParameter(curve=byControlPoints, param=code_block_2)

# group: Create circle on plane s on curve
code_block_3 = CodeBlock { 10; }
byPlaneRadius = Circle.ByPlaneRadius(plane=planeAtParameter, radius=code_block_3)

# group: Scaling geometry
code_block_4 = CodeBlock(times=number_slider_4) { 0.1..5..#times; }
scale = Geometry.Scale(byPlaneRadius, planeAtParameter, code_block_4, code_block_4, code_block_4)

# group: Create solid
byLoft = Solid.ByLoft(scale)
