# Dynamo graph Tag_auto_align.dyn (Dynamo 2.3.0.5885)
# packages: Rhythm 2021.1.1

select_model_elements = DSModelElementsSelection()  # 4 picked in the model
select_model_elements_2 = DSModelElementsSelection()  # 1 picked in the model
ʳʰʸᵗʰᵐ_tags_getheadposition = Rhythm.Revit.Elements.Tags.GetHeadPosition(tag=select_model_elements_2)
X = Point.X(point=ʳʰʸᵗʰᵐ_tags_getheadposition)
Y = Point.Y(point=ʳʰʸᵗʰᵐ_tags_getheadposition)
code_block = CodeBlock { 1000..10000..1000; }
code_block_2 = CodeBlock(y=Y, yheight=code_block) { y+yheight; }
Z = Point.Z(point=ʳʰʸᵗʰᵐ_tags_getheadposition)
code_block_3 = CodeBlock(x=X, y=code_block_2, z=Z) { Point.ByCoordinates(x,y,z); }
ʳʰʸᵗʰᵐ_tags_setheadposition = Rhythm.Revit.Elements.Tags.SetHeadPosition(tag=select_model_elements, location=code_block_3)
ʳʰʸᵗʰᵐ_tags_getleaderelbow = Rhythm.Revit.Elements.Tags.GetLeaderElbow(tag=select_model_elements_2)
X_2 = Point.X(point=ʳʰʸᵗʰᵐ_tags_getleaderelbow)
Y_2 = Point.Y(point=ʳʰʸᵗʰᵐ_tags_getleaderelbow)
code_block_4 = CodeBlock { 1000..10000..1000; }
code_block_5 = CodeBlock(y=Y_2, yheight=code_block_4) { y+yheight; }
Z_2 = Point.Z(point=ʳʰʸᵗʰᵐ_tags_getleaderelbow)
byCoordinates = Point.ByCoordinates(x=X_2, y=code_block_5, z=Z_2)
ʳʰʸᵗʰᵐ_tags = Rhythm.Revit.Elements.Tags.SetLeaderElbowPosition(tag=select_model_elements, location=byCoordinates)
ʳʰʸᵗʰᵐ_tags_getheadposition_2 = Rhythm.Revit.Elements.Tags.GetHeadPosition(tag=select_model_elements)
ʳʰʸᵗʰᵐ_tags_getleaderelbow_2 = Rhythm.Revit.Elements.Tags.GetLeaderElbow(tag=select_model_elements)
python_script = Python()  # unwired: IN[0]
# ---------- python_script.python (1 lines) ----------
for i in IN[0]
# ----------------------------------------
