# Dynamo graph UI Dynamo Player.dyn "D_7-UI Dynamo Player" (Dynamo 2.3.0.5885)
# packages: Data-Shapes 2021.2.92

# group: Extract Offset
# note: For Lower Revit Versions
code_block = CodeBlock { "Middle Elevation"; "Height"; }
list_create = List.Create(item0=code_block.out0, item1=code_block.out1)
getParameterValueByName = Element.GetParameterValueByName(parameterName=list_create, lacing=CrossProduct)  # unwired: element
code_block_2 = CodeBlock { 0; }
getItemAtIndex = List.GetItemAtIndex(list=getParameterValueByName, index=code_block_2, lacing=CrossProduct)
code_block_3 = CodeBlock { 1; }
getItemAtIndex_2 = List.GetItemAtIndex(list=getParameterValueByName, index=code_block_3, lacing=CrossProduct)

# group: Calculate Bottom of Duct
code_block_4 = CodeBlock(x=getItemAtIndex_2) { (x/2); }
code_block_5 = CodeBlock(Elevation=getItemAtIndex, halfsection=code_block_4) { Elevation-halfsection; }

code_block_6 = CodeBlock { "Tool to check duct elevation"; "Ok"; "Cancel"; }
file_path = Filename("C:\Users\Pragatheesh\Pictures\InShot_20200413_133553881.jpg")
file_from_path = FileObject(path=file_path)
readFromFile = Image.ReadFromFile(file=file_from_path)
code_block_7 = CodeBlock { "Category"; }
categories_list = Custom[Categories list]()  # package Data-Shapes; Gives list of all Revit categories and a matching list of their names
dropdown_data = Custom[DropDown Data](InputName=code_block_7, Keys=categories_list.Category_name_s, Values=categories_list.Category_name_s)  # package Data-Shapes; Create data for DropDown input in UI.MultiInputForm ++ . Check out www.data-shapes.net for more infos.
code_block_8 = CodeBlock { "Elevation Check"; "2500"; }
textbox_data = Custom[TextBox Data](InputName=code_block_8.out0, DefaultText=code_block_8.out1)  # package Data-Shapes; Create Data for TextBox input in UI.MultipleInputForm ++ . Check out www.data-shapes.net for more informations
list_create_2 = List.Create(item0=dropdown_data, item1=textbox_data)
boolean = BoolSelector(true)
multipleinputform = Custom[MultipleInputForm ++](Description_optional=code_block_6.out0, Logo_optional=readFromFile, ButtonText_optional=code_block_6.out1, Inputs=list_create_2, Toggle=boolean, CancelButtonText_optional=code_block_6.out2)  # package Data-Shapes; Create a form with multiple inputs. see www.data-shapes.net for tutorials and infos!
code_block_9 = CodeBlock(lst=multipleinputform.User_Inputs) { lst[0]; lst[1]; }
byName = Category.ByName(name=code_block_9.out0)

# group: Categories
categories = Categories("OST_DuctCurves")
code_block_10 = CodeBlock()
# ---------- code_block_10.designscript (2 lines) ----------
//Elevation to check
4000;
# ----------------------------------------
all_elements_of_category = ElementsOfCategory(Category=byName)

# group: for revit above 2019
code_block_11 = CodeBlock { "Bottom Elevation"; }
getParameterValueByName_2 = Element.GetParameterValueByName(element=all_elements_of_category, parameterName=code_block_11, lacing=CrossProduct)

round = Math.Round(number=getParameterValueByName_2)
toNumber = String.ToNumber(str=code_block_9.out1)
code_block_12 = CodeBlock(x=round, y=toNumber) { x<y; }
filterByBoolMask = List.FilterByBoolMask(list=all_elements_of_category, mask=code_block_12)
code_block_13 = CodeBlock { "Comments"; "Notverified"; }
setParameterByName = Element.SetParameterByName(element=filterByBoolMask.in, parameterName=code_block_13.out0, value=code_block_13.out1)
