# Dynamo graph Using vectors to translate geometry.dyn (Dynamo 1.3.4.6666)

# group: LIST OF TWO POLYGON, ONE A RECTANGLE AND OTHER A TRIANGLE
number = DoubleInput(0)
byCoordinates = Point.ByCoordinates(x=number, y=number)
number_2 = DoubleInput(10)
byCoordinates_2 = Point.ByCoordinates(x=number, y=number_2)
byCoordinates_3 = Point.ByCoordinates(x=number_2, y=number_2)
byCoordinates_4 = Point.ByCoordinates(x=number_2, y=number)
create = List.Create(byCoordinates, byCoordinates_2, byCoordinates_3, byCoordinates_4)
byPoints = Polygon.ByPoints(create)
number_3 = DoubleInput(20)
number_4 = DoubleInput(0)
byCoordinates_5 = Point.ByCoordinates(x=number_3, y=number_4)
number_5 = DoubleInput(25)
number_6 = DoubleInput(10)
byCoordinates_6 = Point.ByCoordinates(x=number_5, y=number_6)
number_7 = DoubleInput(30)
byCoordinates_7 = Point.ByCoordinates(x=number_7)
create_2 = List.Create(byCoordinates_5, byCoordinates_6, byCoordinates_7)
byPoints_2 = Polygon.ByPoints(create_2)
create_3 = List.Create(byPoints, byPoints_2)
