# Dynamo graph VASE - two.dyn (Dynamo 0.7.6.4190)

code_block = CodeBlock { 0; }
code_block_2 = CodeBlock { 0; }
byCoordinates = Point.ByCoordinates(code_block_2, code_block_2, code_block_2)
ZAxis = Vector.ZAxis()
byOriginNormal = Plane.ByOriginNormal(byCoordinates, ZAxis)
byPlane = CoordinateSystem.ByPlane(byOriginNormal)
code_block_3 = CodeBlock { Math.Cos(0..1800..18); }
code_block_4 = CodeBlock { (360/40)*0.9; }
code_block_5 = CodeBlock(x=code_block_4) { -x; }
remapRange = Math.RemapRange(code_block_3, code_block_4, code_block_5)
code_block_6 = CodeBlock { 0; }
number_slider = DoubleSlider(7.39, range=0..10 step 0.01)
number_slider_2 = DoubleSlider(50, range=0..50 step 0.01)
code_block_7 = CodeBlock(y=number_slider, x=number_slider_2) { (Math.Cos(0..1800..18)*y)+x; }
count = Count(code_block_7)
number_slider_3 = DoubleSlider(2.46, range=0..10 step 0.01)
number_sequence = NumberSeq(code_block_6, count, number_slider_3, lacing=Longest)
byCylindricalCoordinates = Point.ByCylindricalCoordinates(byPlane, remapRange, number_sequence, number_slider_2)
byControlPoints = NurbsCurve.ByControlPoints(byCylindricalCoordinates)
endPoint = Curve.EndPoint(byControlPoints)
byControlPoints_2 = NurbsCurve.ByControlPoints(byCylindricalCoordinates)
endPoint_2 = Curve.EndPoint(byControlPoints_2)
code_block_8 = CodeBlock { 360/40; }
code_block_9 = CodeBlock(x=code_block_8) { (-x)*2; }
code_block_10 = CodeBlock(y=number_slider, x=number_slider_2) { (-(Math.Cos(0..1800..18)*y))+x; }
byCylindricalCoordinates_2 = Point.ByCylindricalCoordinates(byPlane, code_block_9, number_sequence, code_block_10)
byControlPoints_3 = NurbsCurve.ByControlPoints(byCylindricalCoordinates_2)
startPoint = Curve.StartPoint(byControlPoints_3)
startPoint_2 = Curve.StartPoint(byControlPoints_2)
byStartPointEndPoint = Line.ByStartPointEndPoint(startPoint, startPoint_2)
bySweep2Rails = Surface.BySweep2Rails(byControlPoints_3, byControlPoints_2, byStartPointEndPoint)
endPoint_3 = Curve.EndPoint(byControlPoints_3)
code_block_11 = CodeBlock { 10; }
getItemAtIndex = List.GetItemAtIndex(byCylindricalCoordinates_2, code_block_11)
byThreePoints = Plane.ByThreePoints(endPoint_3, getItemAtIndex, startPoint)
mirror = Geometry.Mirror(bySweep2Rails, byThreePoints)
ZAxis_2 = Vector.ZAxis()
code_block_12 = CodeBlock { 360/4.999; }
code_block_13 = CodeBlock { 5; }
number_sequence_2 = NumberSeq(code_block_12, code_block_13, code_block_12, lacing=Longest)
rotate = Geometry.Rotate(mirror, byCoordinates, ZAxis_2, number_sequence_2)
create = List.Create(mirror, bySweep2Rails)
number_slider_4 = DoubleSlider(72.02, range=0..100 step 0.01)
code_block_14 = CodeBlock(x=number_slider_4) { 360/x; }
rotate_2 = Geometry.Rotate(bySweep2Rails, byCoordinates, ZAxis_2, number_sequence_2)
code_block_15 = CodeBlock(x=code_block_8) { x*2; }
byCylindricalCoordinates_3 = Point.ByCylindricalCoordinates(byPlane, code_block_15, number_sequence, code_block_7)
byControlPoints_4 = NurbsCurve.ByControlPoints(byCylindricalCoordinates_3)
startPoint_3 = Curve.StartPoint(byControlPoints_4)
startPoint_4 = Curve.StartPoint(byControlPoints)
byStartPointEndPoint_2 = Line.ByStartPointEndPoint(startPoint_3, startPoint_4)
bySweep2Rails_2 = Surface.BySweep2Rails(byControlPoints_4, byControlPoints, byStartPointEndPoint_2)
rotate_3 = Geometry.Rotate(bySweep2Rails_2, byCoordinates, ZAxis_2, number_sequence_2)
code_block_16 = CodeBlock { 10; }
getItemAtIndex_2 = List.GetItemAtIndex(byCylindricalCoordinates_3, code_block_16)
endPoint_4 = Curve.EndPoint(byControlPoints_4)
byThreePoints_2 = Plane.ByThreePoints(startPoint_3, getItemAtIndex_2, endPoint_4)
mirror_2 = Geometry.Mirror(bySweep2Rails_2, byThreePoints_2)
rotate_4 = Geometry.Rotate(mirror_2, byCoordinates, ZAxis_2, number_sequence_2)
byGeometry = ImportInstance.ByGeometry()
create_2 = List.Create(mirror_2, bySweep2Rails_2)
byGeometries = ImportInstance.ByGeometries()
byGeometry_2 = ImportInstance.ByGeometry()
byGeometry_3 = ImportInstance.ByGeometry()
byGeometry_4 = ImportInstance.ByGeometry()
byGeometries_2 = ImportInstance.ByGeometries()
