# Dynamo graph Zaha Stadium - FINAL.dyn (Dynamo 1.3.4.6666)

code_block = CodeBlock { true; }
code_block_2 = CodeBlock { false; }
create = List.Create(code_block, code_block_2)
flatten = Flatten(create)
code_block_3 = CodeBlock { 0; }
y = DoubleSlider(30, range=10..30 step 0.01)
z = DoubleSlider(16.8, range=10..20 step 0.01)
byCoordinates = Point.ByCoordinates(x=code_block_3, y=y, z=z)
mid_point_of_arch_height_z = DoubleSlider(1.5, range=1.1..1.5 step 0.01)
code_block_4 = CodeBlock(x=z, y=mid_point_of_arch_height_z) { x*y; }
byCoordinates_2 = Point.ByCoordinates(x=code_block_3, y=code_block_3, z=code_block_4)
code_block_5 = CodeBlock(x=y) { -x; }
byCoordinates_3 = Point.ByCoordinates(x=code_block_3, y=code_block_5, z=z)
byThreePoints = Arc.ByThreePoints(firstPoint=byCoordinates, secondPoint=byCoordinates_2, thirdPoint=byCoordinates_3)
overall_length = DoubleSlider(97.6, range=60..100 step 0.1)
code_block_6 = CodeBlock(x=overall_length) { x/2; }
midle_width = DoubleSlider(1.54, range=1.1..2.1 step 0.01)
code_block_7 = CodeBlock(x=y, y=midle_width) { x*y; }
byCoordinates_4 = Point.ByCoordinates(x=code_block_6, y=code_block_7, z=z)
mid_point_mid_arch_of_arch = DoubleSlider(2.1, range=1.1..2.1 step 0.01)  # "mid point mid arch of arch height z"
code_block_8 = CodeBlock(x=z, y=mid_point_mid_arch_of_arch) { x*y; }
byCoordinates_5 = Point.ByCoordinates(x=code_block_6, y=code_block_3, z=code_block_8)
code_block_9 = CodeBlock(x=code_block_7) { -x; }
byCoordinates_6 = Point.ByCoordinates(x=code_block_6, y=code_block_9, z=z)
byThreePoints_2 = Arc.ByThreePoints(firstPoint=byCoordinates_4, secondPoint=byCoordinates_5, thirdPoint=byCoordinates_6)
byCoordinates_7 = Point.ByCoordinates(x=overall_length, y=y, z=z)
code_block_10 = CodeBlock(x=z, y=mid_point_of_arch_height_z) { x*y; }
byCoordinates_8 = Point.ByCoordinates(x=overall_length, y=code_block_3, z=code_block_10)
code_block_11 = CodeBlock(x=y) { -x; }
byCoordinates_9 = Point.ByCoordinates(x=overall_length, y=code_block_11, z=z)
byThreePoints_3 = Arc.ByThreePoints(firstPoint=byCoordinates_7, secondPoint=byCoordinates_8, thirdPoint=byCoordinates_9)
create_2 = List.Create(byThreePoints, byThreePoints_2, byThreePoints_3)
byLoft = Surface.ByLoft(create_2)
code_block_12 = CodeBlock { 0..1..0.05; 1; }
getIsoline = Surface.GetIsoline(byLoft, code_block_12.out1, code_block_12.out0)
code_block_13 = CodeBlock { 2; }
code_block_14 = CodeBlock { 2; }
takeEveryNthItem = List.TakeEveryNthItem(getIsoline, code_block_13, code_block_14)
code_block_15 = CodeBlock { 0.05..0.95..0.1; }
planeAtParameter = Curve.PlaneAtParameter(curve=takeEveryNthItem, param=code_block_15, lacing=CrossProduct)
origin = Plane.Origin(planeAtParameter)
byControlPoints = NurbsCurve.ByControlPoints(origin)
flatten_2 = Flatten(byControlPoints)
ZAxis = Vector.ZAxis()
hieght_of_ridges = DoubleSlider(3.25, range=2..4 step 0.01)
translate = Geometry.Translate(geometry=flatten_2, direction=ZAxis, distance=hieght_of_ridges)
flatten_3 = Flatten(translate)
count = Count(flatten_3)
cycle = List.Cycle(list=flatten, amount=count)
flatten_4 = Flatten(cycle)
addItemToEnd = List.AddItemToEnd(item=code_block, list=flatten_4)
code_block_16 = CodeBlock { 2; }
code_block_17 = CodeBlock { 1; }
takeEveryNthItem_2 = List.TakeEveryNthItem(getIsoline, code_block_16, code_block_17)
code_block_18 = CodeBlock { 0..1..0.1; }
planeAtParameter_2 = Curve.PlaneAtParameter(curve=takeEveryNthItem_2, param=code_block_18, lacing=CrossProduct)
origin_2 = Plane.Origin(planeAtParameter_2)
byControlPoints_2 = NurbsCurve.ByControlPoints(origin_2)
flatten_5 = Flatten(byControlPoints_2)
python_script = Python(IN[0]=addItemToEnd, IN[1]=flatten_5, IN[2]=flatten_3)
# ---------- python_script.python (21 lines) ----------
import clr
clr.AddReference('ProtoGeometry')
from Autodesk.DesignScript.Geometry import *
#The inputs to this node will be stored as a list in the IN variable.
dataEnteringNode = IN

booleans = IN[0]
lines = IN[1]
arcs = IN[2]

elementlist = []
for boolean in booleans:
    if boolean:
        elementlist.append(lines[0])
        lines.pop(0)
    else:
        elementlist.append(arcs[0])
        arcs.pop(0)

#Assign your output to the OUT variable
OUT = elementlist
# ----------------------------------------
endPoint = Curve.EndPoint(python_script)
code_block_19 = CodeBlock { 2; }
byControlPoints_3 = NurbsCurve.ByControlPoints(endPoint, code_block_19)
code_block_20 = CodeBlock { 0.5; }
planeAtParameter_3 = Curve.PlaneAtParameter(curve=python_script, param=code_block_20)
origin_3 = Plane.Origin(planeAtParameter_3)
code_block_21 = CodeBlock { 1; }
byControlPoints_4 = NurbsCurve.ByControlPoints(origin_3, code_block_21)
startPoint = Curve.StartPoint(python_script)
code_block_22 = CodeBlock { 2; }
byControlPoints_5 = NurbsCurve.ByControlPoints(startPoint, code_block_22)
create_3 = List.Create(byControlPoints_3, byControlPoints_4, byControlPoints_5)
byLoft_2 = Surface.ByLoft(create_3)
byLoft_3 = Surface.ByLoft(python_script)
code_block_23 = CodeBlock { 0; }
byCoordinates_10 = Point.ByCoordinates(x=code_block_6, y=code_block_3, z=code_block_23)
ZAxis_2 = Vector.ZAxis()
byOriginNormal = Plane.ByOriginNormal(origin=byCoordinates_10, normal=ZAxis_2)
ellipse_length = DoubleSlider(0.39, range=0.1..0.9 step 0.01)
code_block_24 = CodeBlock(x=overall_length, y=ellipse_length) { x*y; }
elipse_width = DoubleSlider(0.24, range=0.05..0.8 step 0.01)
code_block_25 = CodeBlock(x=overall_length, y=elipse_width) { x*y; }
byPlaneRadii = Ellipse.ByPlaneRadii(byOriginNormal, code_block_24, code_block_25)
ZAxis_3 = Vector.ZAxis()
code_block_26 = CodeBlock { 30; }
extrude = Curve.Extrude(curve=byPlaneRadii, direction=ZAxis_3, distance=code_block_26)
split = Geometry.Split(geometry=byLoft_3, other=extrude)
firstItem = List.FirstItem(split)
code_block_27 = CodeBlock { 2.5; }
offset = Surface.Offset(byLoft, code_block_27)
code_block_28 = CodeBlock(x=code_block_24) { x*1.05; }
code_block_29 = CodeBlock(x=code_block_25) { x*1.05; }
byPlaneRadii_2 = Ellipse.ByPlaneRadii(byOriginNormal, code_block_28, code_block_29)
ZAxis_4 = Vector.ZAxis()
code_block_30 = CodeBlock { 30; }
extrude_2 = Curve.Extrude(curve=byPlaneRadii_2, direction=ZAxis_4, distance=code_block_30)
split_2 = Geometry.Split(geometry=offset, other=extrude_2)
firstItem_2 = List.FirstItem(split_2)
code_block_31 = CodeBlock { 0; }
getIsoline_2 = Surface.GetIsoline(byLoft, code_block_12.out1, code_block_31)
code_block_32 = CodeBlock { 4; }
offset_2 = Curve.Offset(curve=getIsoline_2, distance=code_block_32)
code_block_33 = CodeBlock { 1; }
getIsoline_3 = Surface.GetIsoline(byLoft, code_block_12.out1, code_block_33)
offset_3 = Curve.Offset(curve=getIsoline_3, distance=code_block_32)
create_4 = List.Create(offset_2, offset_3)
byLoft_4 = Surface.ByLoft(create_4)
code_block_34 = CodeBlock { 20; }
lunchbox_diamond_grid_by_face = Custom[LunchBox Diamond Grid by Face](Surface=byLoft_4, U=code_block_34, V=code_block_34)  # Create a Diamond XYZ grid on a face. The face surface must have an untrimmed UV parameter space.
explode = Geometry.Explode(lunchbox_diamond_grid_by_face.A_Panel_Polys)
flatten_6 = Flatten(explode)
ZAxis_5 = Vector.ZAxis()
projectInputOnto = Surface.ProjectInputOnto(firstItem_2, flatten_6, ZAxis_5)
flatten_7 = Flatten(projectInputOnto)
code_block_35 = CodeBlock { 0..1..0.5; }
planeAtParameter_4 = Curve.PlaneAtParameter(curve=flatten_7, param=code_block_35, lacing=CrossProduct)
transpose = List.Transpose(planeAtParameter_4)
code_block_36 = CodeBlock { 0; }
getItemAtIndex = List.GetItemAtIndex(list=transpose, index=code_block_36)
code_block_37 = CodeBlock { 0.15; }
byPlaneRadius = Circle.ByPlaneRadius(plane=getItemAtIndex, radius=code_block_37)
code_block_38 = CodeBlock { 1; }
getItemAtIndex_2 = List.GetItemAtIndex(list=transpose, index=code_block_38)
code_block_39 = CodeBlock { 0.4; }
byPlaneRadius_2 = Circle.ByPlaneRadius(plane=getItemAtIndex_2, radius=code_block_39)
code_block_40 = CodeBlock { 2; }
getItemAtIndex_3 = List.GetItemAtIndex(list=transpose, index=code_block_40)
code_block_41 = CodeBlock { 0.15; }
byPlaneRadius_3 = Circle.ByPlaneRadius(plane=getItemAtIndex_3, radius=code_block_41)
create_5 = List.Create(byPlaneRadius, byPlaneRadius_2, byPlaneRadius_3)
transpose_2 = List.Transpose(create_5)
byLoft_5 = Surface.ByLoft()  # unwired: arg0
code_block_42 = CodeBlock(x=overall_length) { x*0.9; }
code_block_43 = CodeBlock { 0; }
byCoordinates_11 = Point.ByCoordinates(x=code_block_42, y=code_block_3, z=code_block_43)
ZAxis_6 = Vector.ZAxis()
byOriginNormal_2 = Plane.ByOriginNormal(origin=byCoordinates_11, normal=ZAxis_6)
code_block_44 = CodeBlock { -60; 30; -60; 40; }
byPlaneRadiiAngles = EllipseArc.ByPlaneRadiiAngles(byOriginNormal_2, code_block_44.out1, code_block_44.out3, code_block_44.out0, code_block_44.out2)
code_block_45 = CodeBlock { 5; }
extendEnd = Curve.ExtendEnd(curve=byPlaneRadiiAngles, distance=code_block_45)
extendStart = Curve.ExtendStart(curve=extendEnd, distance=code_block_45)
ZAxis_7 = Vector.ZAxis()
code_block_46 = CodeBlock { 15; }
translate_2 = Geometry.Translate(geometry=extendStart, direction=ZAxis_7, distance=code_block_46)
create_6 = List.Create(extendStart, translate_2)
byLoft_6 = Surface.ByLoft(create_6)
code_block_47 = CodeBlock { 12; }
byCoordinates_12 = Point.ByCoordinates(x=code_block_42, y=code_block_3, z=code_block_47)
byOriginNormal_3 = Plane.ByOriginNormal(origin=byCoordinates_12, normal=ZAxis_7)
code_block_48 = CodeBlock { -60; 2; -60; 20; }
byPlaneRadiiAngles_2 = EllipseArc.ByPlaneRadiiAngles(byOriginNormal_3, code_block_48.out1, code_block_48.out3, code_block_48.out0, code_block_48.out2)
code_block_49 = CodeBlock { 5; }
extendEnd_2 = Curve.ExtendEnd(curve=byPlaneRadiiAngles_2, distance=code_block_49)
extendStart_2 = Curve.ExtendStart(curve=extendEnd_2, distance=code_block_49)
create_7 = List.Create(extendStart_2, translate_2)
byLoft_7 = Surface.ByLoft(create_7)
join = Surface.Join(byLoft_6, byLoft_7)
edges = Face.Edges(join)
code_block_50 = CodeBlock { 2; }
getItemAtIndex_4 = List.GetItemAtIndex(list=edges, index=code_block_50)
code_block_51 = CodeBlock { 5; }
fillet = PolySurface.Fillet(join, getItemAtIndex_4, code_block_51)
code_block_52 = CodeBlock { 0; }
byCoordinates_13 = Point.ByCoordinates(x=code_block_6, y=code_block_3, z=code_block_52)
XAxis = Vector.XAxis()
byOriginNormal_4 = Plane.ByOriginNormal(origin=byCoordinates_13, normal=XAxis)
mirror = Geometry.Mirror(geometry=fillet, mirrorPlane=byOriginNormal_4)
code_block_53 = CodeBlock { 0..1..0.1; }
planeAtParameter_5 = Curve.PlaneAtParameter(curve=extendStart, param=code_block_53)
intersect = Geometry.Intersect(geometry=fillet, other=planeAtParameter_5)
byJoinedCurves = PolyCurve.ByJoinedCurves(intersect)
code_block_54 = CodeBlock { -1.5; }
offset_4 = Curve.Offset(curve=byJoinedCurves, distance=code_block_54)
create_8 = List.Create(byJoinedCurves, offset_4)
transpose_3 = List.Transpose(create_8)
byLoft_8 = Surface.ByLoft(transpose_3)
mirror_2 = Geometry.Mirror(geometry=byLoft_8, mirrorPlane=byOriginNormal_4)
code_block_55 = CodeBlock { 0; }
getIsoline_4 = Surface.GetIsoline(byLoft, code_block_12.out1, code_block_55)
ZAxis_8 = Vector.ZAxis()
byOriginNormal_5 = Plane.ByOriginNormal(origin=byCoordinates_13, normal=ZAxis_8)
code_block_56 = CodeBlock { 0.95; }
scale = Geometry.Scale(getIsoline_4, byOriginNormal_5, code_block_56, code_block_56, code_block_56)
reverse = Vector.Reverse(ZAxis_8)
code_block_57 = CodeBlock(x=z) { x/2; }
translate_3 = Geometry.Translate(geometry=scale, direction=reverse, distance=code_block_57)
reverse_2 = Vector.Reverse(ZAxis_8)
translate_4 = Geometry.Translate(geometry=getIsoline_4, direction=reverse_2, distance=z)
create_9 = List.Create(getIsoline_4, translate_3, translate_4)
byLoft_9 = Surface.ByLoft(create_9)
code_block_58 = CodeBlock { 1; }
getIsoline_5 = Surface.GetIsoline(byLoft, code_block_12.out1, code_block_58)
code_block_59 = CodeBlock { 0.95; }
scale_2 = Geometry.Scale(getIsoline_5, byOriginNormal_5, code_block_59, code_block_59, code_block_59)
reverse_3 = Vector.Reverse(ZAxis_8)
code_block_60 = CodeBlock(x=z) { x/2; }
translate_5 = Geometry.Translate(geometry=scale_2, direction=reverse_3, distance=code_block_60)
reverse_4 = Vector.Reverse(ZAxis_8)
translate_6 = Geometry.Translate(geometry=getIsoline_5, direction=reverse_4, distance=z)
create_10 = List.Create(getIsoline_5, translate_5, translate_6)
byLoft_10 = Surface.ByLoft(create_10)
create_11 = List.Create()  # unwired: arg0, arg1
code_block_61 = CodeBlock { 30..40..1; 40..50..1; }
byOriginRadii = Ellipse.ByOriginRadii(byCoordinates_13, code_block_61.out1, code_block_61.out0)
ZAxis_9 = Vector.ZAxis()
code_block_62 = CodeBlock { 2..12..0.8; }
translate_7 = Geometry.Translate(geometry=byOriginRadii, direction=ZAxis_9, distance=code_block_62)
code_block_63 = CodeBlock { 1; }
offset_5 = Curve.Offset(curve=translate_7, distance=code_block_63)
combine = List.Combine(create_11, translate_7, offset_5)
byLoft_11 = Surface.ByLoft(combine)
ZAxis_10 = Vector.ZAxis()
code_block_64 = CodeBlock { 0.8; }
extrude_3 = Curve.Extrude(curve=offset_5, direction=ZAxis_10, distance=code_block_64)
create_12 = List.Create(byLoft_11, extrude_3)
