# Dynamo graph attractor surface.dyn (Dynamo 1.3.3.4111)

number = DoubleInput(-50)
number_2 = DoubleInput(11)
number_3 = DoubleInput(10)
sequence = Sequence(start=number, amount=number_2, step=number_3, lacing=Longest)
byCoordinates = Point.ByCoordinates(x=sequence, y=sequence, lacing=CrossProduct)
ZAxis = Vector.ZAxis()
number_slider = DoubleSlider(50, range=-50..50 step 0.1)
number_slider_2 = DoubleSlider(50, range=-50..50 step 0.1)
byCoordinates_2 = Point.ByCoordinates(x=number_slider, y=number_slider_2, lacing=CrossProduct)
distanceTo = Geometry.DistanceTo(geometry=byCoordinates_2, other=byCoordinates)
translate = Geometry.Translate(geometry=byCoordinates, direction=ZAxis, distance=distanceTo)
byControlPoints = NurbsSurface.ByControlPoints(controlVertices=translate)
number_4 = DoubleInput(5)
thicken = Surface.Thicken(surface=byControlPoints, thickness=number_4)
