# Dynamo graph birds nest facade - three.dyn (Dynamo 0.8.1.1052)

code_block = CodeBlock { 0; }
byCoordinates = Point.ByCoordinates(x=code_block, y=code_block, z=code_block)
YAxis = Vector.YAxis()
code_block_2 = CodeBlock { 100; }
byStartPointDirectionLength = Line.ByStartPointDirectionLength(startPoint=byCoordinates, direction=YAxis, length=code_block_2)
ZAxis = Vector.ZAxis()
number_slider = DoubleSlider(2.5, range=0.5..3 step 0.1)
code_block_3 = CodeBlock(x=code_block_2, y=number_slider) { x*y; }
extrude = Curve.Extrude(curve=byStartPointDirectionLength, direction=ZAxis, distance=code_block_3)
lime = Custom[Color.Lime]()  # Returns the colour lime.
byGeometryColor = Display.ByGeometryColor(extrude, lime)
red = Custom[Color.Red]()  # Returns the colour red.
create = List.Create(red, lime)
code_block_4 = CodeBlock { 0..2..#1; }
color_range = ColorRange(create, code_block_4, code_block_4)
YAxis_2 = Vector.YAxis()
byGeometries = ImportInstance.ByGeometries()
perimeterCurves = Surface.PerimeterCurves(extrude)
code_block_5 = CodeBlock { 0; }
getItemAtIndex = List.GetItemAtIndex(list=perimeterCurves, index=code_block_5)
code_block_6 = CodeBlock { 0.05; 0.95; 14; 0.01; }
lunchbox_random_numbers = Custom[LunchBox Random Numbers](Min=code_block_6.out0, Max=code_block_6.out1, Amount=code_block_6.out2, Seed=code_block_6.out3)  # Generates a list of Random numbers using a domain, amount, and seed.
sort = List.Sort(lunchbox_random_numbers)
planeAtParameter = Curve.PlaneAtParameter(curve=getItemAtIndex, param=sort)
origin = Plane.Origin(planeAtParameter)
shuffle = List.Shuffle(origin)
code_block_7 = CodeBlock { 2; }
getItemAtIndex_2 = List.GetItemAtIndex(list=perimeterCurves, index=code_block_7)
code_block_8 = CodeBlock { 0.05; 0.95; 13; 0.09; }
lunchbox_random_numbers_2 = Custom[LunchBox Random Numbers](Min=code_block_8.out0, Max=code_block_8.out1, Amount=code_block_8.out2, Seed=code_block_8.out3)
sort_2 = List.Sort(lunchbox_random_numbers_2)
planeAtParameter_2 = Curve.PlaneAtParameter(curve=getItemAtIndex_2, param=sort_2)
origin_2 = Plane.Origin(planeAtParameter_2)
shuffle_2 = List.Shuffle(origin_2)
byStartPointEndPoint = Line.ByStartPointEndPoint(startPoint=shuffle, endPoint=shuffle_2, lacing=Longest)
endPoint = Curve.EndPoint(byStartPointEndPoint)
YAxis_3 = Vector.YAxis()
code_block_9 = CodeBlock { 0.2; 1.5; 0.01; }
count = Count(endPoint)
lunchbox_random_numbers_3 = Custom[LunchBox Random Numbers](Min=code_block_9.out0, Max=code_block_9.out1, Amount=count, Seed=code_block_9.out2)
translate = Geometry.Translate(geometry=endPoint, direction=YAxis_3, distance=lunchbox_random_numbers_3)
reverse = Vector.Reverse(YAxis_3)
translate_2 = Geometry.Translate(geometry=endPoint, direction=reverse, distance=lunchbox_random_numbers_3)
startPoint = Curve.StartPoint(byStartPointEndPoint)
YAxis_4 = Vector.YAxis()
reverse_2 = Vector.Reverse(YAxis_4)
code_block_10 = CodeBlock { 0.5; 4.5; 0.01; }
count_2 = Count(startPoint)
lunchbox_random_numbers_4 = Custom[LunchBox Random Numbers](Min=code_block_10.out0, Max=code_block_10.out1, Amount=count_2, Seed=code_block_10.out2)
translate_3 = Geometry.Translate(geometry=startPoint, direction=reverse_2, distance=lunchbox_random_numbers_4)
translate_4 = Geometry.Translate(geometry=startPoint, direction=YAxis_4, distance=lunchbox_random_numbers_4)
create_2 = List.Create(translate, translate_2, translate_3, translate_4)
transpose = List.Transpose(create_2)
boolean = BoolSelector(true)
byPoints = PolyCurve.ByPoints(points=transpose, connectLastToFirst=boolean)
byPatch = Surface.ByPatch(byPoints)
thicken = Surface.Thicken(surface=byPatch)
code_block_11 = CodeBlock { 1; }
getItemAtIndex_3 = List.GetItemAtIndex(list=perimeterCurves, index=code_block_11)
code_block_12 = CodeBlock { 0.05; 0.95; 14; 0.08; }
lunchbox_random_numbers_5 = Custom[LunchBox Random Numbers](Min=code_block_12.out0, Max=code_block_12.out1, Amount=code_block_12.out2, Seed=code_block_12.out3)
sort_3 = List.Sort(lunchbox_random_numbers_5)
planeAtParameter_3 = Curve.PlaneAtParameter(curve=getItemAtIndex_3, param=sort_3)
origin_3 = Plane.Origin(planeAtParameter_3)
shuffle_3 = List.Shuffle(origin_3)
code_block_13 = CodeBlock { 3; }
getItemAtIndex_4 = List.GetItemAtIndex(list=perimeterCurves, index=code_block_13)
code_block_14 = CodeBlock { 0.05; 0.95; 14; 0.4; }
lunchbox_random_numbers_6 = Custom[LunchBox Random Numbers](Min=code_block_14.out0, Max=code_block_14.out1, Amount=code_block_14.out2, Seed=code_block_14.out3)
sort_4 = List.Sort(lunchbox_random_numbers_6)
planeAtParameter_4 = Curve.PlaneAtParameter(curve=getItemAtIndex_4, param=sort_4)
origin_4 = Plane.Origin(planeAtParameter_4)
shuffle_4 = List.Shuffle(origin_4)
byStartPointEndPoint_2 = Line.ByStartPointEndPoint(startPoint=shuffle_3, endPoint=shuffle_4, lacing=Longest)
endPoint_2 = Curve.EndPoint(byStartPointEndPoint_2)
ZAxis_2 = Vector.ZAxis()
code_block_15 = CodeBlock { 0.2; 1.5; 0.01; }
count_3 = Count(endPoint_2)
lunchbox_random_numbers_7 = Custom[LunchBox Random Numbers](Min=code_block_15.out0, Max=code_block_15.out1, Amount=count_3, Seed=code_block_15.out2)
translate_5 = Geometry.Translate(geometry=endPoint_2, direction=ZAxis_2, distance=lunchbox_random_numbers_7)
reverse_3 = Vector.Reverse(ZAxis_2)
translate_6 = Geometry.Translate(geometry=endPoint_2, direction=reverse_3, distance=lunchbox_random_numbers_7)
startPoint_2 = Curve.StartPoint(byStartPointEndPoint_2)
reverse_4 = Vector.Reverse(ZAxis_2)
code_block_16 = CodeBlock { 0.5; 4.5; 0.01; }
count_4 = Count(startPoint_2)
lunchbox_random_numbers_8 = Custom[LunchBox Random Numbers](Min=code_block_16.out0, Max=code_block_16.out1, Amount=count_4, Seed=code_block_16.out2)
translate_7 = Geometry.Translate(geometry=startPoint_2, direction=reverse_4, distance=lunchbox_random_numbers_8)
translate_8 = Geometry.Translate(geometry=startPoint_2, direction=ZAxis_2, distance=lunchbox_random_numbers_8)
create_3 = List.Create(translate_5, translate_6, translate_7, translate_8)
transpose_2 = List.Transpose(create_3)
boolean_2 = BoolSelector(true)
byPoints_2 = PolyCurve.ByPoints(points=transpose_2, connectLastToFirst=boolean_2)
byPatch_2 = Surface.ByPatch(byPoints_2)
thicken_2 = Surface.Thicken(surface=byPatch_2)
code_block_17 = CodeBlock { 3; }
getItemAtIndex_5 = List.GetItemAtIndex(list=perimeterCurves, index=code_block_17)
code_block_18 = CodeBlock { 0.2; 0.7; 7; 0.08; }
lunchbox_random_numbers_9 = Custom[LunchBox Random Numbers](Min=code_block_18.out0, Max=code_block_18.out1, Amount=code_block_18.out2, Seed=code_block_18.out3)
sort_5 = List.Sort(lunchbox_random_numbers_9)
planeAtParameter_5 = Curve.PlaneAtParameter(curve=getItemAtIndex_5, param=sort_5)
origin_5 = Plane.Origin(planeAtParameter_5)
shuffle_5 = List.Shuffle(origin_5)
code_block_19 = CodeBlock { 2; }
getItemAtIndex_6 = List.GetItemAtIndex(list=perimeterCurves, index=code_block_19)
code_block_20 = CodeBlock { 0.05; 0.95; 5; 0.09; }
lunchbox_random_numbers_10 = Custom[LunchBox Random Numbers](Min=code_block_20.out0, Max=code_block_20.out1, Amount=code_block_20.out2, Seed=code_block_20.out3)
sort_6 = List.Sort(lunchbox_random_numbers_10)
planeAtParameter_6 = Curve.PlaneAtParameter(curve=getItemAtIndex_6, param=sort_6)
origin_6 = Plane.Origin(planeAtParameter_6)
shuffle_6 = List.Shuffle(origin_6)
byStartPointEndPoint_3 = Line.ByStartPointEndPoint(startPoint=shuffle_5, endPoint=shuffle_6, lacing=Longest)
endPoint_3 = Curve.EndPoint(byStartPointEndPoint_3)
YAxis_5 = Vector.YAxis()
code_block_21 = CodeBlock { 0.7; 1.5; 0.01; }
count_5 = Count(endPoint_3)
lunchbox_random_numbers_11 = Custom[LunchBox Random Numbers](Min=code_block_21.out0, Max=code_block_21.out1, Amount=count_5, Seed=code_block_21.out2)
translate_9 = Geometry.Translate(geometry=endPoint_3, direction=YAxis_5, distance=lunchbox_random_numbers_11)
reverse_5 = Vector.Reverse(YAxis_5)
translate_10 = Geometry.Translate(geometry=endPoint_3, direction=reverse_5, distance=lunchbox_random_numbers_11)
startPoint_3 = Curve.StartPoint(byStartPointEndPoint_3)
ZAxis_3 = Vector.ZAxis()
code_block_22 = CodeBlock { 0.5; 4.5; 0.01; }
count_6 = Count(startPoint_3)
lunchbox_random_numbers_12 = Custom[LunchBox Random Numbers](Min=code_block_22.out0, Max=code_block_22.out1, Amount=count_6, Seed=code_block_22.out2)
translate_11 = Geometry.Translate(geometry=startPoint_3, direction=ZAxis_3, distance=lunchbox_random_numbers_12)
reverse_6 = Vector.Reverse(ZAxis_3)
translate_12 = Geometry.Translate(geometry=startPoint_3, direction=reverse_6, distance=lunchbox_random_numbers_12)
create_4 = List.Create(translate_9, translate_10, translate_11, translate_12)
transpose_3 = List.Transpose(create_4)
boolean_3 = BoolSelector(true)
byPoints_3 = PolyCurve.ByPoints(points=transpose_3, connectLastToFirst=boolean_3)
byPatch_3 = Surface.ByPatch(byPoints_3)
thicken_3 = Surface.Thicken(surface=byPatch_3)
create_5 = List.Create(thicken, thicken_2, thicken_3, extrude)
flatten = Flatten(create_5)
code_block_23 = CodeBlock { 100; }
scale = Geometry.Scale(geometry=flatten, xamount=code_block_23, yamount=code_block_23, zamount=code_block_23)
byGeometry = ImportInstance.ByGeometry(scale)
