# Dynamo graph curvy pier one - final revit version.dyn (Dynamo 0.8.1.1052)

code_block = CodeBlock { 0..1..0.013; }
count = Count(code_block)
code_block_2 = CodeBlock { 0..1800..25; }
count_2 = Count(code_block_2)
code_block_3 = CodeBlock { 0; }
byCoordinates = Point.ByCoordinates(x=code_block_3, y=code_block_3, z=code_block_3)
YAxis = Vector.YAxis()
code_block_4 = CodeBlock { 225; }
byStartPointDirectionLength = Line.ByStartPointDirectionLength(startPoint=byCoordinates, direction=YAxis, length=code_block_4)
planeAtParameter = Curve.PlaneAtParameter(curve=byStartPointDirectionLength, param=code_block)
origin = Plane.Origin(planeAtParameter)
ZAxis = Vector.ZAxis()
code_block_5 = CodeBlock { 2.1; }
code_block_6 = CodeBlock(amp=code_block_5, x=code_block_2) { -(amp*Math.Cos(x))+amp; }
translate = Geometry.Translate(geometry=origin, direction=ZAxis, distance=code_block_6)
code_block_7 = CodeBlock { 3; }
byControlPoints = NurbsCurve.ByControlPoints(translate, code_block_7)
code_block_8 = CodeBlock { 0..1..0.05; }
planeAtParameter_2 = Curve.PlaneAtParameter(curve=byControlPoints, param=code_block_8)
origin_2 = Plane.Origin(planeAtParameter_2)
count_3 = Count(origin_2)
YAxis_2 = Vector.YAxis()
byOriginNormal = Plane.ByOriginNormal(origin=origin_2, normal=YAxis_2)
byPlane = CoordinateSystem.ByPlane(byOriginNormal)
code_block_9 = CodeBlock { 0; 0; }
code_block_10 = CodeBlock { 0; }
code_block_11 = CodeBlock { 1; }
code_block_12 = CodeBlock { 6; 10; 6; }
create = List.Create(code_block_12.out0, code_block_12.out1, code_block_12.out2)
code_block_13 = CodeBlock { 2; }
code_block_14 = CodeBlock { 3; 4; 3; }
create_2 = List.Create(code_block_14.out0, code_block_14.out1, code_block_14.out2)
create_3 = List.Create(code_block_11, create, code_block_13, create_2, code_block_13, create, code_block_13, create_2, code_block_13, create, code_block_11)
flatten = Flatten(create_3)
number_slider = DoubleSlider(4.7, range=1.5..10 step 0.1)
number_slider_2 = DoubleSlider(20, range=10..20 step 0.1)
remapRange = Math.RemapRange(numbers=flatten, newMin=number_slider, newMax=number_slider_2)
byCylindricalCoordinates = Point.ByCylindricalCoordinates(byPlane, code_block_9.out0, code_block_10, remapRange)
code_block_15 = CodeBlock { 3; }
byControlPoints_2 = NurbsCurve.ByControlPoints(byCylindricalCoordinates, code_block_15)
XAxis = Vector.XAxis()
code_block_16 = CodeBlock { 2.5; }
translate_2 = Geometry.Translate(geometry=byControlPoints_2, direction=XAxis, distance=code_block_16)
code_block_17 = CodeBlock { 0; }
planeAtParameter_3 = Curve.PlaneAtParameter(curve=translate_2, param=code_block_17)
origin_3 = Plane.Origin(planeAtParameter_3)
YAxis_3 = Vector.YAxis()
byOriginNormal_2 = Plane.ByOriginNormal(origin=origin_3, normal=YAxis_3)
code_block_18 = CodeBlock { 3; 4; 3; }
create_4 = List.Create(code_block_18.out0, code_block_18.out1, code_block_18.out2)
code_block_19 = CodeBlock { 2; }
code_block_20 = CodeBlock { 6; 10; 6; }
create_5 = List.Create(code_block_20.out0, code_block_20.out1, code_block_20.out2)
create_6 = List.Create(code_block_11, create_4, code_block_19, create_5, code_block_19, create_4, code_block_19, create_5, code_block_19, create_4, code_block_11)
flatten_2 = Flatten(create_6)
remapRange_2 = Math.RemapRange(numbers=flatten_2, newMin=number_slider, newMax=number_slider_2)
byCylindricalCoordinates_2 = Point.ByCylindricalCoordinates(byPlane, code_block_9.out1, code_block_10, remapRange_2)
code_block_21 = CodeBlock { 3; }
byControlPoints_3 = NurbsCurve.ByControlPoints(byCylindricalCoordinates_2, code_block_21)
XAxis_2 = Vector.XAxis()
code_block_22 = CodeBlock(x=code_block_16) { -x; }
translate_3 = Geometry.Translate(geometry=byControlPoints_3, direction=XAxis_2, distance=code_block_22)
code_block_23 = CodeBlock { 0; }
planeAtParameter_4 = Curve.PlaneAtParameter(curve=translate_3, param=code_block_23)
origin_4 = Plane.Origin(planeAtParameter_4)
YAxis_4 = Vector.YAxis()
byOriginNormal_3 = Plane.ByOriginNormal(origin=origin_4, normal=YAxis_4)
code_block_24 = CodeBlock { 0..1..0.015; }
planeAtParameter_5 = Curve.PlaneAtParameter(curve=byStartPointDirectionLength, param=code_block_24)
intersect = Geometry.Intersect(geometry=byControlPoints, other=planeAtParameter_5)
code_block_25 = CodeBlock { 55; -55; }
byCylindricalCoordinates_3 = Point.ByCylindricalCoordinates(byPlane, code_block_25.out1, code_block_10, remapRange_2)
code_block_26 = CodeBlock { 3; }
byControlPoints_4 = NurbsCurve.ByControlPoints(byCylindricalCoordinates_3, code_block_26)
intersect_2 = Geometry.Intersect(geometry=byControlPoints_4, other=planeAtParameter_5)
byStartPointEndPoint = Line.ByStartPointEndPoint(startPoint=intersect, endPoint=intersect_2)
byCylindricalCoordinates_4 = Point.ByCylindricalCoordinates(byPlane, code_block_25.out0, code_block_10, remapRange)
code_block_27 = CodeBlock { 3; }
byControlPoints_5 = NurbsCurve.ByControlPoints(byCylindricalCoordinates_4, code_block_27)
intersect_3 = Geometry.Intersect(geometry=byControlPoints_5, other=planeAtParameter_5)
byStartPointEndPoint_2 = Line.ByStartPointEndPoint(startPoint=intersect, endPoint=intersect_3)
code_block_28 = CodeBlock { 50; }
rotate = Geometry.Rotate(geometry=translate_2, origin=origin_3, axis=YAxis_3, degrees=code_block_28)
intersect_4 = Geometry.Intersect(geometry=rotate, other=planeAtParameter_5)
byStartPointEndPoint_3 = Line.ByStartPointEndPoint(startPoint=intersect, endPoint=intersect_4)
startPoint = Curve.StartPoint(byStartPointEndPoint_3)
XAxis_3 = Vector.XAxis()
byOriginNormal_4 = Plane.ByOriginNormal(origin=startPoint, normal=XAxis_3)
code_block_29 = CodeBlock { 0.75; 0.2; }
byPlaneRadii = Ellipse.ByPlaneRadii(byOriginNormal_4, code_block_29.out0, code_block_29.out1)
flatten_3 = Flatten(byPlaneRadii)
code_block_30 = CodeBlock { 1; }
planeAtParameter_6 = Curve.PlaneAtParameter(curve=byStartPointEndPoint_3, param=code_block_30)
code_block_31 = CodeBlock { 0.11; }
byPlaneRadius = Circle.ByPlaneRadius(plane=planeAtParameter_6, radius=code_block_31)
flatten_4 = Flatten(byPlaneRadius)
create_7 = List.Create(flatten_3, flatten_4)
transpose = List.Transpose(create_7)
byLoft = Surface.ByLoft(transpose)
code_block_32 = CodeBlock(x=code_block_28) { -x; }
rotate_2 = Geometry.Rotate(geometry=translate_3, origin=origin_4, axis=YAxis_4, degrees=code_block_32)
intersect_5 = Geometry.Intersect(geometry=rotate_2, other=planeAtParameter_5)
byStartPointEndPoint_4 = Line.ByStartPointEndPoint(startPoint=intersect, endPoint=intersect_5)
startPoint_2 = Curve.StartPoint(byStartPointEndPoint_4)
XAxis_4 = Vector.XAxis()
byOriginNormal_5 = Plane.ByOriginNormal(origin=startPoint_2, normal=XAxis_4)
byPlaneRadii_2 = Ellipse.ByPlaneRadii(byOriginNormal_5, code_block_29.out0, code_block_29.out1)
flatten_5 = Flatten(byPlaneRadii_2)
code_block_33 = CodeBlock { 1; }
planeAtParameter_7 = Curve.PlaneAtParameter(curve=byStartPointEndPoint_4, param=code_block_33)
byPlaneRadius_2 = Circle.ByPlaneRadius(plane=planeAtParameter_7, radius=code_block_31)
flatten_6 = Flatten(byPlaneRadius_2)
create_8 = List.Create(flatten_5, flatten_6)
transpose_2 = List.Transpose(create_8)
byLoft_2 = Surface.ByLoft(transpose_2)
code_block_34 = CodeBlock { 0; }
planeAtParameter_8 = Curve.PlaneAtParameter(curve=rotate, param=code_block_34)
code_block_35 = CodeBlock { 0.5; }
byPlaneRadius_3 = Circle.ByPlaneRadius(plane=planeAtParameter_8, radius=code_block_35)
bySweep = Surface.BySweep(byPlaneRadius_3, rotate)
code_block_36 = CodeBlock { 0; }
planeAtParameter_9 = Curve.PlaneAtParameter(curve=rotate_2, param=code_block_36)
byPlaneRadius_4 = Circle.ByPlaneRadius(plane=planeAtParameter_9, radius=code_block_35)
bySweep_2 = Surface.BySweep(byPlaneRadius_4, rotate_2)
ZAxis_2 = Vector.ZAxis()
reverse = Vector.Reverse(ZAxis_2)
code_block_37 = CodeBlock { 0.4; }
translate_4 = Geometry.Translate(geometry=byControlPoints, direction=reverse, distance=code_block_37)
code_block_38 = CodeBlock { 0; }
planeAtParameter_10 = Curve.PlaneAtParameter(curve=translate_4, param=code_block_38)
code_block_39 = CodeBlock { 0.65; }
byPlaneRadius_5 = Circle.ByPlaneRadius(plane=planeAtParameter_10, radius=code_block_39)
bySweep_3 = Solid.BySweep(byPlaneRadius_5, translate_4)
startPoint_3 = Curve.StartPoint(byControlPoints)
endPoint = Curve.EndPoint(byControlPoints)
byStartPointEndPoint_5 = Line.ByStartPointEndPoint(startPoint=startPoint_3, endPoint=endPoint)
ZAxis_3 = Vector.ZAxis()
code_block_40 = CodeBlock { 6.9; }
translate_5 = Geometry.Translate(geometry=byStartPointEndPoint_5, direction=ZAxis_3, distance=code_block_40)
code_block_41 = CodeBlock { 0; }
planeAtParameter_11 = Curve.PlaneAtParameter(curve=translate_5, param=code_block_41)
code_block_42 = CodeBlock { 1; 3.5; }
byPlaneRadii_3 = Ellipse.ByPlaneRadii(planeAtParameter_11, code_block_42.out0, code_block_42.out1)
bySweep_4 = Solid.BySweep(byPlaneRadii_3, translate_5)
code_block_43 = CodeBlock { 5; }
code_block_44 = CodeBlock { 5.5; }
byWidthHeight = Rectangle.ByWidthHeight(planeAtParameter_11, code_block_43, code_block_44)
ZAxis_4 = Vector.ZAxis()
code_block_45 = CodeBlock { 2; }
translate_6 = Geometry.Translate(geometry=byWidthHeight, direction=ZAxis_4, distance=code_block_45)
bySweep_5 = Solid.BySweep(translate_6, translate_5)
difference = Solid.Difference(solid=bySweep_4, other=bySweep_5)
byGeometry = ImportInstance.ByGeometry()
byGeometry_2 = ImportInstance.ByGeometry()
byGeometry_3 = ImportInstance.ByGeometry()
byGeometry_4 = ImportInstance.ByGeometry()
byGeometry_5 = ImportInstance.ByGeometry()
byGeometry_6 = ImportInstance.ByGeometry()
