# Dynamo graph dynamo studio hero image - two.dyn (Dynamo 0.8.1.1052)

create = List.Create()
XY = Plane.XY()
code_block = CodeBlock { 30; 39; 18; }
byPlaneRadius = Circle.ByPlaneRadius(plane=XY, radius=code_block.out0)
code_block_2 = CodeBlock { 42; }
offset = Plane.Offset(XY, code_block_2)
byPlaneRadius_2 = Circle.ByPlaneRadius(plane=offset, radius=code_block.out1)
code_block_3 = CodeBlock(x=code_block_2) { x*1.9; }
offset_2 = Plane.Offset(XY, code_block_3)
byPlaneRadius_3 = Circle.ByPlaneRadius(plane=offset_2, radius=code_block.out2)
create_2 = List.Create(byPlaneRadius, byPlaneRadius_2, byPlaneRadius_3)
byLoft = Surface.ByLoft(create_2)
XY_2 = Plane.XY()
code_block_4 = CodeBlock { 180; }
rotate = Geometry.Rotate(byLoft, XY_2, code_block_4)
number_slider = DoubleSlider(60, range=0..60 step 0.1)
rotate_2 = Geometry.Rotate(byPlaneRadius, XY, number_slider)
code_block_5 = CodeBlock { 14; }
divideEqually = Curve.DivideEqually(rotate_2, code_block_5)
endPoint = Curve.EndPoint(divideEqually)
count = Count(endPoint)
code_block_6 = CodeBlock(x=count) { x/2; }
chop = List.Chop(endPoint, code_block_6)
deconstruct = List.Deconstruct(list=chop)
flatten = Flatten(deconstruct.rest)
UVParameterAtPoint = Surface.UVParameterAtPoint(rotate, flatten)
divideEqually_2 = Curve.DivideEqually(byPlaneRadius_3, code_block_5)
endPoint_2 = Curve.EndPoint(divideEqually_2)
count_2 = Count(endPoint_2)
code_block_7 = CodeBlock(x=count_2) { x/2; }
chop_2 = List.Chop(endPoint_2, code_block_7)
deconstruct_2 = List.Deconstruct(list=chop_2)
flatten_2 = Flatten(deconstruct_2.rest)
UVParameterAtPoint_2 = Surface.UVParameterAtPoint(rotate, flatten_2)
byParameterLineOnSurface = Curve.ByParameterLineOnSurface(rotate, UVParameterAtPoint, UVParameterAtPoint_2)
count_3 = Count(endPoint)
code_block_8 = CodeBlock(x=count_3) { x/2; }
chop_3 = List.Chop(endPoint, code_block_8)
deconstruct_3 = List.Deconstruct(list=chop_3)
flatten_3 = Flatten(deconstruct_3.first)
UVParameterAtPoint_3 = Surface.UVParameterAtPoint(byLoft, flatten_3)
count_4 = Count(endPoint_2)
code_block_9 = CodeBlock(x=count_4) { x/2; }
chop_4 = List.Chop(endPoint_2, code_block_9)
deconstruct_4 = List.Deconstruct(list=chop_4)
flatten_4 = Flatten(deconstruct_4.first)
UVParameterAtPoint_4 = Surface.UVParameterAtPoint(byLoft, flatten_4)
byParameterLineOnSurface_2 = Curve.ByParameterLineOnSurface(byLoft, UVParameterAtPoint_3, UVParameterAtPoint_4)
create_3 = List.Create(byParameterLineOnSurface, byParameterLineOnSurface_2)
flatten_5 = Flatten(create_3)
code_block_10 = CodeBlock { 0..1..0.1; }
planeAtParameter = Curve.PlaneAtParameter(curve=flatten_5, param=code_block_10, lacing=CrossProduct)
origin = Plane.Origin(planeAtParameter)
code_block_11 = CodeBlock { 1; }
byControlPoints = NurbsCurve.ByControlPoints(origin, code_block_11)
explode = Geometry.Explode(byControlPoints)
transpose = List.Transpose(explode)
flatten_6 = Flatten(transpose)
code_block_12 = CodeBlock { 1.33; }
code_block_13 = CodeBlock(x=code_block.out0, y=code_block_12) { x*y; }
byPlaneRadius_4 = Circle.ByPlaneRadius(plane=XY, radius=code_block_13)
code_block_14 = CodeBlock(x=code_block.out1, y=code_block_12) { x*y; }
byPlaneRadius_5 = Circle.ByPlaneRadius(plane=offset, radius=code_block_14)
code_block_15 = CodeBlock(x=code_block.out2, y=code_block_12) { x*y; }
byPlaneRadius_6 = Circle.ByPlaneRadius(plane=offset_2, radius=code_block_15)
create_4 = List.Create(byPlaneRadius_4, byPlaneRadius_5, byPlaneRadius_6)
byLoft_2 = Surface.ByLoft(create_4)
XY_3 = Plane.XY()
code_block_16 = CodeBlock { 180; }
rotate_3 = Geometry.Rotate(byLoft_2, XY_3, code_block_16)
rotate_4 = Geometry.Rotate(byPlaneRadius_4, XY, number_slider)
divideEqually_3 = Curve.DivideEqually(rotate_4, code_block_5)
endPoint_3 = Curve.EndPoint(divideEqually_3)
count_5 = Count(endPoint_3)
code_block_17 = CodeBlock(x=count_5) { x/2; }
chop_5 = List.Chop(endPoint_3, code_block_17)
deconstruct_5 = List.Deconstruct(list=chop_5)
flatten_7 = Flatten(deconstruct_5.rest)
UVParameterAtPoint_5 = Surface.UVParameterAtPoint(rotate_3, flatten_7)
divideEqually_4 = Curve.DivideEqually(byPlaneRadius_6, code_block_5)
endPoint_4 = Curve.EndPoint(divideEqually_4)
count_6 = Count(endPoint_4)
code_block_18 = CodeBlock(x=count_6) { x/2; }
chop_6 = List.Chop(endPoint_4, code_block_18)
deconstruct_6 = List.Deconstruct(list=chop_6)
flatten_8 = Flatten(deconstruct_6.rest)
UVParameterAtPoint_6 = Surface.UVParameterAtPoint(rotate_3, flatten_8)
byParameterLineOnSurface_3 = Curve.ByParameterLineOnSurface(rotate_3, UVParameterAtPoint_5, UVParameterAtPoint_6)
count_7 = Count(endPoint_3)
code_block_19 = CodeBlock(x=count_7) { x/2; }
chop_7 = List.Chop(endPoint_3, code_block_19)
deconstruct_7 = List.Deconstruct(list=chop_7)
flatten_9 = Flatten(deconstruct_7.first)
UVParameterAtPoint_7 = Surface.UVParameterAtPoint(byLoft_2, flatten_9)
count_8 = Count(endPoint_4)
code_block_20 = CodeBlock(x=count_8) { x/2; }
chop_8 = List.Chop(endPoint_4, code_block_20)
deconstruct_8 = List.Deconstruct(list=chop_8)
flatten_10 = Flatten(deconstruct_8.first)
UVParameterAtPoint_8 = Surface.UVParameterAtPoint(byLoft_2, flatten_10)
byParameterLineOnSurface_4 = Curve.ByParameterLineOnSurface(byLoft_2, UVParameterAtPoint_7, UVParameterAtPoint_8)
create_5 = List.Create(byParameterLineOnSurface_3, byParameterLineOnSurface_4)
flatten_11 = Flatten(create_5)
code_block_21 = CodeBlock { 1; }
shiftIndices = List.ShiftIndices(list=flatten_11, amount=code_block_21)
planeAtParameter_2 = Curve.PlaneAtParameter(curve=shiftIndices, param=code_block_10, lacing=CrossProduct)
origin_2 = Plane.Origin(planeAtParameter_2)
code_block_22 = CodeBlock { 1; }
byControlPoints_2 = NurbsCurve.ByControlPoints(origin_2, code_block_22)
explode_2 = Geometry.Explode(byControlPoints_2)
transpose_2 = List.Transpose(explode_2)
flatten_12 = Flatten(transpose_2)
combine = List.Combine(create, flatten_6, flatten_12)
byLoft_3 = Surface.ByLoft(combine)
explode_3 = Geometry.Explode(byLoft_3)
code_block_23 = CodeBlock { 2.9; }
thicken = Surface.Thicken(surface=explode_3, thickness=code_block_23)
flatten_13 = Flatten(thicken)
code_block_24 = CodeBlock { a=Color.ByARGB(255,0,0,255); b=Color.ByARGB(255,255,0,0); colors={a,b}; indices = {0,1}; 0..1..#140; }
color_range = ColorRange(code_block_24.colors, code_block_24.indices, code_block_24.out4)
byGeometryColor = Display.ByGeometryColor(flatten_13, color_range)
flatten_14 = Flatten(create_3)
code_block_25 = CodeBlock { 0..1..0.1; }
planeAtParameter_3 = Curve.PlaneAtParameter(curve=flatten_14, param=code_block_25, lacing=CrossProduct)
origin_3 = Plane.Origin(planeAtParameter_3)
transpose_3 = List.Transpose(origin_3)
flatten_15 = Flatten(transpose_3)
flatten_16 = Flatten(create_5)
planeAtParameter_4 = Curve.PlaneAtParameter(curve=flatten_16, param=code_block_25, lacing=CrossProduct)
origin_4 = Plane.Origin(planeAtParameter_4)
transpose_4 = List.Transpose(origin_4)
flatten_17 = Flatten(transpose_4)
byStartPointEndPoint = Line.ByStartPointEndPoint(startPoint=flatten_15, endPoint=flatten_17)
code_block_26 = CodeBlock { 0; }
planeAtParameter_5 = Curve.PlaneAtParameter(curve=byStartPointEndPoint, param=code_block_26)
code_block_27 = CodeBlock { 0.7; }
byPlaneRadius_7 = Circle.ByPlaneRadius(plane=planeAtParameter_5, radius=code_block_27)
bySweep = Surface.BySweep(byPlaneRadius_7, byStartPointEndPoint)
code_block_28 = CodeBlock { 0; }
byCoordinates = Point.ByCoordinates(x=code_block_28, y=code_block_28, z=code_block_28)
code_block_29 = CodeBlock { 50; 125; }
byCenterPointRadius = Circle.ByCenterPointRadius(centerPoint=byCoordinates, radius=code_block_29.out0)
byCenterPointRadius_2 = Circle.ByCenterPointRadius(centerPoint=byCoordinates, radius=code_block_29.out1)
create_6 = List.Create(byCenterPointRadius, byCenterPointRadius_2)
byLoft_4 = Surface.ByLoft(create_6)
code_block_30 = CodeBlock { 0; }
code_block_31 = CodeBlock { 0.1..0.9..0.1; }
byIsoCurveOnSurface = Curve.ByIsoCurveOnSurface(baseSurface=byLoft_4, direction=code_block_30, parameter=code_block_31)
XY_4 = Plane.XY()
code_block_32 = CodeBlock { 10; 90; 10; }
number_range = NumberRange(code_block_32.out0, code_block_32.out1, code_block_32.out2, lacing=Longest)
rotate_5 = Geometry.Rotate(byIsoCurveOnSurface, XY_4, number_range)
code_block_33 = CodeBlock { 90; }
randomList = Math.RandomList(code_block_33)
shuffle = List.Shuffle(randomList)
code_block_34 = CodeBlock { {0..8}; }
code_block_35 = CodeBlock { 8; }
sublists = List.Sublists(list=shuffle, ranges=code_block_34, offset=code_block_35)
parameterSplit = Curve.ParameterSplit(rotate_5, sublists)
flatten_18 = Flatten(parameterSplit)
code_block_36 = CodeBlock { 2; }
dropEveryNthItem = List.DropEveryNthItem(list=flatten_18, n=code_block_36, offset=code_block_36)
code_block_37 = CodeBlock { 0; }
planeAtParameter_6 = Curve.PlaneAtParameter(curve=dropEveryNthItem, param=code_block_37)
code_block_38 = CodeBlock { 3; 5; 45; 3.7; }
lunchbox_random_numbers = Custom[LunchBox Random Numbers](Min=code_block_38.out0, Max=code_block_38.out1, Amount=code_block_38.out2, Seed=code_block_38.out3)  # Generates a list of Random numbers using a domain, amount, and seed.
code_block_39 = CodeBlock { 2; 7; 45; 3.7; }
lunchbox_random_numbers_2 = Custom[LunchBox Random Numbers](Min=code_block_39.out0, Max=code_block_39.out1, Amount=code_block_39.out2, Seed=code_block_39.out3)
byWidthHeight = Rectangle.ByWidthHeight(planeAtParameter_6, lunchbox_random_numbers, lunchbox_random_numbers_2)
bySweep_2 = Surface.BySweep(byWidthHeight, dropEveryNthItem)
flatten_19 = Flatten(bySweep_2)
code_block_40 = CodeBlock { a=Color.ByARGB(45,75,56,67); b=Color.ByARGB(128,230,230,98); colors={a,b}; indices = {0,1}; 0..1..#90; }
color_range_2 = ColorRange(code_block_40.colors, code_block_40.indices, code_block_40.out4)
byGeometryColor_2 = Display.ByGeometryColor(flatten_19, color_range_2)
byPatch = Surface.ByPatch(byWidthHeight)
code_block_41 = CodeBlock { 1; }
planeAtParameter_7 = Curve.PlaneAtParameter(curve=dropEveryNthItem, param=code_block_41)
byWidthHeight_2 = Rectangle.ByWidthHeight(planeAtParameter_7, lunchbox_random_numbers, lunchbox_random_numbers_2)
byPatch_2 = Surface.ByPatch(byWidthHeight_2)
create_7 = List.Create(byPatch, byPatch_2)
flatten_20 = Flatten(create_7)
code_block_42 = CodeBlock { a=Color.ByARGB(45,12,12,12); b=Color.ByARGB(128,128,89,90); colors={a,b}; indices = {0,1}; 0..1..#180; }
color_range_3 = ColorRange(code_block_42.colors, code_block_42.indices, code_block_42.out4)
byGeometryColor_3 = Display.ByGeometryColor(flatten_20, color_range_3)
byGeometry = ImportInstance.ByGeometry()
byGeometry_2 = ImportInstance.ByGeometry()
byGeometry_3 = ImportInstance.ByGeometry()
byGeometry_4 = ImportInstance.ByGeometry()
