# Dynamo graph eladio diest church - two.dyn (Dynamo 0.8.1.1052)

code_block = CodeBlock { 100; }
scale = Geometry.Scale(xamount=code_block, yamount=code_block, zamount=code_block)
XZ = Plane.XZ()
code_block_2 = CodeBlock { 140; 180; }
byWidthHeight = Rectangle.ByWidthHeight(XZ, code_block_2.out0, code_block_2.out1)
explode = Geometry.Explode(byWidthHeight)
endPoint = Curve.EndPoint(explode)
code_block_3 = CodeBlock { 0; }
getItemAtIndex = List.GetItemAtIndex(list=endPoint, index=code_block_3)
YAxis = Vector.YAxis()
number_slider = DoubleSlider(2.02, range=1.1..2.5 step 0.01)
code_block_4 = CodeBlock(x=code_block_2.out1, y=number_slider) { x*y; }
byStartPointDirectionLength = Line.ByStartPointDirectionLength(startPoint=getItemAtIndex, direction=YAxis, length=code_block_4)
code_block_5 = CodeBlock { 0..1..0.01; }
planeAtParameter = Curve.PlaneAtParameter(curve=byStartPointDirectionLength, param=code_block_5)
origin = Plane.Origin(planeAtParameter)
XAxis = Vector.XAxis()
code_block_6 = CodeBlock { 6*360; }
count = Count(origin)
code_block_7 = CodeBlock(x=code_block_6, y=count) { x/y; }
amount_of_cos_displacement = DoubleSlider(14.3, range=5..15 step 0.1)
code_block_8 = CodeBlock(x=code_block_6, y=code_block_7, z=amount_of_cos_displacement) { Math.Cos(180..x..y)*z; }
code_block_9 = CodeBlock(x=code_block_8) { -x; }
translate = Geometry.Translate(geometry=origin, direction=XAxis, distance=code_block_9)
XAxis_2 = Vector.XAxis()
offset_amount = CodeBlock { 13; }
translate_2 = Geometry.Translate(geometry=translate, direction=XAxis_2, distance=offset_amount)
byControlPoints = NurbsCurve.ByControlPoints(translate_2)
byControlPoints_2 = NurbsCurve.ByControlPoints(translate)
create = List.Create(byControlPoints, byControlPoints_2)
byLoft = Surface.ByLoft(create)
code_block_10 = CodeBlock { 2.5; }
thicken = Surface.Thicken(surface=byLoft, thickness=code_block_10)
code_block_11 = CodeBlock { 3; }
getItemAtIndex_2 = List.GetItemAtIndex(list=endPoint, index=code_block_11)
byStartPointEndPoint = Line.ByStartPointEndPoint(startPoint=getItemAtIndex, endPoint=getItemAtIndex_2)
code_block_12 = CodeBlock { 0.5; }
pointAtParameter = Curve.PointAtParameter(curve=byStartPointEndPoint, param=code_block_12)
byStartPointDirectionLength_2 = Line.ByStartPointDirectionLength(startPoint=pointAtParameter, direction=YAxis, length=code_block_4)
code_block_13 = CodeBlock { 0..1..0.01; }
planeAtParameter_2 = Curve.PlaneAtParameter(curve=byStartPointDirectionLength_2, param=code_block_13)
origin_2 = Plane.Origin(planeAtParameter_2)
ZAxis = Vector.ZAxis()
code_block_14 = CodeBlock { 6*360; }
count_2 = Count(origin_2)
code_block_15 = CodeBlock(x=code_block_14, y=count_2) { x/y; }
code_block_16 = CodeBlock(x=amount_of_cos_displacement) { x*0.5; }
code_block_17 = CodeBlock(x=code_block_14, y=code_block_15, z=code_block_16) { Math.Cos(180..x..y)*z; }
code_block_18 = CodeBlock(x=code_block_17) { -x; }
translate_3 = Geometry.Translate(geometry=origin_2, direction=ZAxis, distance=code_block_18)
ZAxis_2 = Vector.ZAxis()
maximumItem = List.MaximumItem(code_block_18)
code_block_19 = CodeBlock(x=maximumItem) { x*1.5; }
translate_4 = Geometry.Translate(geometry=translate_3, direction=ZAxis_2, distance=code_block_19)
byControlPoints_3 = NurbsCurve.ByControlPoints(translate_4)
byStartPointDirectionLength_3 = Line.ByStartPointDirectionLength(startPoint=getItemAtIndex_2, direction=YAxis, length=code_block_4)
code_block_20 = CodeBlock { 0..1..0.01; }
planeAtParameter_3 = Curve.PlaneAtParameter(curve=byStartPointDirectionLength_3, param=code_block_20)
origin_3 = Plane.Origin(planeAtParameter_3)
XAxis_3 = Vector.XAxis()
code_block_21 = CodeBlock { 6*360; }
count_3 = Count(origin_3)
code_block_22 = CodeBlock(x=code_block_21, y=count_3) { x/y; }
code_block_23 = CodeBlock(x=code_block_21, y=code_block_22, z=amount_of_cos_displacement) { Math.Cos(180..x..y)*z; }
translate_5 = Geometry.Translate(geometry=origin_3, direction=XAxis_3, distance=code_block_23)
byControlPoints_4 = NurbsCurve.ByControlPoints(translate_5)
create_2 = List.Create(byControlPoints_2, byControlPoints_3, byControlPoints_4)
byLoft_2 = Surface.ByLoft(create_2)
thicken_2 = Surface.Thicken(surface=byLoft_2, thickness=code_block_10)
XAxis_4 = Vector.XAxis()
code_block_24 = CodeBlock(x=offset_amount) { -x; }
translate_6 = Geometry.Translate(geometry=translate_5, direction=XAxis_4, distance=code_block_24)
byControlPoints_5 = NurbsCurve.ByControlPoints(translate_6)
create_3 = List.Create(byControlPoints_4, byControlPoints_5)
byLoft_3 = Surface.ByLoft(create_3)
thicken_3 = Surface.Thicken(surface=byLoft_3, thickness=code_block_10)
XY = Plane.XY()
intersect = Geometry.Intersect(geometry=byWidthHeight, other=XY)
firstItem = List.FirstItem(intersect)
byStartPointDirectionLength_4 = Line.ByStartPointDirectionLength(startPoint=firstItem, direction=YAxis, length=code_block_4)
startPoint = Curve.StartPoint(byStartPointDirectionLength_4)
X = Point.X(startPoint)
endPoint_2 = Curve.EndPoint(byControlPoints_2)
Y = Point.Y(endPoint_2)
code_block_25 = CodeBlock { 0; }
byCoordinates = Point.ByCoordinates(x=X, y=Y, z=code_block_25)
byStartPointEndPoint_2 = Line.ByStartPointEndPoint(startPoint=startPoint, endPoint=byCoordinates)
create_4 = List.Create(byStartPointEndPoint_2, byControlPoints_2)
byLoft_4 = Surface.ByLoft(create_4)
thicken_4 = Surface.Thicken(surface=byLoft_4, thickness=code_block_10)
lastItem = List.LastItem(intersect)
byStartPointDirectionLength_5 = Line.ByStartPointDirectionLength(startPoint=lastItem, direction=YAxis, length=code_block_4)
startPoint_2 = Curve.StartPoint(byStartPointDirectionLength_5)
X_2 = Point.X(startPoint_2)
endPoint_3 = Curve.EndPoint(byControlPoints_4)
Y_2 = Point.Y(endPoint_3)
code_block_26 = CodeBlock { 0; }
byCoordinates_2 = Point.ByCoordinates(x=X_2, y=Y_2, z=code_block_26)
byStartPointEndPoint_3 = Line.ByStartPointEndPoint(startPoint=startPoint_2, endPoint=byCoordinates_2)
create_5 = List.Create(byStartPointEndPoint_3, byControlPoints_4)
byLoft_5 = Surface.ByLoft(create_5)
code_block_27 = CodeBlock(x=code_block_10) { -x; }
thicken_5 = Surface.Thicken(surface=byLoft_5, thickness=code_block_27)
create_6 = List.Create(thicken, thicken_2, thicken_3, thicken_4, thicken_5)
flatten = Flatten(create_6)
byGeometry = ImportInstance.ByGeometry()
