# Dynamo graph king post wall #2.dyn (Dynamo 0.9.1.4062)

create = List.Create()
select_edge = DSEdgeSelection()  # 1 picked in the model
code_block = CodeBlock { 2000; 0; }
divideByLengthFromParameter = Curve.DivideByLengthFromParameter(select_edge, code_block.out0, code_block.out1)
code_block_2 = CodeBlock { 0; }
tangentAtParameter = Curve.TangentAtParameter(divideByLengthFromParameter, code_block_2)
lastItem = List.LastItem(divideByLengthFromParameter)
code_block_3 = CodeBlock { 1; }
tangentAtParameter_2 = Curve.TangentAtParameter(lastItem, code_block_3)
code_block_4 = CodeBlock { 1; }
tangentAtParameter_3 = Curve.TangentAtParameter(select_edge, code_block_4)
create_2 = List.Create(tangentAtParameter, tangentAtParameter_2, tangentAtParameter_3)
flatten = Flatten(create_2)
startPoint = Curve.StartPoint(divideByLengthFromParameter)
divideByLengthFromParameter_2 = Curve.DivideByLengthFromParameter(lastItem, code_block.out0, code_block.out1)
endPoint = Curve.EndPoint(divideByLengthFromParameter_2)
endPoint_2 = Cone.EndPoint(select_edge)
create_3 = List.Create(startPoint, endPoint, endPoint_2)
flatten_2 = Flatten(create_3)
combine = List.Combine(create, flatten, flatten_2)
select_face = DSFaceSelection()  # 1 picked in the model
byOriginNormal = Plane.ByOriginNormal(origin=flatten_2, normal=flatten)
intersect = Geometry.Intersect(geometry=select_face, other=byOriginNormal, lacing=CrossProduct)
reverse = Curve.Reverse(intersect)
levels = Levels("A_00_FFL_Site Plan6")
structural_column_types = StructuralColumnTypes("WWF500x306")
columnByCurve = StructuralFraming.ColumnByCurve(curve=reverse, level=levels, structuralColumnType=structural_column_types)
create_4 = List.Create()
select_edge_2 = DSEdgeSelection()  # 1 picked in the model
code_block_5 = CodeBlock { 2000; 0; }
divideByLengthFromParameter_3 = Curve.DivideByLengthFromParameter(select_edge_2, code_block_5.out0, code_block_5.out1)
code_block_6 = CodeBlock { 0; }
tangentAtParameter_4 = Curve.TangentAtParameter(divideByLengthFromParameter_3, code_block_6)
code_block_7 = CodeBlock { 1; }
tangentAtParameter_5 = Curve.TangentAtParameter(select_edge_2, code_block_7)
create_5 = List.Create(tangentAtParameter_4, tangentAtParameter_5)
flatten_3 = Flatten(create_5)
startPoint_2 = Curve.StartPoint(divideByLengthFromParameter_3)
endPoint_3 = Cone.EndPoint(select_edge_2)
create_6 = List.Create(startPoint_2, endPoint_3)
flatten_4 = Flatten(create_6)
combine_2 = List.Combine(create_4, flatten_3, flatten_4)
select_face_2 = DSFaceSelection()  # 1 picked in the model
byOriginNormal_2 = Plane.ByOriginNormal(origin=flatten_4, normal=flatten_3)
intersect_2 = Geometry.Intersect(geometry=select_face_2, other=byOriginNormal_2, lacing=CrossProduct)
reverse_2 = Curve.Reverse(intersect_2)
levels_2 = Levels("A_00_FFL_Site Plan6")
structural_column_types_2 = StructuralColumnTypes("WWF500x306")
columnByCurve_2 = StructuralFraming.ColumnByCurve(curve=reverse_2, level=levels_2, structuralColumnType=structural_column_types_2)
create_7 = List.Create()
select_edge_3 = DSEdgeSelection()  # 1 picked in the model
code_block_8 = CodeBlock { 2000; 0; }
divideByLengthFromParameter_4 = Curve.DivideByLengthFromParameter(select_edge_3, code_block_8.out0, code_block_8.out1)
code_block_9 = CodeBlock { 0; }
tangentAtParameter_6 = Curve.TangentAtParameter(divideByLengthFromParameter_4, code_block_9)
lastItem_2 = List.LastItem(divideByLengthFromParameter_4)
code_block_10 = CodeBlock { 1; }
tangentAtParameter_7 = Curve.TangentAtParameter(lastItem_2, code_block_10)
code_block_11 = CodeBlock { 1; }
tangentAtParameter_8 = Curve.TangentAtParameter(select_edge_3, code_block_11)
create_8 = List.Create(tangentAtParameter_6, tangentAtParameter_7, tangentAtParameter_8)
flatten_5 = Flatten(create_8)
startPoint_3 = Curve.StartPoint(divideByLengthFromParameter_4)
divideByLengthFromParameter_5 = Curve.DivideByLengthFromParameter(lastItem_2, code_block_8.out0, code_block_8.out1)
endPoint_4 = Curve.EndPoint(divideByLengthFromParameter_5)
endPoint_5 = Cone.EndPoint(select_edge_3)
create_9 = List.Create(startPoint_3, endPoint_4, endPoint_5)
flatten_6 = Flatten(create_9)
combine_3 = List.Combine(create_7, flatten_5, flatten_6)
select_face_3 = DSFaceSelection()  # 1 picked in the model
byOriginNormal_3 = Plane.ByOriginNormal(origin=flatten_6, normal=flatten_5)
intersect_3 = Geometry.Intersect(geometry=select_face_3, other=byOriginNormal_3, lacing=CrossProduct)
reverse_3 = Curve.Reverse(intersect_3)
levels_3 = Levels("A_00_FFL_Site Plan6")
structural_column_types_3 = StructuralColumnTypes("WWF500x306")
columnByCurve_3 = StructuralFraming.ColumnByCurve(curve=intersect_3, level=levels_3, structuralColumnType=structural_column_types_3)
code_block_12 = CodeBlock { 4; }
divideEqually = Curve.DivideEqually(intersect_3, code_block_12)
endPoint_6 = Curve.EndPoint(divideEqually)
transpose = List.Transpose(endPoint_6)
code_block_13 = CodeBlock { 4; }
divideEqually_2 = Curve.DivideEqually(intersect, code_block_13)
transpose_2 = List.Transpose(divideEqually_2)
endPoint_7 = Curve.EndPoint(transpose_2)
transpose_3 = List.Transpose(endPoint_7)
code_block_14 = CodeBlock { 1; }
byControlPoints = NurbsCurve.ByControlPoints(transpose_3, code_block_14)
