# Dynamo graph moving facade - 01.dyn (Dynamo 0.8.0.950)

select_edge = DSEdgeSelection()  # 1 picked in the model
code_block = CodeBlock { 425; }
offset = Curve.Offset(curve=select_edge, distance=code_block)
code_block_2 = CodeBlock { 13; }
divideEqually = Curve.DivideEqually(offset, code_block_2)
restOfItems = List.RestOfItems(divideEqually)
startPoint = Curve.StartPoint(restOfItems)
code_block_3 = CodeBlock { 50; }
byCenterPointRadius = Circle.ByCenterPointRadius(centerPoint=startPoint, radius=code_block_3)
ZAxis = Vector.ZAxis()
code_block_4 = CodeBlock(x=code_block_3) { x*2; }
code_block_5 = CodeBlock(x=code_block_4) { x*2; }
code_block_6 = CodeBlock(x=code_block_5) { 3000-x; }
code_block_7 = CodeBlock(x=code_block_4, y=code_block_6) { x+y; }
translate = Geometry.Translate(geometry=byCenterPointRadius, direction=ZAxis, distance=code_block_7)
extrudeAsSolid = Curve.ExtrudeAsSolid(curve=translate, direction=ZAxis, distance=code_block_4)
extrudeAsSolid_2 = Curve.ExtrudeAsSolid(curve=byCenterPointRadius, direction=ZAxis, distance=code_block_4)
select_edge_2 = DSEdgeSelection()  # 1 picked in the model
code_block_8 = CodeBlock { 425; }
offset_2 = Curve.Offset(curve=select_edge_2, distance=code_block_8)
code_block_9 = CodeBlock { 13; }
divideEqually_2 = Curve.DivideEqually(offset_2, code_block_9)
restOfItems_2 = List.RestOfItems(divideEqually_2)
startPoint_2 = Curve.StartPoint(restOfItems_2)
code_block_10 = CodeBlock { 50; }
byCenterPointRadius_2 = Circle.ByCenterPointRadius(centerPoint=startPoint_2, radius=code_block_10)
ZAxis_2 = Vector.ZAxis()
code_block_11 = CodeBlock(x=code_block_10) { x*2; }
extrudeAsSolid_3 = Curve.ExtrudeAsSolid(curve=byCenterPointRadius_2, direction=ZAxis_2, distance=code_block_11)
code_block_12 = CodeBlock(x=code_block_11) { x*2; }
code_block_13 = CodeBlock(x=code_block_12) { 3000-x; }
code_block_14 = CodeBlock(x=code_block_11, y=code_block_13) { x+y; }
translate_2 = Geometry.Translate(geometry=byCenterPointRadius_2, direction=ZAxis_2, distance=code_block_14)
extrudeAsSolid_4 = Curve.ExtrudeAsSolid(curve=translate_2, direction=ZAxis_2, distance=code_block_11)
select_edge_3 = DSEdgeSelection()  # 1 picked in the model
code_block_15 = CodeBlock { 425; }
offset_3 = Curve.Offset(curve=select_edge_3, distance=code_block_15)
code_block_16 = CodeBlock { 13; }
divideEqually_3 = Curve.DivideEqually(offset_3, code_block_16)
restOfItems_3 = List.RestOfItems(divideEqually_3)
startPoint_3 = Curve.StartPoint(restOfItems_3)
code_block_17 = CodeBlock { 50; }
byCenterPointRadius_3 = Circle.ByCenterPointRadius(centerPoint=startPoint_3, radius=code_block_17)
ZAxis_3 = Vector.ZAxis()
code_block_18 = CodeBlock(x=code_block_17) { x*2; }
extrudeAsSolid_5 = Curve.ExtrudeAsSolid(curve=byCenterPointRadius_3, direction=ZAxis_3, distance=code_block_18)
code_block_19 = CodeBlock(x=code_block_18) { x*2; }
code_block_20 = CodeBlock(x=code_block_19) { 3000-x; }
code_block_21 = CodeBlock(x=code_block_18, y=code_block_20) { x+y; }
translate_3 = Geometry.Translate(geometry=byCenterPointRadius_3, direction=ZAxis_3, distance=code_block_21)
extrudeAsSolid_6 = Curve.ExtrudeAsSolid(curve=translate_3, direction=ZAxis_3, distance=code_block_18)
select_edge_4 = DSEdgeSelection()  # 1 picked in the model
code_block_22 = CodeBlock { 425; }
offset_4 = Curve.Offset(curve=select_edge_4, distance=code_block_22)
code_block_23 = CodeBlock { 13; }
divideEqually_4 = Curve.DivideEqually(offset_4, code_block_23)
restOfItems_4 = List.RestOfItems(divideEqually_4)
startPoint_4 = Curve.StartPoint(restOfItems_4)
code_block_24 = CodeBlock { 50; }
byCenterPointRadius_4 = Circle.ByCenterPointRadius(centerPoint=startPoint_4, radius=code_block_24)
ZAxis_4 = Vector.ZAxis()
code_block_25 = CodeBlock(x=code_block_24) { x*2; }
extrudeAsSolid_7 = Curve.ExtrudeAsSolid(curve=byCenterPointRadius_4, direction=ZAxis_4, distance=code_block_25)
code_block_26 = CodeBlock(x=code_block_25) { x*2; }
code_block_27 = CodeBlock(x=code_block_26) { 3000-x; }
code_block_28 = CodeBlock(x=code_block_25, y=code_block_27) { x+y; }
translate_4 = Geometry.Translate(geometry=byCenterPointRadius_4, direction=ZAxis_4, distance=code_block_28)
extrudeAsSolid_8 = Curve.ExtrudeAsSolid(curve=translate_4, direction=ZAxis_4, distance=code_block_25)
select_edge_5 = DSEdgeSelection()  # 1 picked in the model
code_block_29 = CodeBlock { 425; }
offset_5 = Curve.Offset(curve=select_edge_5, distance=code_block_29)
code_block_30 = CodeBlock { 13; }
divideEqually_5 = Curve.DivideEqually(offset_5, code_block_30)
restOfItems_5 = List.RestOfItems(divideEqually_5)
startPoint_5 = Curve.StartPoint(restOfItems_5)
code_block_31 = CodeBlock { 50; }
byCenterPointRadius_5 = Circle.ByCenterPointRadius(centerPoint=startPoint_5, radius=code_block_31)
ZAxis_5 = Vector.ZAxis()
code_block_32 = CodeBlock(x=code_block_31) { x*2; }
extrudeAsSolid_9 = Curve.ExtrudeAsSolid(curve=byCenterPointRadius_5, direction=ZAxis_5, distance=code_block_32)
code_block_33 = CodeBlock(x=code_block_32) { x*2; }
code_block_34 = CodeBlock(x=code_block_33) { 3000-x; }
code_block_35 = CodeBlock(x=code_block_32, y=code_block_34) { x+y; }
translate_5 = Geometry.Translate(geometry=byCenterPointRadius_5, direction=ZAxis_5, distance=code_block_35)
extrudeAsSolid_10 = Curve.ExtrudeAsSolid(curve=translate_5, direction=ZAxis_5, distance=code_block_32)
translate_6 = Geometry.Translate(geometry=startPoint, direction=ZAxis, distance=code_block_4)
firstItem = List.FirstItem(divideEqually)
length = Curve.Length(firstItem)
code_block_36 = CodeBlock { 20; }
code_block_37 = CodeBlock(x=length, y=code_block_36) { (x/2)-y; }
code_block_38 = CodeBlock { 50; }
byOriginRadii = Ellipse.ByOriginRadii(translate_6, code_block_37, code_block_38)
ZAxis_6 = Vector.ZAxis()
extrudeAsSolid_11 = Curve.ExtrudeAsSolid(curve=byOriginRadii, direction=ZAxis_6, distance=code_block_6)
ZAxis_7 = Vector.ZAxis()
code_block_39 = CodeBlock { 0; 12; }
number_slider = DoubleSlider(0, range=0..10 step 0.1)
number_sequence = NumberSeq(code_block_39.out0, code_block_39.out1, number_slider, lacing=Longest)
rotate = Geometry.Rotate(geometry=extrudeAsSolid_11, origin=translate_6, axis=ZAxis_7, degrees=number_sequence)
translate_7 = Geometry.Translate(geometry=startPoint_2, direction=ZAxis_2, distance=code_block_11)
firstItem_2 = List.FirstItem(divideEqually_2)
length_2 = Curve.Length(firstItem_2)
code_block_40 = CodeBlock { 20; }
code_block_41 = CodeBlock(x=length_2, y=code_block_40) { (x/2)-y; }
code_block_42 = CodeBlock { 50; }
byOriginRadii_2 = Ellipse.ByOriginRadii(translate_7, code_block_41, code_block_42)
ZAxis_8 = Vector.ZAxis()
extrudeAsSolid_12 = Curve.ExtrudeAsSolid(curve=byOriginRadii_2, direction=ZAxis_8, distance=code_block_13)
ZAxis_9 = Vector.ZAxis()
number_slider_2 = DoubleSlider(10, range=0..10 step 0.01)
code_block_43 = CodeBlock(x=number_sequence, y=number_slider_2) { x+y; }
rotate_2 = Geometry.Rotate(geometry=extrudeAsSolid_12, origin=translate_7, axis=ZAxis_9, degrees=code_block_43)
translate_8 = Geometry.Translate(geometry=startPoint_3, direction=ZAxis_3, distance=code_block_18)
firstItem_3 = List.FirstItem(divideEqually_3)
length_3 = Curve.Length(firstItem_3)
code_block_44 = CodeBlock { 20; }
code_block_45 = CodeBlock(x=length_3, y=code_block_44) { (x/2)-y; }
code_block_46 = CodeBlock { 50; }
byOriginRadii_3 = Ellipse.ByOriginRadii(translate_8, code_block_45, code_block_46)
ZAxis_10 = Vector.ZAxis()
extrudeAsSolid_13 = Curve.ExtrudeAsSolid(curve=byOriginRadii_3, direction=ZAxis_10, distance=code_block_20)
ZAxis_11 = Vector.ZAxis()
code_block_47 = CodeBlock(x=code_block_43, y=number_slider_2) { x+y; }
rotate_3 = Geometry.Rotate(geometry=extrudeAsSolid_13, origin=translate_8, axis=ZAxis_11, degrees=code_block_47)
translate_9 = Geometry.Translate(geometry=startPoint_4, direction=ZAxis_4, distance=code_block_25)
firstItem_4 = List.FirstItem(divideEqually_4)
length_4 = Curve.Length(firstItem_4)
code_block_48 = CodeBlock { 20; }
code_block_49 = CodeBlock(x=length_4, y=code_block_48) { (x/2)-y; }
code_block_50 = CodeBlock { 50; }
byOriginRadii_4 = Ellipse.ByOriginRadii(translate_9, code_block_49, code_block_50)
ZAxis_12 = Vector.ZAxis()
extrudeAsSolid_14 = Curve.ExtrudeAsSolid(curve=byOriginRadii_4, direction=ZAxis_12, distance=code_block_27)
ZAxis_13 = Vector.ZAxis()
code_block_51 = CodeBlock(x=code_block_47, y=number_slider_2) { x+y; }
rotate_4 = Geometry.Rotate(geometry=extrudeAsSolid_14, origin=translate_9, axis=ZAxis_13, degrees=code_block_51)
translate_10 = Geometry.Translate(geometry=startPoint_5, direction=ZAxis_5, distance=code_block_32)
firstItem_5 = List.FirstItem(divideEqually_5)
length_5 = Curve.Length(firstItem_5)
code_block_52 = CodeBlock { 20; }
code_block_53 = CodeBlock(x=length_5, y=code_block_52) { (x/2)-y; }
code_block_54 = CodeBlock { 50; }
byOriginRadii_5 = Ellipse.ByOriginRadii(translate_10, code_block_53, code_block_54)
ZAxis_14 = Vector.ZAxis()
extrudeAsSolid_15 = Curve.ExtrudeAsSolid(curve=byOriginRadii_5, direction=ZAxis_14, distance=code_block_34)
ZAxis_15 = Vector.ZAxis()
code_block_55 = CodeBlock(x=code_block_51, y=number_slider_2) { x+y; }
rotate_5 = Geometry.Rotate(geometry=extrudeAsSolid_15, origin=translate_10, axis=ZAxis_15, degrees=code_block_55)
create = List.Create(rotate, rotate_2, rotate_3, rotate_4, rotate_5)
byGeometries = ImportInstance.ByGeometries()
