# Dynamo graph new attempt 1 working 2a.dyn (Dynamo 0.7.6.4190)

code_block = CodeBlock { 0; 0; 0; }
byCoordinates = Point.ByCoordinates(code_block.out0, code_block.out1, code_block.out2)
integer_slider = IntegerSlider(20, range=5..20 step 1)
integer_slider_2 = IntegerSlider(26, range=10..30 step 1)
byOriginRadii = Ellipse.ByOriginRadii(byCoordinates, integer_slider, integer_slider_2)
code_block_2 = CodeBlock { 1.05; 1.3; 0.03; }
number_range = NumberRange(code_block_2.out0, code_block_2.out1, code_block_2.out2, lacing=Longest)
scale = Geometry.Scale(byOriginRadii, number_range, number_range, number_range)
ZAxis = Vector.ZAxis()
code_block_3 = CodeBlock { 0.1; }
code_block_4 = CodeBlock { 1; }
flatten = List.Flatten(scale, code_block_4)
count = List.Count(flatten)
number_slider = DoubleSlider(1.68, range=1..2 step 0.01)
number_sequence = NumberSeq(code_block_3, count, number_slider, lacing=Longest)
translate = Geometry.Translate(scale, ZAxis, number_sequence)
flatten_2 = Flatten(translate)
restOfItems = List.RestOfItems(flatten_2)
restOfItems_2 = List.RestOfItems(restOfItems)
restOfItems_3 = List.RestOfItems(restOfItems_2)
restOfItems_4 = List.RestOfItems(restOfItems_3)
restOfItems_5 = List.RestOfItems(restOfItems_4)
firstItem = List.FirstItem(restOfItems_5)
firstItem_2 = List.FirstItem(flatten_2)
firstItem_3 = List.FirstItem(restOfItems)
firstItem_4 = List.FirstItem(restOfItems_2)
firstItem_5 = List.FirstItem(restOfItems_3)
firstItem_6 = List.FirstItem(restOfItems_4)
code_block_5 = CodeBlock { 0.55; }
scale_2 = Geometry.Scale(byOriginRadii, code_block_5, code_block_5, code_block_5)
ZAxis_2 = Vector.ZAxis()
lastItem = List.LastItem(number_sequence)
number_slider_2 = DoubleSlider(0.57, range=0..1 step 0.01)
code_block_6 = CodeBlock(x=lastItem, y=number_slider_2) { x*y; }
translate_2 = Geometry.Translate(scale_2, ZAxis_2, code_block_6)
create = List.Create(firstItem_2, firstItem_3, firstItem_4, firstItem_5, firstItem_6, translate_2)
byLoft = Surface.ByLoft(create)
code_block_7 = CodeBlock { 0.3; }
scale_3 = Geometry.Scale(byOriginRadii, code_block_7, code_block_7, code_block_7)
ZAxis_3 = Vector.ZAxis()
byOriginNormal = Plane.ByOriginNormal(byCoordinates, ZAxis_3)
code_block_8 = CodeBlock { 76; }
rotate = Geometry.Rotate(scale_3, byOriginNormal, code_block_8)
code_block_9 = CodeBlock { 20; }
divideEqually = Curve.DivideEqually(rotate, code_block_9)
flatten_3 = Flatten(divideEqually)
endPoint = Curve.EndPoint(flatten_3)
code_block_10 = CodeBlock { 1.7; }
scale_4 = Geometry.Scale(byOriginRadii, code_block_10, code_block_10, code_block_10)
code_block_11 = CodeBlock { 20; }
divideEqually_2 = Curve.DivideEqually(scale_4, code_block_11)
flatten_4 = Flatten(divideEqually_2)
endPoint_2 = Curve.EndPoint(flatten_4)
byStartPointEndPoint = Line.ByStartPointEndPoint(endPoint, endPoint_2)
flatten_5 = Flatten(byStartPointEndPoint)
code_block_12 = CodeBlock { 1.7; }
scale_5 = Geometry.Scale(byOriginRadii, code_block_12, code_block_12, code_block_12)
ZAxis_4 = Vector.ZAxis()
byOriginNormal_2 = Plane.ByOriginNormal(byCoordinates, ZAxis_4)
code_block_13 = CodeBlock { 56; }
rotate_2 = Geometry.Rotate(scale_5, byOriginNormal_2, code_block_13)
code_block_14 = CodeBlock { 20; }
divideEqually_3 = Curve.DivideEqually(rotate_2, code_block_14)
flatten_6 = Flatten(divideEqually_3)
endPoint_3 = Curve.EndPoint(flatten_6)
code_block_15 = CodeBlock { 0.3; }
scale_6 = Geometry.Scale(byOriginRadii, code_block_15, code_block_15, code_block_15)
code_block_16 = CodeBlock { 20; }
divideEqually_4 = Curve.DivideEqually(scale_6, code_block_16)
flatten_7 = Flatten(divideEqually_4)
endPoint_4 = Curve.EndPoint(flatten_7)
byStartPointEndPoint_2 = Line.ByStartPointEndPoint(endPoint_3, endPoint_4)
flatten_8 = Flatten(byStartPointEndPoint_2)
create_2 = List.Create(flatten_5, flatten_8)
flatten_9 = Flatten(create_2)
ZAxis_5 = Vector.ZAxis()
projectInputOnto = Surface.ProjectInputOnto(byLoft, flatten_9, ZAxis_5)
code_block_17 = CodeBlock { 10; }
divideEqually_5 = Curve.DivideEqually(projectInputOnto, code_block_17)
endParameter = Curve.EndParameter(divideEqually_5)
normalAtParameter = Curve.NormalAtParameter(divideEqually_5, endParameter)
code_block_18 = CodeBlock { -0.9; }
offset = Surface.Offset(byLoft, code_block_18)
byGeometry = ImportInstance.ByGeometry(offset)
planeAtParameter = Curve.PlaneAtParameter(divideEqually_5, endParameter)
byWidthHeight = Rectangle.ByWidthHeight(planeAtParameter)
byLoft_2 = Surface.ByLoft(byWidthHeight)
byGeometries = ImportInstance.ByGeometries(byLoft_2)
