# Dynamo graph sheet empty01.dyn (Dynamo 1.3.4.6666)

file_path = Filename(".\Book 2.xlsx")
fromPath = FileObject(file_path)  # "File.FromPath"
code_block = CodeBlock { "Sheet1"; }
readFromFile = Excel.ReadFromFile(file=fromPath, sheetName=code_block)
code_block_2 = CodeBlock { 1; }
getItemAtIndex = List.GetItemAtIndex(list=readFromFile, index=code_block_2)
code_block_3 = CodeBlock { 0; }
getItemAtIndex_2 = List.GetItemAtIndex(list=readFromFile, index=code_block_3)
family_types = FamilyTypes("A1 metric:A1 metric")
byNameNumberTitleBlockAndView = Sheet.ByNameNumberTitleBlockAndView(sheetName=getItemAtIndex, sheetNumber=getItemAtIndex_2, titleBlockFamilyType=family_types)  # unwired: view
watch = Watch(byNameNumberTitleBlockAndView)
