# Dynamo graph spiral staircase - final.dyn (Dynamo 0.7.6.4190)

code_block = CodeBlock { 0..3000..25; }
count = Count(code_block)
code_block_2 = CodeBlock(x=count) { 270/x; }
floor = Math.Floor(code_block_2)
code_block_3 = CodeBlock { 0; }
number_sequence = NumberSeq(code_block_3, count, code_block_2, lacing=Longest)
code_block_4 = CodeBlock(x=code_block_2) { 0..270..x; }
lastItem = List.LastItem(code_block_4)
code_block_5 = CodeBlock { 0..3000..25; }
count_2 = Count(code_block_5)
code_block_6 = CodeBlock(x=count_2) { 270/x; }
floor_2 = Math.Floor(code_block_6)
code_block_7 = CodeBlock(x=code_block_6) { 0..270..x; }
lastItem_2 = List.LastItem(code_block_7)
code_block_8 = CodeBlock { 0; }
number_sequence_2 = NumberSeq(code_block_8, count_2, code_block_6, lacing=Longest)
code_block_9 = CodeBlock {  }
code_block_10 = CodeBlock { 0; }
byCoordinates = Point.ByCoordinates(code_block_10, code_block_10, code_block_10)
ZAxis = Vector.ZAxis()
byOriginNormal = Plane.ByOriginNormal(byCoordinates, ZAxis)
byPlane = CoordinateSystem.ByPlane(byOriginNormal)
code_block_11 = CodeBlock { 750; }
byCylindricalCoordinates = Point.ByCylindricalCoordinates(byPlane, code_block_7, code_block_5, code_block_11)
byControlPoints = NurbsCurve.ByControlPoints(byCylindricalCoordinates)
ZAxis_2 = Vector.ZAxis()
code_block_12 = CodeBlock { 5; }
code_block_13 = CodeBlock(X=code_block_12) { 360*X; }
code_block_14 = CodeBlock(x=code_block_13, y=count_2) { x/y; }
code_block_15 = CodeBlock(X=code_block_13, Y=code_block_14) { Math.Cos(0..X..Y)*200; }
code_block_16 = CodeBlock(y=code_block_15) { 900+y; }
translate = Geometry.Translate(byCylindricalCoordinates, ZAxis_2, code_block_16)
byControlPoints_2 = NurbsCurve.ByControlPoints(translate)
create = List.Create(byControlPoints, byControlPoints_2)
byLoft = Surface.ByLoft(create)
byGeometry = ImportInstance.ByGeometry(byLoft)
code_block_17 = CodeBlock(x=code_block_11) { x+1100; }
byCylindricalCoordinates_2 = Point.ByCylindricalCoordinates(byPlane, code_block_4, code_block, code_block_17)
ZAxis_3 = Vector.ZAxis()
code_block_18 = CodeBlock { 5; }
code_block_19 = CodeBlock(X=code_block_18) { 360*X; }
code_block_20 = CodeBlock(x=code_block_19, y=count) { x/y; }
code_block_21 = CodeBlock(X=code_block_19, Y=code_block_20) { Math.Cos(0..X..Y)*200; }
code_block_22 = CodeBlock(y=code_block_21) { 900+y; }
translate_2 = Geometry.Translate(byCylindricalCoordinates_2, ZAxis_3, code_block_22)
byControlPoints_3 = NurbsCurve.ByControlPoints(translate_2)
byControlPoints_4 = NurbsCurve.ByControlPoints(byCylindricalCoordinates_2)
create_2 = List.Create(byControlPoints_3, byControlPoints_4)
byLoft_2 = Surface.ByLoft(create_2)
byGeometry_2 = ImportInstance.ByGeometry(byLoft_2)
byControlPoints_5 = NurbsCurve.ByControlPoints(byCylindricalCoordinates)
byControlPoints_6 = NurbsCurve.ByControlPoints(byCylindricalCoordinates_2)
create_3 = List.Create(byControlPoints_5, byControlPoints_6)
byLoft_3 = Surface.ByLoft(create_3)
code_block_23 = CodeBlock { 100; }
thicken = Surface.Thicken(byLoft_3, code_block_23)
byGeometry_3 = ImportInstance.ByGeometry(thicken)
code_block_24 = CodeBlock { 150; }
code_block_25 = CodeBlock(x=code_block_24) { 0..3000..x; }
offset = Plane.Offset(byOriginNormal, code_block_25)
intersect = Geometry.Intersect(byLoft_3, offset)
restOfItems = List.RestOfItems(intersect)
restOfItems_2 = List.RestOfItems(offset)
firstItem = List.FirstItem(intersect)
startPoint = Curve.StartPoint(firstItem)
endPoint = Curve.EndPoint(firstItem)
byTwoPoints = Vector.ByTwoPoints(startPoint, endPoint)
restOfItems_3 = List.RestOfItems(intersect)
firstItem_2 = List.FirstItem(restOfItems_3)
startPoint_2 = Curve.StartPoint(firstItem_2)
endPoint_2 = Curve.EndPoint(firstItem_2)
byTwoPoints_2 = Vector.ByTwoPoints(startPoint_2, endPoint_2)
angleBetween = Vector.AngleBetween(byTwoPoints, byTwoPoints_2)
count_3 = Count(restOfItems)
cycle = List.Cycle(angleBetween, count_3)
code_block_26 = CodeBlock(x=cycle) { -x; }
rotate = Geometry.Rotate(restOfItems, restOfItems_2, code_block_26, lacing=Longest)
startPoint_3 = Curve.StartPoint(rotate)
endPoint_3 = Curve.EndPoint(rotate)
byStartPointEndPoint = Line.ByStartPointEndPoint(startPoint_3, endPoint_3)
ZAxis_4 = Vector.ZAxis()
reverse = Vector.Reverse(ZAxis_4)
extrude = Curve.Extrude(byStartPointEndPoint, reverse, code_block_24)
byGeometry_4 = ImportInstance.ByGeometry(extrude)
create_4 = List.Create()
startPoint_4 = Curve.StartPoint(restOfItems)
endPoint_4 = Curve.EndPoint(restOfItems)
byStartPointEndPoint_2 = Line.ByStartPointEndPoint(startPoint_4, endPoint_4)
flatten = Flatten(byStartPointEndPoint_2)
flatten_2 = Flatten(byStartPointEndPoint)
combine = List.Combine(create_4, flatten, flatten_2)
byLoft_4 = Surface.ByLoft(combine)
byGeometry_5 = ImportInstance.ByGeometry(byLoft_4)
