# Dynamo graph wall.dyn (Dynamo 1.3.4.6666)

number = DoubleInput(0)
byCoordinates = Point.ByCoordinates(y=number)
number_2 = DoubleInput(10)
byCoordinates_2 = Point.ByCoordinates(y=number_2)
byStartPointEndPoint = Line.ByStartPointEndPoint(startPoint=byCoordinates, endPoint=byCoordinates_2)
number_3 = DoubleInput(4000)
levels = Levels("Level 1")
wall_types = WallTypes("Wall 1")
byCurveAndHeight = Wall.ByCurveAndHeight(curve=byStartPointEndPoint, height=number_3, level=levels, wallType=wall_types)
byCoordinates_3 = Point.ByCoordinates()
