# Dynamo graph xmas tree.dyn (Dynamo 1.3.3.4111)

code_block = CodeBlock { 100; 90; 180; 160; 280; 10; }
byCenterPointRadius = Circle.ByCenterPointRadius(radius=code_block.out5)
code_block_2 = CodeBlock { -100; }
extrude = Curve.Extrude(byCenterPointRadius, code_block_2)
byCartesianCoordinates = Point.ByCartesianCoordinates(arg3=code_block.out0)
byPointsRadius = Cone.ByPointsRadius(arg1=byCartesianCoordinates, arg2=code_block.out0)
byUnion = Solid.ByUnion(byPointsRadius)
byCartesianCoordinates_2 = Point.ByCartesianCoordinates(arg3=code_block.out1)
byCartesianCoordinates_3 = Point.ByCartesianCoordinates(arg3=code_block.out2)
code_block_3 = CodeBlock { 80; }
byPointsRadius_2 = Cone.ByPointsRadius(byCartesianCoordinates_2, byCartesianCoordinates_3, code_block_3)
byUnion_2 = Solid.ByUnion(byPointsRadius_2)
union = Solid.Union(byUnion, byUnion_2)
byCartesianCoordinates_4 = Point.ByCartesianCoordinates(arg3=code_block.out3)
byCartesianCoordinates_5 = Point.ByCartesianCoordinates(arg3=code_block.out4)
code_block_4 = CodeBlock { 70; }
byPointsRadius_3 = Cone.ByPointsRadius(byCartesianCoordinates_4, byCartesianCoordinates_5, code_block_4)
byUnion_3 = Solid.ByUnion(byPointsRadius_3)
union_2 = Solid.Union(union, byUnion_3)
code_block_5 = CodeBlock { 255; }
byARGB = Color.ByARGB(g=code_block_5)
byGeometryColor = Display.Display.ByGeometryColor(union_2, byARGB)
